# Grasshopper definition 2D-Indoor.gh (Grasshopper 1.0.7)
# plug-ins: ProceduralCS

# ----
# Mesh Settings
number_slider = Slider(15, range=0..100)
custom_mesh_settings = SettingsCustom(
    StitchSeams=True,
    SimplePlanes=Toggle(True),
    Refine=True,
    MinCount=number_slider,
    MaxCount=400,
    AspectRatio=20,
    MaxDistance=0,
    MaxAngle=Slider(18, range=0..100),
    MinEdge=0,
    MaxEdge=0)

number_slider_2 = Slider(3, range=0..10)
roof = Brep(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)
walls = Brep([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])
openings = Brep([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])
people = Brep([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])
facade = Brep([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])
railing = Brep([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])
slabs = Brep([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])
smooth = SettingsQuality()
join = BrepJoin(Breps=[roof, walls])  # -> Breps, Closed
mesh = MeshBrep(Brep=people, Settings=custom_mesh_settings)
mesh_2 = MeshBrep(Brep=facade, Settings=custom_mesh_settings)
mesh_3 = MeshBrep(Brep=openings, Settings=custom_mesh_settings)
mesh_4 = MeshBrep(Brep=slabs, Settings=custom_mesh_settings)
mesh_5 = MeshBrep(Brep=join.Breps, Settings=smooth)
mesh_6 = MeshBrep(Brep=railing, Settings=custom_mesh_settings)
setnames = SetNames(Objs=mesh, Names="people")
setnames_2 = SetNames(Objs=mesh_2, Names="facade")
setnames_3 = SetNames(Objs=mesh_3, Names="openings")
setnames_4 = SetNames(Objs=mesh_4, Names="slab")
setnames_5 = SetNames(Objs=mesh_5, Names="envolope")
setnames_6 = SetNames(Objs=mesh_6, Names="railing")
mesh_level = CFDMeshLevel(Objs=setnames, MinLevel=number_slider_2, MaxLevel=0)
mesh_level_2 = CFDMeshLevel(Objs=setnames_2, MinLevel=number_slider_2, MaxLevel=0)
mesh_level_3 = CFDMeshLevel(Objs=setnames_3, MinLevel=number_slider_2, MaxLevel=0)
mesh_level_4 = CFDMeshLevel(Objs=setnames_4, MinLevel=number_slider_2, MaxLevel=0)
mesh_level_5 = CFDMeshLevel(Objs=setnames_5, MinLevel=number_slider_2, MaxLevel=0)
mesh_level_6 = CFDMeshLevel(Objs=setnames_6, MinLevel=number_slider_2, MaxLevel=0)

# ----
# LOGIN TO COMPUTE
panel = Panel("https://compute.procedural.build")
# 0)
password = Text()
login = ComputeLogin(Username="INSERT YOUR USERNAME HERE", Password=password, ComputeURL=panel, Retry=Button())

heat = Geometry([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])
mesh_7 = MeshBrep(Brep=heat, Settings=custom_mesh_settings)
number_slider_3 = Slider(1, range=0..10)
setnames_7 = SetNames(Objs=mesh_7, Names="heatZone")
refinement_region = RefinementRegion(Meshes=setnames_7, Location="inside", MinLevel=number_slider_3, MaxLevel=number_slider_3)

# ----
# GET OR CREATE
# PROJECT AND TASK
panel_2 = Panel("Version 1")
# 1)
project_and_task = GetOrCreateProjectAndTask(Auth=login, ProjectName="2D Indoor", ProjectNumber="20200910", TaskName=panel_2, Create=Button())

# ----
# Inlet/Outlet
panel_3 = Panel("""{
'U': '{ value uniform (0 0.4 0); }',
'T': '{ type fixedValue; value uniform 290.15; }'
}""")
panel_4 = Panel("""{
'U': '{ value uniform (0 -0.4 0); }',
'T': '{ type fixedValue; value uniform 290.15; }'
}""")
panel_5 = Panel("""openings.__2
openings.__3
openings.__4""")
cfd_bc = CFDBoundaryCondition(Names="openings.__0", Preset=2, Overrides=panel_4)
cfd_bc_2 = CFDBoundaryCondition(Names="openings.__1", Preset=2, Overrides=panel_3)
cfd_bc_3 = CFDBoundaryCondition(Names=panel_5, Preset=2, Overrides="{'U': '{ value uniform (0 0 0.6); }'}")
cfd_bc_4 = CFDBoundaryCondition(Names="openings.__5", Preset=4)
merge = Merge(Data1=cfd_bc, Data2=cfd_bc_2, Data3=cfd_bc_3, Data4=cfd_bc_4)

# ----
# SET BOUNDARY CONDITIONS
panel_6 = Panel("{ 'T': '{ type fixedValue; value uniform 310.15; }' }")
getnames = GetNames(Objs=[mesh_level_2, mesh_level_5, mesh_level_4, mesh_level_6])
getnames_2 = GetNames(Objs=mesh_level)
panel_7 = Panel("""MaxZ
MinZ
MinX
MaxX""")
panel_8 = Panel("""MinY
MaxY""")
cfd_bc_5 = CFDBoundaryCondition(Names=[panel_8, getnames], Preset=0)
cfd_bc_6 = CFDBoundaryCondition(Names=panel_7, Preset=1, Overrides="{ 'T': '{ type zeroGradient; }' }")
cfd_bc_7 = CFDBoundaryCondition(Names=getnames_2, Preset=0, Overrides=panel_6)
merge_2 = Merge(Data1=cfd_bc_5, Data2=cfd_bc_6, Data4=cfd_bc_7, Data5=merge)  # -> flatten(Result)

toggle = BooleanToggle(False)

pt = ConstructPoint(XCoordinate=6, YCoordinate=0, ZCoordinate=0)
getnames_3 = GetNames(Objs=refinement_region)
yz = YZPlane(Origin=pt)
list = ValueList({"3D": 0, "2D": 1}, selected="2D")
setset = CFDSetSet(Names=getnames_3, Location=[True, True, False])
domain = CFDDomain(
    Objects=[mesh_level, mesh_level_3, mesh_level_2, mesh_level_5, mesh_level_4, mesh_level_6, refinement_region],
    DomainType=list,
    CellSize=Slider(0.5, range=0..24),
    Z0=toggle,
    CenterXY=toggle,
    Square=True,
    XYScale=Slider(1.1, range=0..10),
    XYOffset=Slider(0, range=0..100),
    ZScale=Slider(1, range=0..10),
    Plane=yz)  # -> Output, Info, BoundingBox, Mesh
panel_9 = Panel(domain.Info)
mesh_8 = ComputeMesh(Input=project_and_task, Domain=domain.Output, SetSet=setset)

# ----
# Open Compute in Browser
button = Button()
# 1a)
launch_browser = PythonScript(input=project_and_task, open=button)  # -> out
# ---------- launch_browser: Python ----------
import webbrowser
import json

taskId = ""
projectId = ""
url = ""

if input:
    input_ = json.loads(input)
    task = input_.get("task")
    project = input_.get("project")
    url = input_.get("url")
    if task:
        taskId = task.get("uid")
    if project:
        projectId = project.get("uid")



if url and taskId:
    url = url + "/project/" + projectId + "/task/" + taskId
    print url
else:
    print "Please provide input from Task/Project component"
    print "GOT url:", url, "TaskId:", taskId
if open:
    webbrowser.open(url, new=2)
# ---------- end launch_browser ----------
panel_10 = Panel(launch_browser)

# ----
# SETUP SOLVER
panel_11 = Panel("""/* These overrides will override settings within casefiles.  

The case file that you specify will be created if it does not exist. 

Note that we use a ">" to define path separators (not a slash "/")
this is because the backend data structure does not support slashes in
a dictionary key.

A case file override looks like this:
```
constant>porosityProperties {
    testKey value;
}
```
*/

decomposeParDict {
numberOfSubdomains 6;
simpleCoeffs { n (3 2 1); }
hierarchicalCoeffs { n (3 2 1); }
}

system>fvOptions {
//************************

heatZone.__0
{
  type scalarSemiImplicitSource;
  active true;
  selectionMode cellSet;

  scalarSemiImplicitSourceCoeffs
  {
    cellSet heatZone.__0;    
    selectionMode cellSet;
    volumeMode  specific; // absolute
    injectionRateSuSp
    {
      h (130.15 0);
    }
  }
}


heatZone.__1
{
  type scalarSemiImplicitSource;
  active true;
  selectionMode cellSet;

  scalarSemiImplicitSourceCoeffs
  {
    cellSet heatZone.__1;     
    selectionMode cellSet;
    volumeMode  specific; // absolute
    injectionRateSuSp
    {
      h (130.15 0);
    }
  }
}


//************************
}""")
panel_12 = Panel("""/* 
This is a OpenFOAM formatted dictionary that defines overrides that will be
applied to the "fields" definition of your case.  

The fields dictionary defines which fields will be used (the files in the 0 folder).
Applying overrides here allows you to define additional fields for the calculation.

A field will look like this:
```
U
{
  classType volVectorField;
  dimensions [ 0 1 -1 0 0 0 0 ];
  internalField uniform (0 0 0);
}
```
*/

T
{
  internalField uniform 294.15;
}""")
list_2 = ValueList({"simpleFoam": 0, "potentialFoam": 1, "pisoFoam": 2, "buoyantSimpleFoam": 3, "buoyantPimpleFoam": 4, "buoyantBoussinesqSimpleFoam": 5, "buoyantBoussinesqPimpleFoam": 6}, selected="buoyantSimpleFoam")
list_3 = ValueList({"SimpleCase": 0, "VirtualWindTunnel": 1, "MeshOnly": 2}, selected="SimpleCase")
overrides = GhPythonScript(fields=panel_12, caseFiles=panel_11)  # -> overrides; inputs fields: list, presets: list, caseFiles: list
# ---------- overrides: Python ----------
__author__ = "markp"
__version__ = "2020.09.11"

import json

overrides = json.dumps({"setup": setup, "fields": fields, "presets": presets, "caseFiles": caseFiles})
# ---------- end overrides ----------
# 2)
cfd_solution = ComputeSolution(
    Input=mesh_8,
    CPUs=Slider(2, range=1..24),
    Solver=list_2,
    CaseType=list_3,
    BoundaryConditions=merge_2,
    Iterations=Slider(250, range=0..1000),
    NumberOfAngles=16,
    Overrides=overrides)

# ----
# RUN ON COMPUTE
# 3)
button_2 = Button()
compute = Compute(Input=cfd_solution, Mesh=domain.Mesh, Compute=button_2)  # -> Info, Output
panel_13 = Panel(compute.Info)

# ----
# CREATE A CUT PLANE
sec = BrepPlane(Brep=domain.BoundingBox, Plane=yz)  # -> Curves, Points
boundary = BoundarySurfaces(Edges=sec.Curves)
python = GhPythonScript(testGeometry=boundary, gridSize=Slider(0.1, range=0..3), distBaseSrf=Slider(0, range=0..3), moveTestMesh=Toggle(True))  # -> readMe, simplify(testPoints), ptsVectors, facesArea, simplify(mesh); inputs testGeometry: GeometryBase
# ---------- python: Python ----------
### THIS COMPONENT IS COPIED FROM LADYBUG TOOLS. 
### IT IS COPIED TO MAKE DISTRIBUTION OF THIS GRASSHOPPER SCRIPT EASIER, BY HAVING LESS DEPENDENCIES.
### PLEASE REPLACE WITH THE ORIGINAL COMPONENT IF YOU HAVE LADYBUG INSTALLED

"""
Use this component to genrate a mesh with corresponding test points.  The resulting mesh will be in a format that the Recolor Mesh component will accept.
-
Provided by Honeybee 0.0.59
    Args:
        _testSurface: Test surface as a Brep.
        _gridSize: Size of the test grid.
        _distBaseSrf: Distance from base surface.
        moveTestMesh_: Set to 'False' if you want test mesh not to move. Default is 'True'.
    Returns:
        readMe!: ...
        testPoints: Test points
        ptsVectors: Vectors
        faceArea: Area of each mesh face
        mesh: Analysis mesh
"""

import Rhino as rc
import Grasshopper.Kernel as gh
from itertools import chain
import System.Threading.Tasks as tasks

def createMesh(brep, gridSize):
    ## mesh breps
    def makeMeshFromSrf(i, inputBrep):
        try:
            mesh[i] = rc.Geometry.Mesh.CreateFromBrep(inputBrep, meshParam)[0]
            inputBrep.Dispose()
        except:
            print 'Error in converting Brep to Mesh...'
            pass

    # prepare bulk list for each surface
    mesh = [None] * len(brep)

    # set-up mesh parameters for each surface based on surface size
    meshParam = rc.Geometry.MeshingParameters.Default
    meshParam.MaximumEdgeLength = gridSize
    meshParam.MinimumEdgeLength = gridSize
    meshParam.GridAspectRatio = 1

    for i in range(len(mesh)): makeMeshFromSrf(i, brep[i])
    
    return mesh

def flattenList(l):return list(chain.from_iterable(l))

def getTestPts(inputMesh, movingDis, moveTestMesh= False, parallel = True):
        
        # preparing bulk lists
        testPoint = [[]] * len(inputMesh)
        srfNormals = [[]] * len(inputMesh)
        meshSrfCen = [[]] * len(inputMesh)
        meshSrfArea = [[]] * len(inputMesh)
        
        srfCount = 0
        for srf in inputMesh:
            testPoint[srfCount] = range(srf.Faces.Count)
            srfNormals[srfCount] = range(srf.Faces.Count)
            meshSrfCen[srfCount] = range(srf.Faces.Count)
            meshSrfArea[srfCount] = range(srf.Faces.Count)
            srfCount += 1

        try:
            def srfPtCalculator(i):
                # calculate face normals
                inputMesh[i].FaceNormals.ComputeFaceNormals()
                inputMesh[i].FaceNormals.UnitizeFaceNormals()
                
                for face in range(inputMesh[i].Faces.Count):
                    srfNormals[i][face] = (inputMesh[i].FaceNormals)[face] # store face normals
                    meshSrfCen[i][face] = inputMesh[i].Faces.GetFaceCenter(face) # store face centers
                    # calculate test points
                    if srfNormals[i][face]:
                        movingVec = rc.Geometry.Vector3f.Multiply(movingDis,srfNormals[i][face])
                        testPoint[i][face] = rc.Geometry.Point3d.Add(rc.Geometry.Point3d(meshSrfCen[i][face]), movingVec)
                    # make mesh surface, calculate the area, dispose the mesh and mass area calculation
                    tempMesh = rc.Geometry.Mesh()
                    tempMesh.Vertices.Add(inputMesh[i].Vertices[inputMesh[i].Faces[face].A]) #0
                    tempMesh.Vertices.Add(inputMesh[i].Vertices[inputMesh[i].Faces[face].B]) #1
                    tempMesh.Vertices.Add(inputMesh[i].Vertices[inputMesh[i].Faces[face].C]) #2
                    tempMesh.Vertices.Add(inputMesh[i].Vertices[inputMesh[i].Faces[face].D]) #3
                    tempMesh.Faces.AddFace(0, 1, 3, 2)
                    massData = rc.Geometry.AreaMassProperties.Compute(tempMesh)
                    meshSrfArea[i][face] = massData.Area
                    massData.Dispose()
                    tempMesh.Dispose()
                    
                    
        except:
            print 'Error in Extracting Test Points'
            pass
        
        # calling the function
        if parallel:
            tasks.Parallel.ForEach(range(len(inputMesh)),srfPtCalculator)
        else:
            for i in range(len(inputMesh)):
                srfPtCalculator(i)
        
        if moveTestMesh:
            # find surfaces based on first normal in srfNormals - It is a simplification we can write a better function for this later
            for meshCount, mesh in enumerate(inputMesh):
                vector = srfNormals[meshCount][0]
                vector.Unitize()
                vector = rc.Geometry.Vector3d.Multiply(movingDis, vector)
                mesh.Translate(vector.X, vector.Y, vector.Z)
                
        return flattenList(testPoint), flattenList(srfNormals), flattenList(meshSrfArea), inputMesh


if _testGeometry!=None:
    inputMesh = []
    
    if type(_testGeometry) == rc.Geometry.Mesh and _distBaseSrf!=None:
        ghenv.Component.Params.Input[1].Name = '.'
        ghenv.Component.Params.Input[1].NickName = '.'
        inputMesh.append(_testGeometry)
        
    elif _gridSize!=None and _distBaseSrf!=None:
        initMesh = createMesh([_testGeometry], _gridSize)
        for m in initMesh: inputMesh.append(m)   

    if _distBaseSrf<0:
        msg = "Distance from base should be greater than 0. Flip the input surface instead of using a negative number."
        ghenv.Component.AddRuntimeMessage(gh.GH_RuntimeMessageLevel.Warning, msg)
    else:
        testPoints, ptsVectors, facesArea, mesh = getTestPts(inputMesh, _distBaseSrf, moveTestMesh_)
# ---------- end python ----------

# ----
# Display
mesh_9 = Mesh(domain.Mesh)
# Get Started: If you haven't done already, sign up for a free user account at https://compute.procedural.build/ to get started!
# 
# 0) Add your username (email) and password.
# 
# 1) Update the project name, number and task name. To create the new project and task click the button.
# 
# 2) Update the solver configuration or leave the defaults.
# 
# 3) Click the button to upload and start simulating the case.
# 
# 4) Click the button to add the probe points.
# 
# 5) Wait for the simulation to finish and visualise the results. Connect the U and T values to the wire to see the results when they are done.
# 
# If you are having any questions, issues or feedback, you are welcome to post them at https://discourse.procedural.build/
# We will be there to answer any queries!
swatch = ColourSwatch(SwatchColor=RGB(0, 0, 0))
medges = MeshEdges(Mesh=mesh_9)  # -> NakedEdges, InteriorEdges, NonManifoldEdges
medges_2 = MeshEdges(Mesh=python.mesh)  # -> NakedEdges, InteriorEdges, NonManifoldEdges
wires = BrepWireframe(Brep=domain.BoundingBox, Density=-1)
preview = CustomPreview(Geometry=wires, Material=ColourSwatch(SwatchColor=RGB(0, 0, 0)))
preview_2 = CustomPreview(Geometry=domain.Mesh, Material=ColourSwatch(SwatchColor=RGB(153, 153, 153)))
preview_3 = CustomPreview(Geometry=[medges.NakedEdges, medges.InteriorEdges], Material=ColourSwatch(SwatchColor=RGB(0, 0, 0)))
preview_4 = CustomPreview(Geometry=[medges_2.NakedEdges, medges_2.InteriorEdges], Material=swatch)

facen = FaceNormals(Mesh=mesh_9)  # -> flatten(Centers), Normals
lng = ListLength(List=facen.Centers)
mesh_faces = Panel(lng)

# ----
# PROBE AND DOWNLOAD
button_3 = Button()
# 4)
panel_14 = Panel("foam/")
panel_15 = Panel("""U
T""")
probe_points = ProbePoints(
    Input=compute.Output,
    Points=python.testPoints,
    Names="slice",
    Fields=panel_15,
    CPUs=1,
    CaseDirectory=panel_14,
    Create=button_3)
folder_name = GhPythonScript(BasePath="C:\Procedural", ProjectName="2D Indoor", TaskName=panel_2)  # -> out, ProjectPath, TaskPath
# ---------- folder_name: Python ----------
__author__ = "kongsgaard"
__version__ = "2020.08.31"

import rhinoscriptsyntax as rs
import os

if not BasePath:
    BasePath = "C:\Procedural"

if not ProjectName:
    ProjectName = "Project"
else:
    project_name_ = ProjectName.replace(" ", "_")
    
if not TaskName:
    TaskName = "Task"
else:
    task_name_ = TaskName.replace(" ", "_")
    
ProjectPath = os.path.join(BasePath, project_name_)
TaskPath = os.path.join(BasePath, project_name_, task_name_)
# ---------- end folder_name ----------
concat = Concatenate(FragmentA=folder_name.TaskPath, FragmentB="\probeResults")
download = Download(Input=probe_points, DownloadPath="foam/postProcessing/internalCloud", LocalPath=concat, Reload=Button())

# ----
# VISUALIZE AIR FLOW
# VISUALIZE AIR FLOW
button_4 = Button()
# 5)
probe_results = ProbeResults(Folder=download, Mesh=python.mesh, Rerun=button_4)  # -> Info, Points, Mesh
connect_to_u = Relay()
# https://compute.procedural.build
panel_16 = Panel("{0;1}")
connect_to_t = Relay()
split = SplitTree(Data=connect_to_u, Masks=flatten(panel_16))  # -> Positive, Negative
split_2 = SplitTree(Data=connect_to_t, Masks=flatten("{0;1}"))  # -> Positive, Negative
vlen = VectorLength(Vector=split.Positive)
number_slider_4 = Slider(1, range=0..10)
subtraction = Subtraction(A=split_2.Positive, B=273.15)
bnd = Bounds(Numbers=vlen)
bnd_2 = Bounds(Numbers=subtraction)
dedomain = DeconstructDomain(Domain=bnd)  # -> Start, End
dedomain_2 = DeconstructDomain(Domain=bnd_2)  # -> Start, End
colors = Data([RGB(75, 107, 169), RGB(173, 203, 249), RGB(254, 244, 84), RGB(234, 126, 0), RGB(234, 38, 0)])
colors_2 = Data([RGB(75, 107, 169), RGB(173, 203, 249), RGB(254, 244, 84), RGB(234, 126, 0), RGB(234, 38, 0)])
recolor_mesh = RecolorMesh(
    Mesh=probe_results.Mesh,
    Result=subtraction,
    ListOfColors=colors,
    LowerBoundary=dedomain_2.Start,
    UpperBoundary=dedomain_2.End,
    Segments=10)  # -> ColoredMesh, Colors, Values
recolor_mesh_2 = RecolorMesh(
    Mesh=probe_results.Mesh,
    Result=vlen,
    ListOfColors=colors_2,
    LowerBoundary=dedomain.Start,
    UpperBoundary=number_slider_4,
    Segments=10)  # -> ColoredMesh, Colors, Values
python_2 = GhPythonScript(mesh=recolor_mesh.ColoredMesh, scale=1)  # -> out, text_point, rectangle
# ---------- python_2: Python ----------
__author__ = "kongs"
__version__ = "2020.09.15"

import rhinoscriptsyntax as rs


bb = rs.BoundingBox(mesh)

point = bb[2]
point.Y = point.Y * 1.05 * scale
plane = rs.MovePlane(rs.WorldYZPlane(), point)


width = (bb[2].Y - bb[0].Y) * 0.05 * scale
height = (bb[4].Z - bb[2].Z)
rectangle = rs.AddRectangle(plane, width, height)

point_ = bb[0]
point_.Z = point_.Z - (height * 0.2 * scale)
text_point = rs.MovePlane(rs.WorldYZPlane(), point_)
# ---------- end python_2 ----------
python_3 = GhPythonScript(mesh=recolor_mesh_2.ColoredMesh, scale=1)  # -> out, text_point, rectangle; same code as python_2
gradient = Gradient(
    LowerLimit=number_slider_4,
    UpperLimit=dedomain.Start,
    Parameter=vlen,
    stops=[0: RGB(234, 38, 0), 0.25: RGB(234, 126, 0), 0.5: RGB(254, 244, 84), 0.75: RGB(173, 203, 249), 1: RGB(75, 107, 169)])
legend = Legend(Colour=recolor_mesh.Colors, Tags=recolor_mesh.Values, Rectangle=python_2.rectangle, LegendType=1)
legend_2 = Legend(Colour=recolor_mesh_2.Colors, Tags=recolor_mesh_2.Values, Rectangle=python_3.rectangle, LegendType=1)
vdisex = VectorDisplayEx(Point=probe_results.Points, Vector=split.Positive, Colour=RGB(0, 0, 0), Width=2)
tag = TextTag3D(Location=python_2.text_point, Text="Temperature (C)", Size=1, Colour=RGB(0, 0, 0), Justification=1)
tag_2 = TextTag3D(Location=python_3.text_point, Text="Air Speed (m/s)", Size=1, Colour=RGB(0, 0, 0), Justification=1)
