# Grasshopper definition AnnualDaylight_benchmark.gh (Grasshopper 1.0.7)
# plug-ins: ProceduralCS

panel = Panel("http://192.168.0.226:8001")
panel_2 = Panel("4320lejre")
panel_3 = Panel("christian@procedural.build")

# ----
# LOGIN TO COMPUTE
# This demo is matching version 2020.12.0 of the ComputeGH plugin
panel_4 = Panel("http://192.168.1.128:8001")
panel_5 = Panel("admin")
# 0)
password = Text("0358d7bb")
login = ComputeLogin(Username=panel_5, Password=password, ComputeURL=panel_4, Retry=Button())

# ----
# SET NAMES
pipeline = GeometryPipeline(
    GroupByLayer=False,
    GroupByType=False,
    IncludeHidden=True,
    IncludeLocked=True,
    LayerFilter="Floor",
    NameFilter="*",
    SublayerFiltering=True,
    TypeFilter=1073741848)
pipeline_2 = GeometryPipeline(
    GroupByLayer=False,
    GroupByType=False,
    IncludeHidden=True,
    IncludeLocked=True,
    LayerFilter="ExteriorWalls",
    NameFilter="*",
    SublayerFiltering=True,
    TypeFilter=1073741848)
pipeline_3 = GeometryPipeline(
    GroupByLayer=False,
    GroupByType=False,
    IncludeHidden=True,
    IncludeLocked=True,
    LayerFilter="Ground",
    NameFilter="*",
    SublayerFiltering=True,
    TypeFilter=1073741848)
pipeline_4 = GeometryPipeline(
    GroupByLayer=False,
    GroupByType=False,
    IncludeHidden=True,
    IncludeLocked=True,
    LayerFilter="InteriorWalls",
    NameFilter="*",
    SublayerFiltering=True,
    TypeFilter=1073741848)
pipeline_5 = GeometryPipeline(
    GroupByLayer=False,
    GroupByType=False,
    IncludeHidden=True,
    IncludeLocked=True,
    LayerFilter="Ceiling",
    NameFilter="*",
    SublayerFiltering=True,
    TypeFilter=1073741848)
pipeline_6 = GeometryPipeline(
    GroupByLayer=False,
    GroupByType=False,
    IncludeHidden=True,
    IncludeLocked=True,
    LayerFilter="Glazing",
    NameFilter="*",
    SublayerFiltering=True,
    TypeFilter=1073741848)
mesh = MeshBrep(
    Brep=pipeline,
    Settings={GridMaxCount=0, GridMinCount=16, JaggedSeams=False, MaxEdgeLength=0, MinEdgeLength=0.0001, MinTolerance=0, Refine=True, RefineAngle=0, RelativeTolerance=0.65, SimplePlanes=True, Tolerance=0})
mesh_2 = MeshBrep(
    Brep=pipeline_3,
    Settings={GridMaxCount=0, GridMinCount=16, JaggedSeams=False, MaxEdgeLength=0, MinEdgeLength=0.0001, MinTolerance=0, Refine=True, RefineAngle=0, RelativeTolerance=0.65, SimplePlanes=True, Tolerance=0})
mesh_3 = MeshBrep(
    Brep=pipeline_5,
    Settings={GridMaxCount=0, GridMinCount=16, JaggedSeams=False, MaxEdgeLength=0, MinEdgeLength=0.0001, MinTolerance=0, Refine=True, RefineAngle=0, RelativeTolerance=0.65, SimplePlanes=True, Tolerance=0})
mesh_4 = MeshBrep(
    Brep=pipeline_2,
    Settings={GridMaxCount=0, GridMinCount=16, JaggedSeams=False, MaxEdgeLength=0, MinEdgeLength=0.0001, MinTolerance=0, Refine=True, RefineAngle=0, RelativeTolerance=0.65, SimplePlanes=True, Tolerance=0})
mesh_5 = MeshBrep(
    Brep=pipeline_4,
    Settings={GridMaxCount=0, GridMinCount=16, JaggedSeams=False, MaxEdgeLength=0, MinEdgeLength=0.0001, MinTolerance=0, Refine=True, RefineAngle=0, RelativeTolerance=0.65, SimplePlanes=True, Tolerance=0})
mesh_6 = MeshBrep(
    Brep=pipeline_6,
    Settings={GridMaxCount=0, GridMinCount=16, JaggedSeams=False, MaxEdgeLength=0, MinEdgeLength=0.0001, MinTolerance=0, Refine=True, RefineAngle=0, RelativeTolerance=0.65, SimplePlanes=True, Tolerance=0})
setnames = SetNames(Objs=mesh_4, Names="exterior_wall")
setnames_2 = SetNames(Objs=mesh, Names="floor")
setnames_3 = SetNames(Objs=mesh_2, Names="ground")
setnames_4 = SetNames(Objs=mesh_3, Names="ceiling")
setnames_5 = SetNames(Objs=mesh_6, Names="glazing")
setnames_6 = SetNames(Objs=mesh_5, Names="interior_wall")
merge = Merge(Data1=setnames, Data2=setnames_2, Data3=setnames_3, Data4=setnames_4, Data5=setnames_5, Data6=setnames_6)

# ----
# Display
merge_2 = Merge(Data1=pipeline_2, Data2=pipeline, Data3=pipeline_3, Data4=pipeline_5, Data5=pipeline_4)
# Get Started: If you haven't done already, sign up for a free user account at https://compute.procedural.build/ to get started!
# For this demo to work you need to download and install Ladybug/HoneyBee - Legacy! You can find the plugin here: https://www.food4rhino.com/app/ladybug-tools
# 
# 0) Add your username (email) and password.
# 
# 1) Update the project name, number and task name. To create the new project and task click the button.
# 
# 2) Update/Check the case setup. This is just a simple setup with HoneyBee, where we take the geometry, turn it into a HoneyBee zone and add windows a default constructions.
# 2a) We add the probe points that we want to have.
# 2b) We generate the HoneyBee recipe for a Daylight Factor calculation
# 2c) We write the HoneyBee case into the specified folder path
# 
# 3) Click the button to upload and start simulating the case.
# 
# 4) Wait for the simulation to finish. When the result files are downloaded you need to click refresh for the Daylight Folder lookup component to refresh.
# 
# 5) Visualise the results by making the colored mesh
# 
# If you are having any questions, issues or feedback, you are welcome to post them at https://discourse.procedural.build/
# We will be there to answer any queries!
swatch = ColourSwatch(SwatchColor=RGB(0, 0, 0))
medges = MeshEdges(Mesh=merge)  # -> NakedEdges, InteriorEdges, NonManifoldEdges
wires = BrepWireframe(Brep=merge_2, Density=-1)
preview = CustomPreview(Geometry=wires, Material=ColourSwatch(SwatchColor=RGB(0, 0, 0)))
preview_2 = CustomPreview(Geometry=[medges.NakedEdges, medges.InteriorEdges], Material=swatch)
preview_3 = CustomPreview(Geometry=mesh_6, Material=ColourSwatch(SwatchColor=RGBA(86, 126, 193, 171)))

# ----
# SET MATERIALS
panel_6 = Panel("clear.xml")
python = GhPythonScript(bsdf=panel_6)  # -> overrides
# ---------- python: Python ----------
__author__ = "Christian Kongsgaard"
__version__ = "2021.01.21"

import json


overrides = json.dumps({"bsdf": bsdf})
# ---------- end python ----------
radiance_material = RadianceMaterial(Names="ceiling*", Preset=3)
radiance_material_2 = RadianceMaterial(Names="interior_wall*", Preset=1)
radiance_material_3 = RadianceMaterial(Names="exterior_wall*", Preset=1)
radiance_material_4 = RadianceMaterial(Names="floor*", Preset=5)
radiance_material_5 = RadianceMaterial(Names="ground*", Preset=6)
radiance_material_6 = RadianceMaterial(Names="glazing*", Preset=2, Overrides=python)
merge_3 = Merge(
    Data1=radiance_material_3,
    Data2=radiance_material_4,
    Data3=radiance_material_5,
    Data4=radiance_material,
    Data5=radiance_material_2,
    Data6=radiance_material_6)

# ----
# GET OR CREATE
# PROJECT AND TASK
panel_7 = Panel("Version 2")
# 1)
project_and_task = GetOrCreateProjectAndTask(Auth=login, ProjectName="Annual Daylight Benchmark", TaskName=panel_7, Create=Button())

panel_8 = Panel(merge_3)

limit_ray_weight = Slider(0.0002, range=0.0001..0.001)
panel_9 = Panel("C:\Procedural\WindThresholds\DNK_Copenhagen.061800_IWEC.epw")
overrides = GhPythonScript(
    ambient_bounces=Slider(4, range=1..10),
    ambient_divisions=Slider(5000, range=1000..7500),
    limit_ray_weight=limit_ray_weight,
    samples=Slider(1000, range=500..2000),
    reinhart_divisions=Slider(1, range=1..4))  # -> overrides
# ---------- overrides: Python ----------
__author__ = "Chrisian Kongsgaard"
__version__ = "2021.01.29"

import json

overrides = json.dumps({
            "ambient_bounces": ambient_bounces or 4,
            "ambient_divisions": ambient_divisions or 5000,
            "limit_ray_weight": limit_ray_weight or 0.0002,
            "samples": samples or 1000,
            "reinhart_divisions": reinhart_divisions or 1
        })
# ---------- end overrides ----------
list = ValueList({"3Phase": 0}, selected="3Phase")
radiation_solution = RadiationSolution(
    Input=project_and_task,
    CPUs=Slider(2, range=1..24),
    Method=list,
    Materials=merge_3,
    EPWFile=panel_9,
    Overrides=overrides)

# ----
# Open Compute in Browser
button = Button()
# 1a)
launch_browser = PythonScript(input=project_and_task, open=button)  # -> out
# ---------- launch_browser: Python ----------
import webbrowser
import json

taskId = ""
projectId = ""
url = ""

if input:
    input_ = json.loads(input)
    task = input_.get("task")
    project = input_.get("project")
    url = input_.get("url")
    if task:
        taskId = task.get("uid")
    if project:
        projectId = project.get("uid")



if url and taskId:
    url = url + "/project/" + projectId + "/task/" + taskId
    print url
else:
    print "Please provide input from Task/Project component"
    print "GOT url:", url, "TaskId:", taskId
if open:
    webbrowser.open(url, new=2)
# ---------- end launch_browser ----------
panel_10 = Panel(launch_browser)

analysismesh = AnalysisMesh(Surface=pipeline, GridSize=Slider(0.55, range=0.1..2), Offset=Slider(0.75, range=0..1), OffsetDirection=2)  # -> AnalysisMesh, FaceCenters, FaceNormals
probe_radiation = ProbeRadiation(Input=radiation_solution, Points=analysismesh.FaceCenters, Normals=analysismesh.FaceNormals, Create=Button())

compute = Compute(Input=probe_radiation, Mesh=merge, Compute=Button())  # -> Info, Output

panel_11 = Panel(compute.Output)

list_2 = ValueList({"daylight_autonomy": 0, "spatial_daylight_autonomy": 1, "continuous_daylight_autonomy": 2, "useful_daylight_illuminances": 3}, selected="daylight_autonomy")
daylight_metrics = DaylightMetrics(Input=compute.Output, Preset=list_2, CPUs=1, Create=Button())

# ----
# DOWNLOAD
panel_12 = Panel("C:\Procedural\AnnualDaylightBenchmark\")
concat = Concatenate(FragmentA=panel_12, FragmentB=panel_7)
# 4)
download = Download(Input=daylight_metrics, DownloadPath="metrics", LocalPath=concat, Reload=Button())

# ----
# VISUALIZE
button_2 = Button()
radiation_results = RadiationProbeResults(Folder=download, Rerun=button_2)  # -> Info, Metric
bnd = Bounds(Numbers=radiation_results.Metric)
dedomain = DeconstructDomain(Domain=bnd)  # -> Start, End
colors = Data([RGB(75, 107, 169), RGB(173, 203, 249), RGB(254, 244, 84), RGB(234, 126, 0), RGB(234, 38, 0)])
# 5)
recolor_mesh = RecolorMesh(
    Mesh=analysismesh.AnalysisMesh,
    Result=radiation_results.Metric,
    ListOfColors=colors,
    LowerBoundary=dedomain.Start,
    UpperBoundary=dedomain.End,
    Segments=10)  # -> ColoredMesh, Colors, Values
python_2 = GhPythonScript(mesh=recolor_mesh.ColoredMesh, scale=Slider(1.2, range=0.5..5))  # -> out, text_point, rectangle
# ---------- python_2: Python ----------
__author__ = "kongs"
__version__ = "2020.09.15"

import rhinoscriptsyntax as rs

scale = scale or 1
bb = rs.BoundingBox(mesh)

point = bb[5]
point.X = point.X * 1.05 * scale
plane = rs.MovePlane(rs.WorldXYPlane(), point)

width = (bb[5].X - bb[4].X) * 0.15 * scale
height = (bb[3].Y - bb[4].Y)

rectangle = point

point_ = bb[0]
point_.Y = point_.Y - (height * 0.1 * scale)
text_point = rs.MovePlane(rs.WorldXYPlane(), point_)
# ---------- end python_2 ----------
number_slider = Slider(0.4, range=0..1)
legend = Legend(
    BasePoint=python_2.rectangle,
    Colors=reverse(recolor_mesh.Colors),
    Values=reverse(recolor_mesh.Values),
    Scale=Slider(0.7, range=0..1),
    TextHeight=number_slider)  # -> Legend, Text
tag = TextTag3D(Location=python_2.text_point, Text="Daylight Autonomy %", Size=number_slider, Colour=RGB(0, 0, 0), Justification=1)
