# Grasshopper definition DaylightFactor.gh (Grasshopper 1.0.7)
# plug-ins: ProceduralCS

# ----
# LOGIN TO COMPUTE
# This demo is matching version 2021.11.1 of the ComputeGH plugin
panel = Panel("https://compute.procedural.build")
# 0)
password = Text()
login = ComputeLogin(Username="INSERT YOUR USERNAME HERE", Password=password, ComputeURL=panel, Retry=Button())

# ----
# SET NAMES
number_slider = Slider(50, range=0..100)
windows_north = Brep([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])
windows_east = Surface([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])
floor = Brep(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)
area = Area(Geometry=floor)  # -> Area, Centroid
cir = Circle(Plane=area.Centroid, Radius=number_slider)
walls = Brep([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])
ceiling = Brep(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)
mesh = MeshBrep(
    Brep=floor,
    Settings={GridMaxCount=0, GridMinCount=16, JaggedSeams=False, MaxEdgeLength=0, MinEdgeLength=0.0001, MinTolerance=0, Refine=True, RefineAngle=0, RelativeTolerance=0.65, SimplePlanes=True, Tolerance=0})
mesh_2 = MeshBrep(
    Brep=cir,
    Settings={GridMaxCount=0, GridMinCount=16, JaggedSeams=False, MaxEdgeLength=0, MinEdgeLength=0.0001, MinTolerance=0, Refine=True, RefineAngle=0, RelativeTolerance=0.65, SimplePlanes=True, Tolerance=0})
mesh_3 = MeshBrep(
    Brep=ceiling,
    Settings={GridMaxCount=0, GridMinCount=16, JaggedSeams=False, MaxEdgeLength=0, MinEdgeLength=0.0001, MinTolerance=0, Refine=True, RefineAngle=0, RelativeTolerance=0.65, SimplePlanes=True, Tolerance=0})
mesh_4 = MeshBrep(
    Brep=walls,
    Settings={GridMaxCount=0, GridMinCount=16, JaggedSeams=False, MaxEdgeLength=0, MinEdgeLength=0.0001, MinTolerance=0, Refine=True, RefineAngle=0, RelativeTolerance=0.65, SimplePlanes=True, Tolerance=0})
mesh_5 = MeshBrep(
    Brep=windows_east,
    Settings={GridMaxCount=0, GridMinCount=16, JaggedSeams=False, MaxEdgeLength=0, MinEdgeLength=0.0001, MinTolerance=0, Refine=True, RefineAngle=0, RelativeTolerance=0.65, SimplePlanes=True, Tolerance=0})
mesh_6 = MeshBrep(
    Brep=windows_north,
    Settings={GridMaxCount=0, GridMinCount=16, JaggedSeams=False, MaxEdgeLength=0, MinEdgeLength=0.0001, MinTolerance=0, Refine=True, RefineAngle=0, RelativeTolerance=0.65, SimplePlanes=True, Tolerance=0})
set_names = SetNames(Meshes=mesh_4, Names="wall")  # -> Meshes, Names
set_names_2 = SetNames(Meshes=mesh, Names="floor")  # -> Meshes, Names
set_names_3 = SetNames(Meshes=mesh_2, Names="ground")  # -> Meshes, Names
set_names_4 = SetNames(Meshes=mesh_3, Names="ceiling")  # -> Meshes, Names
set_names_5 = SetNames(Meshes=mesh_5, Names="window_north")  # -> Meshes, Names
set_names_6 = SetNames(Meshes=mesh_6, Names="window_east")  # -> Meshes, Names
# 2a)
merge = Merge(
    Data1=set_names.Meshes,
    Data2=set_names_2.Meshes,
    Data3=set_names_3.Meshes,
    Data4=set_names_4.Meshes,
    Data5=set_names_5.Meshes,
    Data6=set_names_6.Meshes)

# ----
# Display
swatch = ColourSwatch(SwatchColor=RGB(0, 0, 0))
# Get Started: If you haven't done already, sign up for a free user account at https://compute.procedural.build/ to get started!
# 
# 0) Add your username (email) and password.
# 
# 1) Update the project name, number and task name. To create the new project and task click the button.
# 1a) Check the project and parent task in the browser to see progress.
# 
# 2) Update/Check the case setup.
# Pick the desired number of CPUs you want to run with.
# 2a) Give names to the geometry.
# 2b) Apply materials.
# 
# 3) Click the button to upload and start the probe task.
# 
# 4) Click the button the start the daylight simulation.*
# 
# 5) Wait for the simulation to finish and the download will start.
# 
# 6) Visualize the results!
# 
# If you are having any questions, issues or feedback, you are welcome to post them at https://discourse.procedural.build/
# We will be there to answer any queries!
# 
# NOTES:
# * The simulation tasks will queue up, so you don't need to wait for each to finish, but you can just add task in one go.
swatch_2 = ColourSwatch(SwatchColor=RGB(0, 0, 0))
medges = MeshEdges(Mesh=merge)  # -> NakedEdges, InteriorEdges, NonManifoldEdges
wires = BrepWireframe(Brep=[floor, walls, ceiling], Density=-1)
preview = CustomPreview(Geometry=wires, Material=swatch)
preview_2 = CustomPreview(Geometry=[medges.NakedEdges, medges.InteriorEdges], Material=swatch_2)
preview_3 = CustomPreview(Geometry=[windows_north, windows_east], Material=ColourSwatch(SwatchColor=RGBA(86, 126, 193, 171)))

# ----
# SET MATERIALS
panel_2 = Panel("""0.9
0.9
0.9
0.0
0.0""")
python = GhPythonScript(reals=panel_2)  # -> overrides; inputs reals: list
# ---------- python: Python ----------
__author__ = "Christian Kongsgaard"
__version__ = "2021.01.21"

import json


overrides = json.dumps({"reals": reals})
# ---------- end python ----------
panel_3 = Panel("""window_north*
window_east*""")
panel_4 = Panel("""wall*
floor*""")
material = RadianceMaterial(Names=panel_4, Preset=1)
material_2 = RadianceMaterial(Names="ceiling*", Preset=3, Overrides=python)
material_3 = RadianceMaterial(Names="ground*", Preset=6)
material_4 = RadianceMaterial(Names=panel_3, Preset=2)
# 2b)
merge_2 = Merge(Data1=material, Data2=material_2, Data3=material_3, Data4=material_4)

# ----
# GET OR CREATE
# PROJECT AND TASK
panel_5 = Panel("Version 1")
# 1)
project_and_task = GetOrCreateProjectAndTask(Auth=login, ProjectName="Daylight Factor", TaskName=panel_5, Create=Button())

# ----
# INSPECT NORMALS
panel_6 = Panel("{0.5,0.5,0}")
evalsrf = EvaluateSurface(Surface=reparameterize(windows_east), Point=panel_6)  # -> Point, Normal, UDirection, VDirection, Frame
vdisex = VectorDisplayEx(Point=evalsrf.Point, Vector=evalsrf.Normal, Colour=RGB(0, 0, 0), Width=2)

# ----
# Open Compute in Browser
button = Button()
# 1a)
launch_browser = PythonScript(open=button)  # -> out
# ---------- launch_browser: Python ----------
import webbrowser
import json

taskId = ""
projectId = ""
url = ""

if input:
    input_ = json.loads(input)
    task = input_.get("task")
    project = input_.get("project")
    url = input_.get("url")
    if task:
        taskId = task.get("uid")
    if project:
        projectId = project.get("uid")



if url and taskId:
    url = url + "/project/" + projectId + "/task/" + taskId
    print url
else:
    print "Please provide input from Task/Project component"
    print "GOT url:", url, "TaskId:", taskId
if open:
    webbrowser.open(url, new=2)
# ---------- end launch_browser ----------
panel_7 = Panel(launch_browser)

# ----
# SETUP SOLUTION
number_slider_2 = Slider(2, range=1..24)
list = ValueList({"3Phase": 0, "SolarRadiation": 1, "DaylightFactor": 2, "SkyViewFactor": 3}, selected="DaylightFactor")
# 2)
radiation_solution = RadiationSolution(Input=project_and_task, CPUs=number_slider_2, Method=list, Materials=merge_2)

# ----
# CREATE PROBES
analysis_surfaces = Surface([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])
area_2 = Area(Geometry=analysis_surfaces)  # -> Area, Centroid
sort = SortList(Keys=area_2.Area, ValuesA=analysis_surfaces)  # -> Keys, ValuesA
# 3)
analysismesh = AnalysisMesh(Surface=sort.ValuesA, GridSize=Slider(0.2, range=0..1), Offset=Slider(0.8, range=0..1), OffsetDirection=2)  # -> AnalysisMesh, FaceCenters, FaceNormals
panel_8 = Panel("""room_1
room_2
room_3""")
probe_radiation = ProbeRadiation(
    Input=radiation_solution,
    Mesh=analysismesh.AnalysisMesh,
    Points=analysismesh.FaceCenters,
    Normals=analysismesh.FaceNormals,
    Names=panel_8,
    Create=Button())

# ----
# COMPUTE CASE
button_2 = Button()
# 4)
compute = Compute(Input=probe_radiation, Mesh=merge, Compute=button_2)  # -> Info, Output

# ----
# DOWNLOAD
panel_9 = Panel("C:\Procedural\DaylightFactor\")
concat = Concatenate(FragmentA=panel_9, FragmentB=panel_5)
# 5)
download = Download(Input=compute.Output, DownloadPath="results", LocalPath=concat, Reload=Button())

# ----
# VISUALIZE
button_3 = Button()
radiation_results = RadiationProbeResults(Folder=download, Rerun=button_3)  # -> Info, Metric
bnd = Bounds(Numbers=flatten(radiation_results.Metric))
dedomain = DeconstructDomain(Domain=bnd)  # -> Start, End
colors = Data([RGB(113, 142, 173), RGB(118, 150, 161), RGB(129, 169, 135), RGB(138, 186, 112), RGB(145, 190, 106), RGB(187, 198, 91), RGB(231, 206, 76), RGB(238, 210, 81), RGB(244, 226, 118), RGB(252, 245, 164), RGB(255, 253, 184)])
recolor_mesh = RecolorMesh(
    Mesh=analysismesh.AnalysisMesh,
    Result=radiation_results.Metric,
    ListOfColors=colors,
    UpperBoundary=dedomain.End,
    Segments=10)  # -> ColoredMesh, Colors, Values
mjoin = MeshJoin(Meshes=flatten(recolor_mesh.ColoredMesh))
python_2 = GhPythonScript(mesh=mjoin, scale=Slider(1.2, range=0.5..5))  # -> out, text_point, legend
# ---------- python_2: Python ----------
__author__ = "kongs"
__version__ = "2020.09.15"

import rhinoscriptsyntax as rs

scale = scale or 1
bb = rs.BoundingBox(mesh)

point = bb[5]
point.X = point.X * 1.05 * scale
plane = rs.MovePlane(rs.WorldXYPlane(), point)

width = (bb[5].X - bb[4].X) * 0.15 * scale
height = (bb[3].Y - bb[4].Y)

legend = point

point_ = bb[0]
point_.Y = point_.Y - (height * 0.1 * scale)
text_point = rs.MovePlane(rs.WorldXYPlane(), point_)
# ---------- end python_2 ----------
branch = TreeBranch(Tree=simplify(recolor_mesh.Values), Path="{0}", MaintainPaths=True)  # -> reverse(Branch)
branch_2 = TreeBranch(Tree=simplify(recolor_mesh.Colors), Path="{0}", MaintainPaths=True)  # -> reverse(Branch)
# 6)
panel_10 = Panel("Daylight Factor %")
legend = Legend(BasePoint=python_2.legend, Colors=branch_2, Values=branch, Scale=Slider(2.5, range=0.5..5), TextHeight=1)  # -> Legend, Text
tag = TextTag3D(Location=python_2.text_point, Text=panel_10, Size=1, Colour=RGB(0, 0, 0), Justification=1)
