# Grasshopper definition DaylightFactorParametric.gh (Grasshopper 1.0.7)
# plug-ins: ProceduralCS

ladybug = Ladybug_Ladybug()  # -> Vviiiiiiiiiizzz; plug-in component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
honeybee = Honeybee_Honeybee()  # -> Vviiiiiiiiiizzz; plug-in component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

# ----
# LOGIN TO COMPUTE
# This demo is matching version 2020.12.0 of the ComputeGH plugin
panel = Panel("https://compute.procedural.build")
# 0)
password = Text()
login = ComputeLogin(Username="INSERT USERNAME", Password=password, ComputeURL=panel, Retry=Button())

run_on_compute = Button()
create_rad_cases = BooleanToggle(False)
create_tasks = Button()
download = Button()

# ----
# GET OR CREATE
# PROJECT AND TASK
panel_2 = Panel("""0.5
0.5
0.5
0.6
0.6
0.6
0.7
0.7
0.7""")
height = Panel("""3
4
5
3
4
5
3
4
5""")
width = Panel("""8
9
10
8
9
10
8
9
10""")
panel_3 = Panel("""0
0
0
40
40
40
80
80
80""")
panel_4 = Panel("""0
30
60
0
30
60
0
30
60""")
dom = ConstructDomain(DomainStart=0, DomainEnd=height)
pt = ConstructPoint(XCoordinate=panel_4, YCoordinate=panel_3, ZCoordinate=0)
dom_2 = ConstructDomain(DomainStart=0, DomainEnd=width)
genname = GhPythonScript(x=width, z=height, ratio=panel_2)  # -> out, name
# ---------- genname: Python ----------
__author__ = "kongs"
__version__ = "2020.11.19"

import rhinoscriptsyntax as rs

name = "width" + str(int(x)) + "_height" + str(int(z)) + "_ratio" + str(ratio)
# ---------- end genname ----------
number_slider = Slider(0, range=0..8)
panel_5 = Panel(genname.name)
panel_6 = Panel("Parametric Daylight Factor")
item = ListItem(List=panel_5, Index=number_slider, Wrap=True)
# 1)
project_and_task = GetOrCreateProjectAndTask(Auth=login, ProjectName=panel_6, TaskName=item, Create=create_tasks)

# ----
# SETUP CASE GEOMETRY
number_slider_2 = Slider(5, range=3..5, expression="x*5")
dom_3 = ConstructDomain(DomainStart=0, DomainEnd=number_slider_2)
box = DomainBox(Base=pt, X=dom_2, Y=dom_3, Z=dom)
mass2zone = Honeybee_Masses2Zones(zoneMasses=flatten(box), maxRoofAngle=30, createHBZones=Toggle(True))  # -> readMe, graft(HBZones); plug-in component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
# 2)
glzparamlist = Honeybee_GlazingParametersList(northGlzParam=0, westGlzParam=panel_2, southGlzParam=0, eastGlzParam=panel_2)  # -> glzParamList; plug-in component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
glazingcreator = Honeybee_GlazingBasedOnRatio(
    HBObjects=simplify(mass2zone.HBZones),
    glzRatio=simplify(glzparamlist),
    sillHeight=Slider(0.9, range=0..1),
    RADMaterials="Exterior_Window",
    runIt=Toggle(True))  # -> readMe, HBObjWGLZ; plug-in component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

# ----
# Open Compute in Browser
button = Button()
# 1a)
launch_browser = PythonScript(input=project_and_task, open=button)  # -> out
# ---------- launch_browser: Python ----------
import webbrowser
import json

taskId = ""
projectId = ""
url = ""

if input:
    input_ = json.loads(input)
    task = input_.get("task")
    project = input_.get("project")
    url = input_.get("url")
    if task:
        taskId = task.get("uid")
    if project:
        projectId = project.get("uid")



if url and taskId:
    url = url + "/project/" + projectId + "/task/" + taskId
    print url
else:
    print "Please provide input from Task/Project component"
    print "GOT url:", url, "TaskId:", taskId
if open:
    webbrowser.open(url, new=2)
# ---------- end launch_browser ----------
panel_7 = Panel(launch_browser)

# ----
# GENERATE PROBE POINTS
decomposebytype = Honeybee_DecomposeBasedOnType(HBZone=glazingcreator.HBObjWGLZ)  # -> walls, interiorWalls, airWalls, windows, interiorWindows, skylights, roofs, ceilings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; plug-in component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
flip = Flip(Surface=decomposebytype.groundFloors)  # -> Surface, Result
# 2a)
gentestpts = Honeybee_GenerateTestPoints(testGeometry=flip.Surface, gridSize=Slider(0.5, range=0..1), distBaseSrf=Slider(0.8, range=0..1), moveTestMesh=True)  # -> readMe, simplify(testPoints), simplify(ptsVectors), simplify(facesArea), simplify(mesh); plug-in component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

# ----
# Display
swatch = ColourSwatch(SwatchColor=RGB(0, 0, 0))
# Get Started: If you haven't done already, sign up for a free user account at https://compute.procedural.build/ to get started!
# For this demo to work you need to download and install Ladybug/HoneyBee - Legacy! You can find the plugin here: https://www.food4rhino.com/app/ladybug-tools
# 
# 0) Add your username (email) and password.
# 
# 1) Update the project name, number and task name. To create the new project and task click the button.
# 
# 2) Update/Check the case setup. This is just a simple setup with HoneyBee, where we take the geometry, turn it into a HoneyBee zone and add windows a default constructions.
# 2a) We add the probe points that we want to have.
# 2b) We generate the HoneyBee recipe for a Daylight Factor calculation
# 2c) We write the HoneyBee case into the specified folder path
# 
# 3) Click the button to upload and start simulating the case.
# 
# 4) Wait for the simulation to finish. When the result files are downloaded you need to click refresh for the Daylight Folder lookup component to refresh.
# 
# 5) Visualise the results by making the colored mesh
# 
# If you are having any questions, issues or feedback, you are welcome to post them at https://discourse.procedural.build/
# We will be there to answer any queries!
swatch_2 = ColourSwatch(SwatchColor=RGB(0, 0, 0))
medges = MeshEdges(Mesh=gentestpts.mesh)  # -> NakedEdges, InteriorEdges, NonManifoldEdges
wires = BrepWireframe(Brep=glazingcreator.HBObjWGLZ, Density=-1)
preview = CustomPreview(Geometry=wires, Material=swatch)
preview_2 = CustomPreview(Geometry=[medges.NakedEdges, medges.InteriorEdges], Material=swatch_2)

# ----
# MAKE HB RECIPE
number_slider_3 = Slider(1, range=0..2)
radparameters = Honeybee_RADParameters(quality=number_slider_3)  # -> readMe, radParameters; plug-in component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
branch = TreeBranch(Tree=gentestpts.ptsVectors, Path=number_slider, MaintainPaths=True)
branch_2 = TreeBranch(Tree=gentestpts.testPoints, Path=number_slider, MaintainPaths=True)
branch_3 = TreeBranch(Tree=gentestpts.mesh, Path=number_slider, MaintainPaths=True)
# 2b)
daylighfactorsimulation = Honeybee_DaylightFactorSimulation(testPoints=branch_2, ptsVectors=branch, testMesh=branch_3, uniformSky=False, radParameters=radparameters.radParameters)  # -> analysisRecipe; plug-in component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

# ----
# WRITE HONEYBEE CASE
panel_8 = Panel("C:\Procedural")
folder_name = GhPythonScript(BasePath=panel_8, ProjectName=panel_6, TaskName=item)  # -> out, ProjectPath, TaskPath
# ---------- folder_name: Python ----------
__author__ = "kongsgaard"
__version__ = "2020.08.31"

import rhinoscriptsyntax as rs
import os

if not BasePath:
    BasePath = "C:\Procedural"

if not ProjectName:
    ProjectName = "Project"
else:
    project_name_ = ProjectName.replace(" ", "_")
    
if not TaskName:
    TaskName = "Task"
else:
    task_name_ = TaskName.replace(" ", "_")
    
ProjectPath = os.path.join(BasePath, project_name_)
TaskPath = os.path.join(BasePath, project_name_, task_name_)
# ---------- end folder_name ----------
# 2c)
branch_4 = TreeBranch(Tree=simplify(glazingcreator.HBObjWGLZ), Path=number_slider, MaintainPaths=True)
rundaylightanalysis = Honeybee_RunDaylightSimulation(
    HBObjects=flatten(branch_4),
    analysisRecipe=daylighfactorsimulation,
    writeRad=create_rad_cases,
    numOfCPUs=Slider(4, range=0..20),
    workingDir=folder_name.ProjectPath,
    radFileName=item,
    overwriteResults=True)  # -> readMe, analysisType, resultsUnit, results, testPts, resultFiles, radGeoFile, studyFolder, done; plug-in component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

# ----
# DOWNLOAD
python = GhPythonScript(x=folder_name.ProjectPath, y=panel_5)  # -> out, a
# ---------- python: Python ----------
__author__ = "kongs"
__version__ = "2020.11.22"

import rhinoscriptsyntax as rs


a = x + "\\" + y + "\\DF"
# ---------- end python ----------
bang = ExplodeTree(Data=graft(python.a))  # -> Branch0, Branch1, Branch2, Branch3, Branch4, Branch5, Branch6, Branch7, Branch8
python_2 = GhPythonScript(x=folder_name.ProjectPath, y=item)  # -> out, a; same code as python
button_2 = Button()
# 4)
download_2 = Download(Input=project_and_task, DownloadPath="foam", LocalPath=python_2.a, Reload=download)
lookupfolder_daylighting = Honeybee_LookupDaylightingFolder(studyFolder=bang.Branch0, refresh=button_2)  # -> analysisType, resultsUnit, resultFiles, ptsFiles, hdrFiles, imageFiles, iesFiles, epwFile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; plug-in component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
lookupfolder_daylighting_2 = Honeybee_LookupDaylightingFolder(studyFolder=bang.Branch1, refresh=button_2)  # -> analysisType, resultsUnit, resultFiles, ptsFiles, hdrFiles, imageFiles, iesFiles, epwFile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; plug-in component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
lookupfolder_daylighting_3 = Honeybee_LookupDaylightingFolder(studyFolder=bang.Branch2, refresh=button_2)  # -> analysisType, resultsUnit, resultFiles, ptsFiles, hdrFiles, imageFiles, iesFiles, epwFile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; plug-in component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
lookupfolder_daylighting_4 = Honeybee_LookupDaylightingFolder(studyFolder=bang.Branch3, refresh=button_2)  # -> analysisType, resultsUnit, resultFiles, ptsFiles, hdrFiles, imageFiles, iesFiles, epwFile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; plug-in component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
lookupfolder_daylighting_5 = Honeybee_LookupDaylightingFolder(studyFolder=bang.Branch4, refresh=button_2)  # -> analysisType, resultsUnit, resultFiles, ptsFiles, hdrFiles, imageFiles, iesFiles, epwFile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; plug-in component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
lookupfolder_daylighting_6 = Honeybee_LookupDaylightingFolder(studyFolder=bang.Branch5, refresh=button_2)  # -> analysisType, resultsUnit, resultFiles, ptsFiles, hdrFiles, imageFiles, iesFiles, epwFile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; plug-in component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
lookupfolder_daylighting_7 = Honeybee_LookupDaylightingFolder(studyFolder=bang.Branch6, refresh=button_2)  # -> analysisType, resultsUnit, resultFiles, ptsFiles, hdrFiles, imageFiles, iesFiles, epwFile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; plug-in component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
lookupfolder_daylighting_8 = Honeybee_LookupDaylightingFolder(studyFolder=bang.Branch7, refresh=button_2)  # -> analysisType, resultsUnit, resultFiles, ptsFiles, hdrFiles, imageFiles, iesFiles, epwFile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; plug-in component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
lookupfolder_daylighting_9 = Honeybee_LookupDaylightingFolder(studyFolder=bang.Branch8, refresh=button_2)  # -> analysisType, resultsUnit, resultFiles, ptsFiles, hdrFiles, imageFiles, iesFiles, epwFile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; plug-in component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
importpts = Honeybee_ImportPtsFile(ptsFileAddress=lookupfolder_daylighting.ptsFiles)  # -> points, vectors; plug-in component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
importpts_2 = Honeybee_ImportPtsFile(ptsFileAddress=lookupfolder_daylighting_5.ptsFiles)  # -> points, vectors; plug-in component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
importpts_3 = Honeybee_ImportPtsFile(ptsFileAddress=lookupfolder_daylighting_6.ptsFiles)  # -> points, vectors; plug-in component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
importpts_4 = Honeybee_ImportPtsFile(ptsFileAddress=lookupfolder_daylighting_3.ptsFiles)  # -> points, vectors; plug-in component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
importpts_5 = Honeybee_ImportPtsFile(ptsFileAddress=lookupfolder_daylighting_4.ptsFiles)  # -> points, vectors; plug-in component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
importpts_6 = Honeybee_ImportPtsFile(ptsFileAddress=lookupfolder_daylighting_2.ptsFiles)  # -> points, vectors; plug-in component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
importpts_7 = Honeybee_ImportPtsFile(ptsFileAddress=lookupfolder_daylighting_8.ptsFiles)  # -> points, vectors; plug-in component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
importpts_8 = Honeybee_ImportPtsFile(ptsFileAddress=lookupfolder_daylighting_7.ptsFiles)  # -> points, vectors; plug-in component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
importpts_9 = Honeybee_ImportPtsFile(ptsFileAddress=lookupfolder_daylighting_9.ptsFiles)  # -> points, vectors; plug-in component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
readradresults = Honeybee_ReadRADResult(
    analysisType=simplify(lookupfolder_daylighting.analysisType),
    resultFiles=simplify(lookupfolder_daylighting.resultFiles),
    testPts=simplify(importpts.points),
    writeToFile=False)  # -> readMe, unit, values; plug-in component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
readradresults_2 = Honeybee_ReadRADResult(
    analysisType=simplify(lookupfolder_daylighting_5.analysisType),
    resultFiles=simplify(lookupfolder_daylighting_5.resultFiles),
    testPts=simplify(importpts_2.points),
    writeToFile=False)  # -> readMe, unit, values; plug-in component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
readradresults_3 = Honeybee_ReadRADResult(
    analysisType=simplify(lookupfolder_daylighting_6.analysisType),
    resultFiles=simplify(lookupfolder_daylighting_6.resultFiles),
    testPts=simplify(importpts_3.points),
    writeToFile=False)  # -> readMe, unit, values; plug-in component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
readradresults_4 = Honeybee_ReadRADResult(
    analysisType=simplify(lookupfolder_daylighting_3.analysisType),
    resultFiles=simplify(lookupfolder_daylighting_3.resultFiles),
    testPts=simplify(importpts_4.points),
    writeToFile=False)  # -> readMe, unit, values; plug-in component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
readradresults_5 = Honeybee_ReadRADResult(
    analysisType=simplify(lookupfolder_daylighting_4.analysisType),
    resultFiles=simplify(lookupfolder_daylighting_4.resultFiles),
    testPts=simplify(importpts_5.points),
    writeToFile=False)  # -> readMe, unit, values; plug-in component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
readradresults_6 = Honeybee_ReadRADResult(
    analysisType=simplify(lookupfolder_daylighting_2.analysisType),
    resultFiles=simplify(lookupfolder_daylighting_2.resultFiles),
    testPts=simplify(importpts_6.points),
    writeToFile=False)  # -> readMe, unit, values; plug-in component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
readradresults_7 = Honeybee_ReadRADResult(
    analysisType=simplify(lookupfolder_daylighting_8.analysisType),
    resultFiles=simplify(lookupfolder_daylighting_8.resultFiles),
    testPts=simplify(importpts_7.points),
    writeToFile=False)  # -> readMe, unit, values; plug-in component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
readradresults_8 = Honeybee_ReadRADResult(
    analysisType=simplify(lookupfolder_daylighting_7.analysisType),
    resultFiles=simplify(lookupfolder_daylighting_7.resultFiles),
    testPts=simplify(importpts_8.points),
    writeToFile=False)  # -> readMe, unit, values; plug-in component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
readradresults_9 = Honeybee_ReadRADResult(
    analysisType=simplify(lookupfolder_daylighting_9.analysisType),
    resultFiles=simplify(lookupfolder_daylighting_9.resultFiles),
    testPts=simplify(importpts_9.points),
    writeToFile=False)  # -> readMe, unit, values; plug-in component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
entwine = Entwine(
    Branch00=readradresults.values,
    Branch01=readradresults_6.values,
    Branch02=readradresults_4.values,
    Branch03=readradresults_5.values,
    Branch04=readradresults_2.values,
    Branch05=readradresults_3.values,
    Branch06=readradresults_8.values,
    Branch07=readradresults_7.values,
    Branch08=readradresults_9.values,
    FlattenInputs=True)
entwine_2 = Entwine(
    Branch00=lookupfolder_daylighting.analysisMesh,
    Branch01=lookupfolder_daylighting_2.analysisMesh,
    Branch02=lookupfolder_daylighting_3.analysisMesh,
    Branch03=lookupfolder_daylighting_4.analysisMesh,
    Branch04=lookupfolder_daylighting_5.analysisMesh,
    Branch05=lookupfolder_daylighting_6.analysisMesh,
    Branch06=lookupfolder_daylighting_7.analysisMesh,
    Branch07=lookupfolder_daylighting_8.analysisMesh,
    Branch08=lookupfolder_daylighting_9.analysisMesh,
    FlattenInputs=True)

# ----
# 3)
# RUN IN CLOUD
compute = Compute(Input=project_and_task, Folder=rundaylightanalysis.studyFolder, Compute=run_on_compute)  # -> Info, Output

panel_9 = Panel(compute.Output)

# ----
# VISUALIZE
number_slider_4 = Slider(15, range=0..100)
colors = Data([RGB(75, 107, 169), RGB(173, 203, 249), RGB(254, 244, 84), RGB(234, 126, 0), RGB(234, 38, 0)])
# 5)
recolor_mesh = RecolorMesh(Mesh=entwine_2, Result=entwine, ListOfColors=colors, UpperBoundary=number_slider_4, Segments=10)  # -> ColoredMesh, Colors, Values
python_3 = GhPythonScript(x=entwine, y=Slider(10, range=0..10))  # -> out, flatten(a); inputs x: list
# ---------- python_3: Python ----------
__author__ = "kongs"
__version__ = "2020.11.26"

import rhinoscriptsyntax as rs

above = 0

for i in x:
    print i, y
    if i > y:
        above += 1
a = above / len(x) * 100
# ---------- end python_3 ----------
panel_10 = Panel(python_3.a)
python_4 = GhPythonScript(mesh=recolor_mesh.ColoredMesh, scale=Slider(1.2, range=0.5..5))  # -> out, text_point, rectangle
# ---------- python_4: Python ----------
__author__ = "kongs"
__version__ = "2020.09.15"

import rhinoscriptsyntax as rs

scale = scale or 1
bb = rs.BoundingBox(mesh)

point = bb[5]
point.X = point.X * 1.05 * scale
plane = rs.MovePlane(rs.WorldXYPlane(), point)

width = (bb[5].X - bb[4].X) * 0.15 * scale
height = (bb[3].Y - bb[4].Y)

rectangle = rs.AddRectangle(plane, width, height)

point_ = bb[0]
point_.Y = point_.Y - (height * 0.1 * scale)
text_point = rs.MovePlane(rs.WorldXYPlane(), point_)
# ---------- end python_4 ----------
python_5 = GhPythonScript(x=genname.name, y=python_3.a)  # -> out, a
# ---------- python_5: Python ----------
__author__ = "Christian Kongsgaard"
__version__ = "2020.11.26"

a = "\nModel: " + str(x) + "\nDaylight Factor (%)\nArea above 10%: " + str(y)
# ---------- end python_5 ----------
legend = Legend(Colour=recolor_mesh.Colors, Tags=recolor_mesh.Values, Rectangle=python_4.rectangle, LegendType=1)
tag = TextTag3D(Location=pt, Text=python_5.a, Size=1, Colour=ColourSwatch(SwatchColor=RGB(0, 0, 0)), Justification=1)
