# Grasshopper definition DynamicBlinds.gh (Grasshopper 1.0.7)
# plug-ins: ProceduralCS

# ----
# SET NAMES
number_slider = Slider(50, range=0..100)
windows_north = Brep([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])
windows_east = Surface([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])
# 2a) ASSIGN NAMES: Here we assign names to the geometry.
# Give it descriptive names then it is easier to find the individual surfaces later, if needed.
walls = Brep([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])
floor = Brep(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)
area = Area(Geometry=floor)  # -> Area, Centroid
cir = Circle(Plane=area.Centroid, Radius=number_slider)
ceiling = Brep(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)
mesh = MeshBrep(
    Brep=floor,
    Settings={GridMaxCount=0, GridMinCount=16, JaggedSeams=False, MaxEdgeLength=0, MinEdgeLength=0.0001, MinTolerance=0, Refine=True, RefineAngle=0, RelativeTolerance=0.65, SimplePlanes=True, Tolerance=0})
mesh_2 = MeshBrep(
    Brep=cir,
    Settings={GridMaxCount=0, GridMinCount=16, JaggedSeams=False, MaxEdgeLength=0, MinEdgeLength=0.0001, MinTolerance=0, Refine=True, RefineAngle=0, RelativeTolerance=0.65, SimplePlanes=True, Tolerance=0})
mesh_3 = MeshBrep(
    Brep=ceiling,
    Settings={GridMaxCount=0, GridMinCount=16, JaggedSeams=False, MaxEdgeLength=0, MinEdgeLength=0.0001, MinTolerance=0, Refine=True, RefineAngle=0, RelativeTolerance=0.65, SimplePlanes=True, Tolerance=0})
mesh_4 = MeshBrep(
    Brep=walls,
    Settings={GridMaxCount=0, GridMinCount=16, JaggedSeams=False, MaxEdgeLength=0, MinEdgeLength=0.0001, MinTolerance=0, Refine=True, RefineAngle=0, RelativeTolerance=0.65, SimplePlanes=True, Tolerance=0})
mesh_5 = MeshBrep(
    Brep=windows_east,
    Settings={GridMaxCount=0, GridMinCount=16, JaggedSeams=False, MaxEdgeLength=0, MinEdgeLength=0.0001, MinTolerance=0, Refine=True, RefineAngle=0, RelativeTolerance=0.65, SimplePlanes=True, Tolerance=0})
mesh_6 = MeshBrep(
    Brep=windows_north,
    Settings={GridMaxCount=0, GridMinCount=16, JaggedSeams=False, MaxEdgeLength=0, MinEdgeLength=0.0001, MinTolerance=0, Refine=True, RefineAngle=0, RelativeTolerance=0.65, SimplePlanes=True, Tolerance=0})
set_names = SetNames(Meshes=mesh_4, Names="wall")  # -> Meshes, Names
set_names_2 = SetNames(Meshes=mesh, Names="floor")  # -> Meshes, Names
set_names_3 = SetNames(Meshes=mesh_2, Names="ground")  # -> Meshes, Names
set_names_4 = SetNames(Meshes=mesh_3, Names="ceiling")  # -> Meshes, Names
set_names_5 = SetNames(Meshes=mesh_6, Names="window_north")  # -> Meshes, Names
set_names_6 = SetNames(Meshes=mesh_5, Names="window_east")  # -> Meshes, Names
merge = Merge(
    Data1=set_names.Meshes,
    Data2=set_names_2.Meshes,
    Data3=set_names_3.Meshes,
    Data4=set_names_4.Meshes,
    Data5=set_names_5.Meshes,
    Data6=set_names_6.Meshes)

# ----
# Display
swatch = ColourSwatch(SwatchColor=RGB(0, 0, 0))
# Get Started: If you haven't done already, sign up for a free user account at https://compute.procedural.build/ to get started!
# 
# 0) Add your username (email) and password.
# 
# 1) Update the project name, number and task name. To create the new project and task click the button.
# 1a) Check the project and parent task in the browser to see progress.
# 
# 2) Update/Check the case setup.
# Pick the desired number of CPUs you want to run with.
# Select a EPW file that you want to use. You can use the Download EPW component to download an EPW file from EnergyPlus.
# 2a) Give names to the geometry.
# 2b) Apply materials.
# 
# 3) Click the button to upload and start the probe task.
# 
# 4) Click the button the start the daylight simulation.*
# 
# 5) Click the button the add a daylight metric calculation to the results of the daylight simulation.*
# 
# 6) Wait for the simulation to finish and the download will start.
# 
# 7) Visualize the results!
# 
# If you are having any questions, issues or feedback, you are welcome to post them at https://discourse.procedural.build/
# We will be there to answer any queries!
# 
# NOTES:
# * The simulation tasks will queue up, so you don't need to wait for each to finish, but you can just add task in one go.
swatch_2 = ColourSwatch(SwatchColor=RGB(0, 0, 0))
medges = MeshEdges(Mesh=merge)  # -> NakedEdges, InteriorEdges, NonManifoldEdges
wires = BrepWireframe(Brep=[floor, walls, ceiling], Density=-1)
preview = CustomPreview(Geometry=wires, Material=swatch)
preview_2 = CustomPreview(Geometry=[medges.NakedEdges, medges.InteriorEdges], Material=swatch_2)
preview_3 = CustomPreview(Geometry=[windows_north, windows_east], Material=ColourSwatch(SwatchColor=RGBA(86, 126, 193, 171)))

# ----
# INSPECT NORMALS
# INSPECT NORMALS: Radiance is very sentitive to which direction the normals are pointing. You should always have the normals pointing towards the area you are intersted in.
# For windows and interior surfaces that means that they have to point inwards to the room.
panel = Panel("{0.5,0.5,0}")
evalsrf = EvaluateSurface(Surface=reparameterize(windows_east), Point=panel)  # -> Point, Normal, UDirection, VDirection, Frame
vdisex = VectorDisplayEx(Point=evalsrf.Point, Vector=evalsrf.Normal, Colour=RGB(0, 0, 0), Width=2)

# ----
# BSDF SCHEDULES: Here we create a simple schedule of true and false values to determine whether the blinds are on or off.
# You can download the blinds.xml file here: https://raw.githubusercontent.com/procedural-build/demos/master/DynamicBlinds/blinds.xml
number_slider_2 = Slider(4380, range=0..10000)
insert_a_blinds_bsdf_file = Panel("")
bool = Boolean(True)
bool_2 = Boolean(True)
bool_3 = Boolean(False)
bool_4 = Boolean(False)
dup = DuplicateData(Data=[bool_4, bool], Number=number_slider_2, Order=True)
dup_2 = DuplicateData(Data=[bool_2, bool_3], Number=Slider(4380, range=0..10000), Order=True)
entwine = Entwine(Branch00=dup_2, Branch01=dup, FlattenInputs=True)

# ----
# LOGIN TO COMPUTE
# This demo is matching version 2021.5.4 of the ComputeGH plugin
panel_2 = Panel("https://compute.procedural.build")
# 0)
password = Text()
login = ComputeLogin(Username="INSERT YOUR USERNAME HERE", Password=password, ComputeURL=panel_2, Retry=Button())

# ----
# SET MATERIALS
# 2b) ASSIGN MATERIALS: Here we assign materials to the different geometry.
# It is possible to apply overrides to the different presets.
# Read more about the presets and overrides here:
# https://compute.procedural.build/docs/daylight/materials
panel_3 = Panel("clear.xml")
panel_4 = Panel("""0.9
0.9
0.9
0.0
0.0""")
python = GhPythonScript(bsdf=[panel_3, insert_a_blinds_bsdf_file], schedules=entwine)  # -> overrides; inputs bsdf: list, schedules: tree
# ---------- python: Python ----------
__author__ = "Christian Kongsgaard"
__version__ = "2021.01.21"

import json


data = {"bsdf_path": bsdf}
if schedules:
    _schedules = []
    for branch in schedules.Branches:
        _schedules.append(list(branch))
    data.update({"schedule_values": _schedules})
overrides = json.dumps(data)
# ---------- end python ----------
python_2 = GhPythonScript(reals=panel_4)  # -> overrides; inputs reals: list
# ---------- python_2: Python ----------
__author__ = "Christian Kongsgaard"
__version__ = "2021.01.21"

import json


overrides = json.dumps({"reals": reals})
# ---------- end python_2 ----------
python_3 = GhPythonScript(bsdf=panel_3)  # -> overrides; inputs bsdf: list
# ---------- python_3: Python ----------
__author__ = "Christian Kongsgaard"
__version__ = "2021.01.21"

import json


overrides = json.dumps({"bsdf_path": bsdf})
# ---------- end python_3 ----------
panel_5 = Panel("""wall*
floor*""")
list = ValueList({"Context": 0, "Wall": 1, "Window": 2, "Ceiling": 3, "Roof": 4, "Floor": 5, "Ground": 6}, selected="Ceiling")
list_2 = ValueList({"Context": 0, "Wall": 1, "Window": 2, "Ceiling": 3, "Roof": 4, "Floor": 5, "Ground": 6}, selected="Wall")
# 2b)
list_3 = ValueList({"Context": 0, "Wall": 1, "Window": 2, "Ceiling": 3, "Roof": 4, "Floor": 5, "Ground": 6}, selected="Ground")
list_4 = ValueList({"Context": 0, "Wall": 1, "Window": 2, "Ceiling": 3, "Roof": 4, "Floor": 5, "Ground": 6}, selected="Window")
material = RadianceMaterial(Names=panel_5, Preset=list_2)
material_2 = RadianceMaterial(Names="ceiling*", Preset=list, Overrides=python_2)
material_3 = RadianceMaterial(Names="ground*", Preset=list_3)
material_4 = RadianceMaterial(Names="window_north*", Preset=list_4, Overrides=python)
material_5 = RadianceMaterial(Names="window_east*", Preset=list_4, Overrides=python_3)
merge_2 = Merge(Data1=material, Data2=material_2, Data3=material_3, Data4=material_4, Data5=material_5)  # -> flatten(Result)

# ----
# GET OR CREATE
# PROJECT AND TASK
# 1) CREATE PROJECT AND TASK: Every task on Compute belongs to a project. Then first thing to do is to create that project.
# 
# We will call our project Annual Daylight and our TaskName Version 1. The parent task we create together with our project works to group our simulation tasks, so we can easily keep track of design iterations. When we click on the Create button the project and task will be created on Compute.
panel_6 = Panel("Version 1")
# 1)
project_and_task = GetOrCreateProjectAndTask(Auth=login, ProjectName="Dynamic Blinds", TaskName=panel_6, Create=Button())

# ----
# SETUP SOLUTION
# 2a)
insert_a_local_epw_file = Panel("")
list_5 = ValueList({"3Phase": 0, "SolarRadiation": 1, "DaylightFactor": 2, "SkyViewFactor": 3}, selected="3Phase")
# 2)
radiation_solution = RadiationSolution(Input=project_and_task, CPUs=Slider(8, range=1..24), Method=list_5, Materials=merge_2, EPWFile=insert_a_local_epw_file)

# ----
# Open Compute in Browser
# 2) SETUP SOLUTION: With the solution component you can specify, who many CPUs you want to run with. For this demo 8 is sufficient.
# 
# You can choose between different methods. To run an annual daylight simulation you have to pick 3Phase.
# 
# You cannot continue before you apply a valid EPW file.
# You can use our Download EPW component to find a EPW file that suits you
toggle = BooleanToggle(False)
# 1a)
launch_browser = PythonScript(input=project_and_task, open=toggle)  # -> out
# ---------- launch_browser: Python ----------
import webbrowser
import json

taskId = ""
projectId = ""
url = ""

if input:
    input_ = json.loads(input)
    task = input_.get("task")
    project = input_.get("project")
    url = input_.get("url")
    if task:
        taskId = task.get("uid")
    if project:
        projectId = project.get("uid")



if url and taskId:
    url = url + "/project/" + projectId + "/task/" + taskId
    print url
else:
    print "Please provide input from Task/Project component"
    print "GOT url:", url, "TaskId:", taskId
if open:
    webbrowser.open(url, new=2)
# ---------- end launch_browser ----------
panel_7 = Panel(launch_browser)

# ----
# CREATE PROBES
analysis_surfaces = Surface([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])
area_2 = Area(Geometry=analysis_surfaces)  # -> Area, Centroid
sort = SortList(Keys=area_2.Area, ValuesA=analysis_surfaces)  # -> Keys, ValuesA
# 3)
analysismesh = AnalysisMesh(Surface=sort.ValuesA, GridSize=Slider(0.2, range=0..1), Offset=Slider(0.8, range=0..1), OffsetDirection=2)  # -> AnalysisMesh, FaceCenters, FaceNormals
panel_8 = Panel("""room_1
room_2
room_3""")
# 3) CREATE PROBES: When clicking the button connected to Create in the Probe Radiation component and new subtask, called Probe, will be created. When a black info bar under the component appears, saying Task Created, then the task is created on the server. You can then go to the project and task on Compute to inspect.
probe_radiation = ProbeRadiation(
    Input=radiation_solution,
    Points=analysismesh.FaceCenters,
    Normals=analysismesh.FaceNormals,
    Names=panel_8,
    Create=Button())

download_epw = DownloadEPW(OpenBrowser=Button())

# ----
# COMPUTE CASE
# 4) COMPUTE CASE: Clicking Compute will upload the geometry, materials, epw and anything else needed to run the case.
# This componenten will create an Actions tasks, that turn the Rhino/Grasshopper geometry and material description into .rad files and setup the Radiance case.
# The component will also create a Three Phase task, which the actuall simulation task. It will run after the Actions tasks is finished.
button = Button()
# 4)
compute = Compute(Input=probe_radiation, Mesh=merge, Compute=button)  # -> Info, Output

# ----
# 5) DAYLIGHT METRICS: The Three Phase Method produces hourly illuminace values (lux) throughout the year for each point. That is a lot of data and typically not what we are interested in as architects and engineers.
# We therefore need to transform those hourly values into a daylight metric.
# You can choose between several presets, which each calculates a different daylight metric.
# COMPUTE DAYLIGHT METRIC
list_6 = ValueList({"Daylight Autonomy": 0, "Spatial Daylight Autonomy": 1, "Continuous Daylight Autonomy": 2, "Useful Daylight Illuminances": 3, "Statistics": 4}, selected="Daylight Autonomy")
# 5)
daylight_metrics = DaylightMetrics(Input=compute.Output, Preset=list_6, CPUs=Slider(4, range=0..10), CaseDirectory="metrics", Create=Button())

# ----
# DOWNLOAD
panel_9 = Panel("C:\Procedural\Blinds\")
# 6) DOWNLOAD RESULTS: The component will itself start downloading the files as soon as they become available on the server.
concat = Concatenate(FragmentA=panel_9, FragmentB=panel_6)
# 6)
download = Download(Input=daylight_metrics, DownloadPath="metrics", LocalPath=concat, Reload=Button())

# ----
# VISUALIZE
number_slider_3 = Slider(0, range=0..9)
radiation_results = RadiationProbeResults(Folder=download, Rerun=Button())  # -> Info, Metric
branch_mask = GhPythonScript(Index=number_slider_3)  # -> out, Path
# ---------- branch_mask: Python ----------
__author__ = "kongs"
__version__ = "2020.08.31"

import rhinoscriptsyntax as rs

if not Index:
    Index = 0
    
Path = "{*;" + str(Index) + "}"
# ---------- end branch_mask ----------
split = SplitTree(Data=radiation_results.Metric, Masks=flatten(branch_mask.Path))  # -> Positive, Negative
colors = Data([RGB(113, 142, 173), RGB(118, 150, 161), RGB(129, 169, 135), RGB(138, 186, 112), RGB(145, 190, 106), RGB(187, 198, 91), RGB(231, 206, 76), RGB(238, 210, 81), RGB(244, 226, 118), RGB(252, 245, 164), RGB(255, 253, 184)])
recolor_mesh = RecolorMesh(
    Mesh=analysismesh.AnalysisMesh,
    Result=split.Positive,
    ListOfColors=colors,
    UpperBoundary=Slider(100, range=0..100),
    Segments=10)  # -> ColoredMesh, Colors, Values
mjoin = MeshJoin(Meshes=flatten(recolor_mesh.ColoredMesh))
python_4 = GhPythonScript(mesh=mjoin, scale=Slider(1.2, range=0.5..5))  # -> out, text_point, legend
# ---------- python_4: Python ----------
__author__ = "kongs"
__version__ = "2020.09.15"

import rhinoscriptsyntax as rs

scale = scale or 1
bb = rs.BoundingBox(mesh)

point = bb[5]
point.X = point.X * 1.05 * scale
plane = rs.MovePlane(rs.WorldXYPlane(), point)

width = (bb[5].X - bb[4].X) * 0.15 * scale
height = (bb[3].Y - bb[4].Y)

legend = point

point_ = bb[0]
point_.Y = point_.Y - (height * 0.1 * scale)
text_point = rs.MovePlane(rs.WorldXYPlane(), point_)
# ---------- end python_4 ----------
branch = TreeBranch(Tree=simplify(recolor_mesh.Values), Path="{0}", MaintainPaths=True)  # -> reverse(Branch)
branch_2 = TreeBranch(Tree=simplify(recolor_mesh.Colors), Path="{0}", MaintainPaths=True)  # -> reverse(Branch)
# 7)
panel_10 = Panel("Daylight Autonomy %")
legend = Legend(BasePoint=python_4.legend, Colors=branch_2, Values=branch, Scale=Slider(2.5, range=0.5..5), TextHeight=1)  # -> Legend, Text
tag = TextTag3D(Location=python_4.text_point, Text=panel_10, Size=1, Colour=RGB(0, 0, 0), Justification=1)

panel_11 = Panel(radiation_results.Info)
