# Grasshopper definition FacadePressure.gh (Grasshopper 1.0.7)
# plug-ins: ProceduralCS

# ----
# LOGIN TO COMPUTE
# This demo is matching version 2021.10.0 of the ComputeGH plugin
panel = Panel("https://compute.procedural.build")
# 0)
password = Text()
login = ComputeLogin(Username="INSERT YOUR USERNAME HERE", Password=password, ComputeURL=panel, Retry=Button())

# ----
# GEOMETRY
brep = Brep([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])
mesh = MeshBrep(
    Brep=brep,
    Settings={GridMaxCount=0, GridMinCount=16, JaggedSeams=False, MaxEdgeLength=0, MinEdgeLength=0.0001, MinTolerance=0, Refine=True, RefineAngle=0, RelativeTolerance=0.65, SimplePlanes=True, Tolerance=0})
# 2a) GEOMETRY: Here we assign names to the geometry.
# For this demo, we just give all the geometry the same name "buildings". When doing larger cases it is adventages to apply different names to different parts of the input geometry.
# That way it is easier to find the individual surfaces later, if needed.
# 
# We also apply the mesh levels here.
# The mesh levels specifies the size of the mesh faces on the surface of the geometry. The levels are related to the Cell Size set in the Domain component.
# If you have a Cell Size of eg. 10m and apply a mesh level of 2 then your mesh faces will be 10 halfed 2 times ie. 2.5m
number_slider = Slider(2, range=0..10)
set_names = SetNames(Meshes=mesh, Names="buildings")  # -> Meshes, Names
mesh_level = CFDMeshLevel(Meshes=set_names.Meshes, MinLevel=number_slider, MaxLevel=0)

# ----
# GET OR CREATE
# PROJECT AND TASK
panel_2 = Panel("Version 1")
# 1) CREATE PROJECT AND TASK: Every task on Compute belongs to a project. Then first thing to do is to create that project.
# 
# We will call our project Simple VWT and our TaskName Version 1. The parent task we create together with our project works to group our simulation tasks, so we can easily keep track of design iterations. When we click on the Create button the project and task will be created on Compute.
button = Button()
# 1)
project_and_task = GetOrCreateProjectAndTask(Auth=login, ProjectName="Facade Pressure", TaskName=panel_2, Create=button)

# ----
# CONFIGURE MESHING
number_slider_2 = Slider(0, range=0..100)
# 2b) CONFIGURE MESHING: This is where we set up the domain and mesh properties for the CFD case.
# The meshes with applied mesh levels are inputted and the domain is generated.
# In the domain component you can specify different properties for the CFD domain.
# 
# For this demo we have just applied some simple defaults, which should be changed when you run a real case.
number_slider_3 = Slider(2, range=0..10)
toggle = BooleanToggle(True)
list = ValueList({"3D": 0, "2D": 1}, selected="3D")
domain = CFDDomain(
    Objects=mesh_level,
    DomainType=list,
    CellSize=Slider(2, range=0..2),
    Z0=toggle,
    CenterXY=toggle,
    Square=toggle,
    XYScale=Slider(1.5, range=0..10),
    XYOffset=number_slider_2,
    ZScale=number_slider_3)  # -> Output, Info, BoundingBox, Mesh
panel_3 = Panel(domain.Info)
mesh_2 = ComputeMesh(Input=project_and_task, Domain=domain.Output)

# ----
# Display
mesh_3 = Mesh(domain.Mesh)
# Get Started: If you haven't done already, sign up for a free user account at https://compute.procedural.build/ to get started!
# 
# 0) Add your username (email) and password.
# 
# 1) Update the project name, number and task name. To create the new project and task click the button.
# 
# 2) Update the solver configuration or leave the defaults.
# 
# 3) Click the button to upload and start simulating the case.
# 
# 4) Click the button to add the probe points. Make sure to create the C:/Procedural/ComputeVWTDemo folder to store the results in.
# 
# 5) Wait for the simulation to finish and visualise the results.
# 
# 6) Check the simulation progress in the browser.
# 
# If you are having any questions, issues or feedback, you are welcome to post them at https://discourse.procedural.build/
# We will be there to answer any queries!
swatch = ColourSwatch(SwatchColor=RGB(0, 0, 0))
medges = MeshEdges(Mesh=mesh_3)  # -> NakedEdges, InteriorEdges, NonManifoldEdges
wires = BrepWireframe(Brep=domain.BoundingBox, Density=-1)
preview = CustomPreview(Geometry=wires, Material=ColourSwatch(SwatchColor=RGB(0, 0, 0)))
preview_2 = CustomPreview(Geometry=domain.Mesh, Material=ColourSwatch(SwatchColor=RGB(153, 153, 153)))
preview_3 = CustomPreview(Geometry=[medges.NakedEdges, medges.InteriorEdges], Material=swatch)
facen = FaceNormals(Mesh=mesh_3)  # -> flatten(Centers), Normals
lng = ListLength(List=facen.Centers)
mesh_faces = Panel(lng)

# ----
# SET BOUNDARY CONDITIONS
panel_4 = Panel("{'U': '{ value uniform (0 -5 0); }'}")
# 2c) ASSIGN BOUNDARY CONDITIONS: Here we assign boundary conditions to the different geometry.
# By default all geometry are given the boundary condition "wall".
# Therefore we only need to give the domain box sides different boundary conditions to specify in flow of air over the model.
panel_5 = Panel("""MaxZ
MinZ
MinX
MaxX""")
cfd_bc = CFDBoundaryCondition(Names="MaxY", Preset=2, Overrides=panel_4)
cfd_bc_2 = CFDBoundaryCondition(Names="MinY", Preset=3)
cfd_bc_3 = CFDBoundaryCondition(Names=panel_5, Preset=1)
merge = Merge(Data1=cfd_bc, Data2=cfd_bc_2, Data3=cfd_bc_3)

# ----
# Open Compute in Browser
toggle_2 = BooleanToggle(False)
# 1a)
launch_browser = PythonScript(input=project_and_task, open=toggle_2)  # -> out
# ---------- launch_browser: Python ----------
import webbrowser
import json

taskId = ""
projectId = ""
url = ""

if input:
    input_ = json.loads(input)
    task = input_.get("task")
    project = input_.get("project")
    url = input_.get("url")
    if task:
        taskId = task.get("uid")
    if project:
        projectId = project.get("uid")



if url and taskId:
    url = url + "/project/" + projectId + "/task/" + taskId
    print url
else:
    print "Please provide input from Task/Project component"
    print "GOT url:", url, "TaskId:", taskId
if open:
    webbrowser.open(url, new=2)
# ---------- end launch_browser ----------
panel_6 = Panel(launch_browser)

# ----
# SETUP SOLVER
# 2) SETUP SOLUTION: With the solution component you can specify, who many CPUs you want to run with. For this demo 4 is sufficient.
# 
# You can choose between different OpenFOAM solvers. For running outdoor comfort analyses the simpleFoam solver is recormended.
# We will also use the VirtualWindTunnel Case Type as it is the method that sets up the virtual wind tunnel and lets you simulate multiple angles at the same time. You specify the number of angles that you would like to run in "Number of Angles". For this demo we have chosen 4, which means that the angles 0.0, 90.0, 180.0 and 270.0 is simulated.
# 
# This is also the place where you specify the number of iterations that you would like the run the simulates for. For the purpose of the demo 300 is enough. But when running real cases we recormend between 500 and 1000
number_slider_4 = Slider(4, range=0..100)
list_2 = ValueList({"simpleFoam": 0, "potentialFoam": 1, "porousSimpleFoam": 2, "pisoFoam": 3, "buoyantSimpleFoam": 4, "buoyantPimpleFoam": 5, "buoyantBoussinesqSimpleFoam": 6, "buoyantBoussinesqPimpleFoam": 7}, selected="simpleFoam")
list_3 = ValueList({"SimpleCase": 0, "VirtualWindTunnel": 1, "MeshOnly": 2}, selected="VirtualWindTunnel")
# 2)
cfd_solution = ComputeSolution(
    Input=mesh_2,
    CPUs=Slider(2, range=1..24),
    Solver=list_2,
    CaseType=list_3,
    BoundaryConditions=merge,
    Iterations=Slider(300, range=0..1000),
    NumberOfAngles=number_slider_4)

# ----
# CREATE A PROBE POINTS
number_slider_5 = Slider(1, range=0..4)
item = ListItem(List=brep, Index=number_slider_5, Wrap=True)
debrep = DeconstructBrep(Brep=item)  # -> Faces, Edges, Vertices
panel_7 = Panel("""0
2""")
item_2 = ListItem(List=debrep.Faces, Index=panel_7, Wrap=True)
# 4a) CREATE PROBE POINTS: We use the AnalysisMesh component to create a mesh, whose face centers we use as probe points.
# 
# The mesh we will also use to color the results onto.
number_slider_6 = Slider(0.1, range=0..3)
list_4 = ValueList({"X": 0, "Y": 1, "Z": 2, "Normal": 3}, selected="Normal")
analysismesh = AnalysisMesh(Surface=item_2, GridSize=Slider(0.5, range=0..3), Offset=number_slider_6, OffsetDirection=list_4)  # -> AnalysisMesh, FaceCenters, FaceNormals

# ----
# RUN ON COMPUTE
button_2 = Button()
# 3)
compute = Compute(Input=cfd_solution, Mesh=domain.Mesh, Compute=button_2)  # -> Info, Output
# 3) COMPUTE VWT: Clicking Compute will upload the geometry, boundary conditions and anything else needed to run the case.
# 
# This component will create an Actions tasks, that turn the Rhino/Grasshopper geometry and boundary condition descriptions into openFOAM files and setup the openFOAM case.
# The component will create a Mesh task, which will execute after the Actions task is done.
# Furthermore, a VirtualWindTunnel task will be created with the number of wind angles underneeth that has been specified in the Solution component. The wind angles will start and run in parallel, when the prepare_wind_tunnel is finished.
# 
# When a black info bar under the component appears, saying Tasks Created, then the tasks are created on the server. You can then go to the project and task on Compute to inspect.
panel_8 = Panel(compute.Info)

panel_9 = Panel("""facadeSouth
facadeNorth""")
# 4) CREATE PROBES: When clicking the button connected to Create in the Probe Points component and new subtask, called Probe, will be created.
# Running probe tasks in a CFD simulation is a post simulation process and what you are doing is to go into the simulation results and extracting the values you want from a set of probe points.
# We do that by creating a grid of points that we want to have the results in.
# 
# Fields is the fields (type of values) we want to extract from the CFD simulation. In this case we are interested in the pressure (p), which we later will turn into pressure coefficients
button_3 = Button()
# 4)
probe_points = ProbePoints(
    Input=compute.Output,
    Points=analysismesh.FaceCenters,
    Names=panel_9,
    Fields="p",
    Mesh=analysismesh.AnalysisMesh,
    CPUs=1,
    DependentOn="VirtualWindTunnel",
    Create=button_3)

# ----
# https://compute.procedural.build
button_4 = Button()
facade_pressure = FacadePressure(Input=probe_points, ProbeNames=panel_9, CPUs=Slider(2, range=0..10), DependentOn="Probe", Create=button_4)

# ----
# PROBE AND DOWNLOAD
panel_10 = Panel("C:\Procedural\FacadePressure\")
# 4b) DOWNLOAD RESULTS: The component will itself start downloading the files as soon as they become available on the server.
# 
# Notice that we are downloading two folders:
# 
# * pressure_results
# * geometry
# 
# They are respectively put into
# * pressureResults
# * geometry
# 
# That way we can both download the probe results and the result mesh. The Path output from the download component, we split into two, so we can give it to the right input in the Load Results Component.
panel_11 = Panel("""\pressureResults
\geometry""")
panel_12 = Panel("""pressure_results
geometry""")
concat = Concatenate(FragmentA=panel_10, FragmentB=panel_2, FragmentC=panel_11)
download = Download(Input=facade_pressure, DownloadPath=panel_12, LocalPath=concat, Reload=Button())
item_3 = ListItem(List=download, Index=1, Wrap=True)
item_4 = ListItem(List=download, Index=0, Wrap=True)

# ----
# 5) VISUALIZE WIND RESULTS: By using the Load Probe Results and the Recolor Mesh components, it is possible to visualize the pressure coefficients from the differnt wind angles.
number_slider_7 = Slider(3, range=0..3)
load_probe_results = LoadProbeResults(Folder=item_4, MeshPath=item_3, Rerun=Button())  # -> Info, Points, Mesh, Cp
branch_mask = GhPythonScript(Index=number_slider_7)  # -> out, Path
# ---------- branch_mask: Python ----------
__author__ = "kongs"
__version__ = "2020.08.31"

import rhinoscriptsyntax as rs

if not Index:
    Index = 0
    
Path = "{*;" + str(Index) + "}"
# ---------- end branch_mask ----------
panel_13 = Panel(load_probe_results.Info)
split = SplitTree(Data=load_probe_results.Cp, Masks=flatten(branch_mask.Path))  # -> Positive, Negative
colors = Data([RGB(255, 255, 255), RGB(209, 229, 240), RGB(146, 197, 222), RGB(67, 147, 195), RGB(33, 102, 172), RGB(5, 48, 97)])
# 5)
# Visualize Values
recolor_mesh = RecolorMesh(
    Mesh=load_probe_results.Mesh,
    Result=split.Positive,
    ListOfColors=colors,
    UpperBoundary=Slider(1.4, range=0..10),
    Segments=10)  # -> ColoredMesh, Colors, Values
mjoin = MeshJoin(Meshes=flatten(recolor_mesh.ColoredMesh))
python = GhPythonScript(mesh=mjoin, scale=Slider(1.2, range=0.5..5))  # -> out, text_point, legend
# ---------- python: Python ----------
__author__ = "kongs"
__version__ = "2020.09.15"

import rhinoscriptsyntax as rs

scale = scale or 1
bb = rs.BoundingBox(mesh)

point = bb[5]
point.X = point.X * 1.05 * scale
plane = rs.MovePlane(rs.WorldXYPlane(), point)

width = (bb[5].X - bb[4].X) * 0.15 * scale
height = (bb[3].Y - bb[4].Y)

legend = point

point_ = bb[0]
point_.Y = point_.Y - (height * 0.1 * scale)
text_point = rs.MovePlane(rs.WorldXYPlane(), point_)
# ---------- end python ----------
branch = TreeBranch(Tree=recolor_mesh.Colors, Path="{0;0}", MaintainPaths=True)
branch_2 = TreeBranch(Tree=recolor_mesh.Values, Path="{0;0}", MaintainPaths=True)
legend_text = LegendText(T=load_probe_results.Info, i=number_slider_7)
legend = Legend(BasePoint=python.legend, Colors=branch, Values=branch_2, Scale=Slider(2.5, range=0.5..5), TextHeight=1)  # -> Legend, Text
tag = TextTag3D(Location=python.text_point, Text=legend_text, Size=1, Colour=RGB(0, 0, 0), Justification=1)

# ==== cluster LegendText
T = ClusterInput()
i = ClusterInput()
branch = TreeBranch(Tree=T, Path="{2}", MaintainPaths=True)
item = ListItem(List=branch, Index=i, Wrap=True)
concat = Concatenate(FragmentA="Wind Velocity [m/s]", FragmentB=item, FragmentC="° from North")
R = ClusterOutput(concat)
