# Grasshopper definition AdvancedProbing.gh (Grasshopper 1.0.7)
# plug-ins: ProceduralCS

# ----
# LOGIN TO COMPUTE
# This demo is matching version 2021.7.2 of the ComputeGH plugin
panel = Panel("https://compute.procedural.build")
# 0)
password = Text()
login = ComputeLogin(Username="INSERT YOUR USERNAME HERE", Password=password, ComputeURL=panel, Retry=Button())

# ----
# GEOMETRY
panel_2 = Panel("buildings")
mesh = Mesh([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])
# 2a) GEOMETRY: Here we assign names to the geometry.
# For this demo, we just give all the geometry the same name "buildings". When doing larger cases it is adventages to apply different names to different parts of the input geometry.
# That way it is easier to find the individual surfaces later, if needed.
# 
# We also apply the mesh levels here.
# The mesh levels specifies the size of the mesh faces on the surface of the geometry. The levels are related to the Cell Size set in the Domain component.
# If you have a Cell Size of eg. 10m and apply a mesh level of 2 then your mesh faces will be 10 halfed 2 times ie. 2.5m
number_slider = Slider(2, range=0..10)
set_names = SetNames(Meshes=mesh, Names=panel_2)  # -> Meshes, Names
mesh_level = CFDMeshLevel(Meshes=set_names.Meshes, MinLevel=number_slider, MaxLevel=0)

# ----
# GET OR CREATE
# PROJECT AND TASK
panel_3 = Panel("Version 5")
# 1) CREATE PROJECT AND TASK: Every task on Compute belongs to a project. Then first thing to do is to create that project.
# 
# We will call our project Simple VWT and our TaskName Version 1. The parent task we create together with our project works to group our simulation tasks, so we can easily keep track of design iterations. When we click on the Create button the project and task will be created on Compute.
button = Button()
# 1)
project_and_task = GetOrCreateProjectAndTask(Auth=login, ProjectName="Advanced Probes", TaskName=panel_3, Create=button)

# ----
# CONFIGURE MESHING
number_slider_2 = Slider(0, range=0..100)
# 2b) CONFIGURE MESHING: This is where we set up the domain and mesh properties for the CFD case.
# The meshes with applied mesh levels are inputted and the domain is generated.
# In the domain component you can specify different properties for the CFD domain.
# 
# For this demo we have just applied some simple defaults, which should be changed when you run a real case.
number_slider_3 = Slider(2, range=0..10)
toggle = BooleanToggle(True)
list = ValueList({"3D": 0, "2D": 1}, selected="3D")
domain = CFDDomain(
    Objects=mesh_level,
    DomainType=list,
    CellSize=Slider(2, range=0..2),
    Z0=toggle,
    CenterXY=toggle,
    Square=toggle,
    XYScale=Slider(1.5, range=0..10),
    XYOffset=number_slider_2,
    ZScale=number_slider_3)  # -> Output, Info, BoundingBox, Mesh
panel_4 = Panel(domain.Info)
mesh_2 = ComputeMesh(Input=project_and_task, Domain=domain.Output)

# ----
# Display
mesh_3 = Mesh(domain.Mesh)
# Get Started: If you haven't done already, sign up for a free user account at https://compute.procedural.build/ to get started!
# 
# 0) Add your username (email) and password.
# 
# 1) Update the project name, number and task name. To create the new project and task click the button.
# 
# 2) Update the solver configuration or leave the defaults.
# 
# 3) Click the button to upload and start simulating the case.
# 
# 4) Click the button to add the probe points. Make sure to create the C:/Procedural/ComputeVWTDemo folder to store the results in.
# 
# 5) Wait for the simulation to finish and visualise the results.
# 
# 6) Check the simulation progress in the browser.
# 
# If you are having any questions, issues or feedback, you are welcome to post them at https://discourse.procedural.build/
# We will be there to answer any queries!
swatch = ColourSwatch(SwatchColor=RGB(0, 0, 0))
medges = MeshEdges(Mesh=mesh_3)  # -> NakedEdges, InteriorEdges, NonManifoldEdges
wires = BrepWireframe(Brep=domain.BoundingBox, Density=-1)
preview = CustomPreview(Geometry=wires, Material=ColourSwatch(SwatchColor=RGB(0, 0, 0)))
preview_2 = CustomPreview(Geometry=domain.Mesh, Material=ColourSwatch(SwatchColor=RGB(153, 153, 153)))
preview_3 = CustomPreview(Geometry=[medges.NakedEdges, medges.InteriorEdges], Material=swatch)
facen = FaceNormals(Mesh=mesh_3)  # -> flatten(Centers), Normals
lng = ListLength(List=facen.Centers)
mesh_faces = Panel(lng)

# ----
# SET BOUNDARY CONDITIONS
panel_5 = Panel("{'U': '{ value uniform (0 -5 0); }'}")
# 2c) ASSIGN BOUNDARY CONDITIONS: Here we assign boundary conditions to the different geometry.
# By default all geometry are given the boundary condition "wall".
# Therefore we only need to give the domain box sides different boundary conditions to specify in flow of air over the model.
panel_6 = Panel("""MaxZ
MinZ
MinX
MaxX""")
cfd_bc = CFDBoundaryCondition(Names="MaxY", Preset=2, Overrides=panel_5)
cfd_bc_2 = CFDBoundaryCondition(Names="MinY", Preset=3)
cfd_bc_3 = CFDBoundaryCondition(Names=panel_6, Preset=1)
merge = Merge(Data1=cfd_bc, Data2=cfd_bc_2, Data3=cfd_bc_3)

# ----
# Open Compute in Browser
toggle_2 = BooleanToggle(False)
# 1a)
launch_browser = PythonScript(input=project_and_task, open=toggle_2)  # -> out
# ---------- launch_browser: Python ----------
import webbrowser
import json

taskId = ""
projectId = ""
url = ""

if input:
    input_ = json.loads(input)
    task = input_.get("task")
    project = input_.get("project")
    url = input_.get("url")
    if task:
        taskId = task.get("uid")
    if project:
        projectId = project.get("uid")



if url and taskId:
    url = url + "/project/" + projectId + "/task/" + taskId
    print url
else:
    print "Please provide input from Task/Project component"
    print "GOT url:", url, "TaskId:", taskId
if open:
    webbrowser.open(url, new=2)
# ---------- end launch_browser ----------
panel_7 = Panel(launch_browser)

panel_8 = Panel("""functions
{
  probes_U
  {
    type                    probes;
    functionObjectLibs      ("libfieldFunctionObjects.so");
    enabled                 true;
    writeControl            timeStep;
    writeInterval           50;
    objects                 ();
    executeControl          timeStep;
    executeInterval         50;
    log                     true;
    fields                  ( U );
    probeLocations
    (
{{PROBE_LOCATIONS}}
    );
  }
}""")
get_inlet_points = GetInletPoints(B=domain.BoundingBox)
python = GhPythonScript(points=get_inlet_points, template=panel_8)  # -> out, a; inputs points: list of Point3d
# ---------- python: Python ----------
__author__ = "kongs"
__version__ = "2021.09.07"

_points = ""
for point in points:
    _points += "      ( " + str(point.X) + " " + str(point.Y) + " " + str(point.Z) + " )\n"

a = "system>controlDict\n{\n" + template.replace("{{PROBE_LOCATIONS}}", _points) + "\n}"
# ---------- end python ----------

# ----
# SETUP SOLVER
number_slider_4 = Slider(4, range=0..100)
list_2 = ValueList({"simpleFoam": 0, "potentialFoam": 1, "porousSimpleFoam": 2, "pisoFoam": 3, "buoyantSimpleFoam": 4, "buoyantPimpleFoam": 5, "buoyantBoussinesqSimpleFoam": 6, "buoyantBoussinesqPimpleFoam": 7}, selected="simpleFoam")
# 2) SETUP SOLUTION: With the solution component you can specify, who many CPUs you want to run with. For this demo 4 is sufficient.
# 
# You can choose between different OpenFOAM solvers. For running outdoor comfort analyses the simpleFoam solver is recormended.
# We will also use the VirtualWindTunnel Case Type as it is the method that sets up the virtual wind tunnel and lets you simulate multiple angles at the same time. You specify the number of angles that you would like to run in "Number of Angles". For this demo we have chosen 4, which means that the angles 0.0, 90.0, 180.0 and 270.0 is simulated.
# 
# This is also the place where you specify the number of iterations that you would like the run the simulates for. For the purpose of the demo 300 is enough. But when running real cases we recormend between 500 and 1000
overrides = GhPythonScript(caseFiles=python.a)  # -> overrides; inputs fields: list, presets: list, caseFiles: list
# ---------- overrides: Python ----------
__author__ = "markp"
__version__ = "2020.09.11"

import json

overrides = json.dumps({"setup": setup, "fields": fields, "presets": presets, "caseFiles": caseFiles})
# ---------- end overrides ----------
list_3 = ValueList({"SimpleCase": 0, "VirtualWindTunnel": 1, "MeshOnly": 2}, selected="VirtualWindTunnel")
# 2)
cfd_solution = ComputeSolution(
    Input=mesh_2,
    CPUs=Slider(2, range=1..24),
    Solver=list_2,
    CaseType=list_3,
    BoundaryConditions=merge,
    Iterations=Slider(300, range=0..1000),
    NumberOfAngles=number_slider_4,
    Overrides=overrides)

# ----
# 2d) CREATE PROBE POINTS: To create probes that saves result values throughout the simulation's time steps we have to apply an override to the CFD Solution component.
# 
# This override will add the snippet of code above to the system/controlDict.
# This snippet specifies that we want to write the values to a file every 50th time step (writeControl).
# We want to write the velocity values (fields)
# and we want to do it in the following points (probeLocations)
# 
# The probeLocations can be generated from Grasshopper with a little Python script and placed in the code snippet. Finally we can give it in the CFD Solution overrides input.
panel_9 = Panel(python.a)

# ----
# RUN ON COMPUTE
button_2 = Button()
# 3)
compute = Compute(Input=cfd_solution, Mesh=domain.Mesh, Compute=button_2)  # -> Info, Output
# 3) COMPUTE VWT: Clicking Compute will upload the geometry, boundary conditions and anything else needed to run the case.
# 
# This component will create an Actions tasks, that turn the Rhino/Grasshopper geometry and boundary condition descriptions into openFOAM files and setup the openFOAM case.
# The component will create a Mesh task, which will execute after the Actions task is done.
# Furthermore, a VirtualWindTunnel task will be created with the number of wind angles underneeth that has been specified in the Solution component. The wind angles will start and run in parallel, when the prepare_wind_tunnel is finished.
# 
# When a black info bar under the component appears, saying Tasks Created, then the tasks are created on the server. You can then go to the project and task on Compute to inspect.
panel_10 = Panel(compute.Info)

# ----
# DOWNLOAD
panel_11 = Panel("C:\Procedural\AdvancedProbes\")
# 4b) DOWNLOAD RESULTS: The component will itself start downloading the files as soon as they become available on the server.
# 
# We are downloading the folder:
# 
# * VWT/postProcessing/probes_U
# 
# The files are put into
# * probeResults
# 
# on your machine.
button_3 = Button()
concat = Concatenate(FragmentA=panel_11, FragmentB=panel_3, FragmentC="\probeResults")
# 4)
download = Download(Input=compute.Output, DownloadPath="VWT/postProcessing/probes_U", LocalPath=concat, Reload=button_3)

# ----
# 5) VISUALIZE WIND RESULTS: By using the Load Probe Results and the Recolor Mesh components, it is possible to visualize the probes from different wind directions and time steps in the simulation.
# 
# The info output for this type of simulation is a little misleading.
# Patch Names is the wind direction.
# Angles is the time steps in the simulation.
# https://compute.procedural.build
number_slider_5 = Slider(5, range=0..5)
number_slider_6 = Slider(1, range=0..3)
branch_mask = GhPythonScript(angleIndex=number_slider_6, timeIndex=number_slider_5)  # -> out, Path
# ---------- branch_mask: Python ----------
__author__ = "kongs"
__version__ = "2020.08.31"

import rhinoscriptsyntax as rs

if not angleIndex:
    angleIndex = 0
if not timeIndex:
    timeIndex = 0
    
Path = "{" + str(angleIndex) + ";" + str(timeIndex) + "}"
# ---------- end branch_mask ----------
load_probe_results = LoadProbeResults(Folder=download, Rerun=Button())  # -> Info, Points, Mesh, U
# 5)
panel_12 = Panel(load_probe_results.Info)
vlen = VectorLength(Vector=load_probe_results.U)
split = SplitTree(Data=vlen, Masks=flatten(branch_mask.Path))  # -> Positive, Negative
# Visualize Values
number_slider_7 = Slider(1.2, range=0.5..5)
python_2 = GhPythonScript(points=load_probe_results.Points, scale=number_slider_7)  # -> out, text_point, legend; inputs points: list of Point3d
# ---------- python_2: Python ----------
__author__ = "kongs"
__version__ = "2020.09.15"

import rhinoscriptsyntax as rs

scale = scale or 1


point = points[0]
point.Y = point.Y * 1.05 * scale

legend = point


point.Z = point.Z - (point.Z * 1.05 * scale)
text_point = rs.MovePlane(rs.WorldXYPlane(), point)
# ---------- end python_2 ----------
legend_text = LegendText(T=load_probe_results.Info, i=number_slider_6)
tag = TextTag3D(Location=python_2.text_point, Text=legend_text, Size=1, Colour=RGB(0, 0, 0), Justification=1)

# ----
# Visualize Vectors
bnd = Bounds(Numbers=flatten(vlen))
split_2 = SplitTree(Data=load_probe_results.U, Masks=flatten(branch_mask.Path))  # -> Positive, Negative
dedomain = DeconstructDomain(Domain=bnd)  # -> Start, End
gradient = Gradient(
    LowerLimit=dedomain.End,
    UpperLimit=dedomain.Start,
    Parameter=split.Positive,
    stops=[0: RGB(5, 48, 97), 0.166: RGB(33, 102, 172), 0.33: RGB(67, 147, 195), 0.5: RGB(146, 197, 222), 0.66: RGB(209, 229, 240), 0.833: RGB(255, 255, 255)])
vdisex = VectorDisplayEx(Point=load_probe_results.Points, Vector=split_2.Positive, Colour=gradient, Width=2)

legend = Legend(BasePoint=python_2.legend, Colors=gradient, Values=split.Positive, Scale=Slider(2.5, range=0.5..5), TextHeight=1)  # -> Legend, Text

# ==== cluster LegendText
T = ClusterInput()
i = ClusterInput()
branch = TreeBranch(Tree=T, Path="{1}", MaintainPaths=True)
item = ListItem(List=branch, Index=i, Wrap=True)
concat = Concatenate(FragmentA="Wind Velocity [m/s]", FragmentB=item, FragmentC="° from North")
R = ClusterOutput(concat)

# ==== cluster GetInletPoints
B = ClusterInput()
debrep = DeconstructBrep(Brep=B)  # -> Faces, Edges, Vertices
item = ListItem(List=debrep.Edges, Index=[Slider(2, range=0..11), Slider(6, range=0..11)], Wrap=True)
eval = EvaluateCurve(Curve=reparameterize(item), Parameter=0.5)  # -> Point, Tangent, Angle
split = SplitList(List=eval.Point, Index=1)  # -> ListA, ListB
series = Series(Start=0, Step=Slider(0.1, range=0..0.1), Count=10)
ln = Line(StartPoint=split.ListA, EndPoint=split.ListB)
eval_2 = EvaluateCurve(Curve=reparameterize(ln), Parameter=series)  # -> Point, Tangent, Angle
P = ClusterOutput(eval_2.Point)
