# Grasshopper definition AnnualDaylightRevit.gh (Grasshopper 1.0.7)
# plug-ins: Rhino.Inside for Autodesk Revit, ProceduralCS, EleFront

txt = Text("dasf")
txt_2 = Text("dasf")

# ----
# Get Glazed Elements from Curtain Panels
model = ModelCategoriesPicker({"Abutments": -2006130, "Air Systems": -2001008, "Air Terminals": -2008013, "Analysis Display Style": -2000304, "Analysis Results": -2000303, "Areas": -2003200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}, selected="Walls": -2000011)
catfltr = CategoryFilter(Categories=model, Inverted=False)
elements = QueryElements(Filter=catfltr, Limit=100)  # -> Elements, Count
dependents = ElementDependents(Element=elements.Elements)
python = GhPythonScript(x=dependents, y="Curtain Wall Dbl Glass")  # -> out, simplify(flatten(a)); inputs x: list
# ---------- python: Python ----------
__author__ = "kongs"
__version__ = "2021.03.22"


a = []
for elem in x:
    if elem.Name == y:
        a.append(elem)
# ---------- end python ----------
python_2 = GhPythonScript(x=dependents, y="Glazed")  # -> out, a; inputs x: list; same code as python
python_3 = GhPythonScript(x=dependents, y="Entrance door")  # -> out, a; inputs x: list; same code as python
geometry = ElementGeometry(Elements=python_3.a)
geometry_2 = ElementGeometry(Elements=python_2.a)
geometry_3 = ElementGeometry(Elements=python.a)
cull_i = CullIndex(List=geometry_3, Indices=Slider(0, range=0..100), Wrap=True)
item = ListItem(List=geometry, Index=0, Wrap=True)

# ----
# REVIT
# SCALE TO METERS
number_slider = Slider(0.001, range=0..0.001)

# ----
# Deconstruct Windows
model_2 = ModelCategoriesPicker({"Abutments": -2006130, "Air Systems": -2001008, "Air Terminals": -2008013, "Analysis Display Style": -2000304, "Analysis Results": -2000303, "Areas": -2003200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}, selected="Windows": -2000014)
catfltr_2 = CategoryFilter(Categories=model_2, Inverted=False)
elements_2 = QueryElements(Filter=catfltr_2, Limit=100)  # -> Elements, Count
elemtype = ElementType(Element=elements_2.Elements)  # -> Element, Type
cset = CreateSet(List=elemtype.Type)  # -> Set, Map
typinstas = TypeInstances(Type=cset.Set)
bang = ExplodeTree(Data=simplify(typinstas))  # -> Branch0, Branch1
geometry_4 = ElementGeometry(Elements=bang.Branch0)
number_slider_2 = Slider(3, range=0..10)
item_2 = ListItem(List=geometry_4, Index=number_slider_2, Wrap=True)  # -> simplify(Item)
cull_i_2 = CullIndex(List=geometry_4, Indices=number_slider_2, Wrap=True)  # -> simplify(List)
# WINDOWS
scale = Scale(Geometry=cull_i_2, Center=Point(0, 0, 0), Factor=number_slider)  # -> Geometry, Transform

# ----
# Get Curtain Wall Mullions
model_3 = ModelCategoriesPicker({"Abutments": -2006130, "Air Systems": -2001008, "Air Terminals": -2008013, "Analysis Display Style": -2000304, "Analysis Results": -2000303, "Areas": -2003200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}, selected="Curtain Wall Mullions": -2000171)
catfltr_3 = CategoryFilter(Categories=model_3, Inverted=False)
elements_3 = QueryElements(Filter=catfltr_3, Limit=Slider(200, range=0..1000))  # -> Elements, Count
geometry_5 = ElementGeometry(Elements=elements_3.Elements)
scale_2 = Scale(Geometry=geometry_5, Center=Point(0, 0, 0), Factor=number_slider)  # -> Geometry, Transform

panel = Panel("""{47;*}
{5;*}
{34;*}""")
split = SplitTree(Data=simplify(geometry_2), Masks=flatten(panel))  # -> Positive, Negative

# ----
# Get Room floors
model_4 = ModelCategoriesPicker({"Abutments": -2006130, "Air Systems": -2001008, "Air Terminals": -2008013, "Analysis Display Style": -2000304, "Analysis Results": -2000303, "Areas": -2003200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}, selected="Rooms": -2000160)
catfltr_4 = CategoryFilter(Categories=model_4, Inverted=False)
panel_2 = Panel("""101
106
201
202
204
206""")
elements_4 = QueryElements(Filter=catfltr_4, Limit=100)  # -> Elements, Count
python_4 = GhPythonScript(x=elements_4.Elements, y=panel_2)  # -> out, a; inputs x: list, y: list
# ---------- python_4: Python ----------
__author__ = "kongs"
__version__ = "2021.03.22"


a = []
for elem in x:
    if elem.Number in y:
        a.append(elem)
# ---------- end python_4 ----------
geometry_6 = ElementGeometry(Elements=python_4.a)
debrep = DeconstructBrep(Brep=geometry_6)  # -> Faces, Edges, Vertices
item_3 = ListItem(List=debrep.Faces, Index=0, Wrap=True)  # -> flatten(Item)
scale_3 = Scale(Geometry=item_3, Center=Point(0, 0, 0), Factor=number_slider)  # -> Geometry, Transform

# ----
# Split Skylight based on Normal
geometry_7 = ElementGeometry(Elements=bang.Branch1)
cull_i_3 = CullIndex(List=geometry_7, Indices=number_slider_2, Wrap=True)  # -> simplify(List)
item_4 = ListItem(List=geometry_7, Index=number_slider_2, Wrap=True)  # -> simplify(Item)
scale_4 = Scale(Geometry=cull_i_3, Center=Point(0, 0, 0), Factor=number_slider)  # -> Geometry, Transform
debrep_2 = DeconstructBrep(Brep=item_4)  # -> Faces, Edges, Vertices
item_5 = ListItem(List=debrep_2.Faces, Index=Slider(1, range=0..5), Wrap=True)
scale_5 = Scale(Geometry=item_5, Center=Point(0, 0, 0), Factor=number_slider)  # -> Geometry, Transform
bang_2 = ExplodeTree(Data=simplify(scale_5.Geometry))  # -> Branch0, Branch1
mesh = MeshBrep(
    Brep=bang_2.Branch0,
    Settings={GridMaxCount=0, GridMinCount=16, JaggedSeams=False, MaxEdgeLength=0, MinEdgeLength=0.0001, MinTolerance=0, Refine=True, RefineAngle=0, RelativeTolerance=0.65, SimplePlanes=True, Tolerance=0})
mesh_2 = MeshBrep(
    Brep=bang_2.Branch1,
    Settings={GridMaxCount=0, GridMinCount=16, JaggedSeams=False, MaxEdgeLength=0, MinEdgeLength=0.0001, MinTolerance=0, Refine=True, RefineAngle=0, RelativeTolerance=0.65, SimplePlanes=True, Tolerance=0})
set_names = SetNames(Meshes=mesh, Names="skylight_north")
set_names_2 = SetNames(Meshes=mesh_2, Names="skylight_south")

# ----
# FLOORS
model_5 = ModelCategoriesPicker({"Abutments": -2006130, "Air Systems": -2001008, "Air Terminals": -2008013, "Analysis Display Style": -2000304, "Analysis Results": -2000303, "Areas": -2003200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}, selected="Floors": -2000032)
catfltr_5 = CategoryFilter(Categories=model_5, Inverted=False)
elements_5 = QueryElements(Filter=catfltr_5, Limit=100)  # -> Elements, Count
geometry_8 = ElementGeometry(Elements=elements_5.Elements)
scale_6 = Scale(Geometry=geometry_8, Center=Point(0, 0, 0), Factor=number_slider)  # -> Geometry, Transform
mesh_3 = MeshBrep(
    Brep=scale_6.Geometry,
    Settings={GridMaxCount=0, GridMinCount=16, JaggedSeams=False, MaxEdgeLength=0, MinEdgeLength=0.0001, MinTolerance=0, Refine=True, RefineAngle=0, RelativeTolerance=0.65, SimplePlanes=True, Tolerance=0})  # -> flatten(Mesh)
set_names_3 = SetNames(Meshes=mesh_3, Names="floor")

# ----
# WALLS
model_6 = ModelCategoriesPicker({"Abutments": -2006130, "Air Systems": -2001008, "Air Terminals": -2008013, "Analysis Display Style": -2000304, "Analysis Results": -2000303, "Areas": -2003200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}, selected="Walls": -2000011)
catfltr_6 = CategoryFilter(Categories=model_6, Inverted=False)
elements_6 = QueryElements(Filter=catfltr_6, Limit=100)  # -> Elements, Count
python_5 = GhPythonScript(x=elements_6.Elements, y="SH_Curtain wall")  # -> out, a; inputs x: list
# ---------- python_5: Python ----------
__author__ = "kongs"
__version__ = "2021.03.22"


a = []
for elem in x:
    if elem.Name != y:
        a.append(elem)
# ---------- end python_5 ----------
geometry_9 = ElementGeometry(Elements=python_5.a)
scale_7 = Scale(Geometry=geometry_9, Center=Point(0, 0, 0), Factor=number_slider)  # -> Geometry, Transform
# SET NAMES
mesh_4 = MeshBrep(
    Brep=scale_7.Geometry,
    Settings={GridMaxCount=0, GridMinCount=16, JaggedSeams=False, MaxEdgeLength=0, MinEdgeLength=0.0001, MinTolerance=0, Refine=True, RefineAngle=0, RelativeTolerance=0.65, SimplePlanes=True, Tolerance=0})  # -> flatten(Mesh)
# 2a)
set_names_4 = SetNames(Meshes=mesh_4, Names="wall")

# ----
# GROUND
model_7 = ModelCategoriesPicker({"Abutments": -2006130, "Air Systems": -2001008, "Air Terminals": -2008013, "Analysis Display Style": -2000304, "Analysis Results": -2000303, "Areas": -2003200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}, selected="Topography": -2001340)
catfltr_7 = CategoryFilter(Categories=model_7, Inverted=False)
elements_7 = QueryElements(Filter=catfltr_7, Limit=100)  # -> Elements, Count
geometry_10 = ElementGeometry(Elements=elements_7.Elements)
filtertype = FilterByType(Geometry=geometry_10, ObjectType="Mesh")  # -> flatten(Geometry)
clean = CleanTree(RemoveNulls=True, RemoveInvalid=True, RemoveEmpty=False, Tree=filtertype)
scale_8 = Scale(Geometry=clean, Center=Point(0, 0, 0), Factor=number_slider)  # -> Geometry, Transform
set_names_5 = SetNames(Meshes=scale_8.Geometry, Names="ground")

# ----
# Split Windows based on Normal
debrep_3 = DeconstructBrep(Brep=item_2)  # -> Faces, Edges, Vertices
item_6 = ListItem(List=debrep_3.Faces, Index=0, Wrap=True)  # -> flatten(Item)
panel_3 = Panel("""{0,1,0}
{0,-1,0}
{1,0,0}
{-1,0,0}""")
evalsrf = EvaluateSurface(Surface=reparameterize(item_6), Point="{0.5,0.5,0}")  # -> Point, Normal, UDirection, VDirection, Frame
dprod = DotProduct(VectorA=graft(panel_3), VectorB=evalsrf.Normal, Unitize=False)
equals = Equality(FirstNumber=dprod, SecondNumber=1)  # -> Equality, Inequality
cull = CullPattern(List=item_6, CullPattern=equals.Equality)
scale_9 = Scale(Geometry=cull, Center=Point(0, 0, 0), Factor=number_slider)  # -> Geometry, Transform
bang_3 = ExplodeTree(Data=scale_9.Geometry)  # -> Branch0, Branch1, Branch2, Branch3

# ----
# Split Curtain Double Doors based on Normal
number_slider_3 = Slider(0, range=0..5)
debrep_4 = DeconstructBrep(Brep=cull_i)  # -> Faces, Edges, Vertices
item_7 = ListItem(List=debrep_4.Faces, Index=number_slider_3, Wrap=True)  # -> flatten(Item)
panel_4 = Panel("""{0,1,0}
{0,-1,0}
{1,0,0}
{-1,0,0}""")
evalsrf_2 = EvaluateSurface(Surface=reparameterize(item_7), Point="{0.5,0.5,0}")  # -> Point, Normal, UDirection, VDirection, Frame
dprod_2 = DotProduct(VectorA=graft(panel_4), VectorB=evalsrf_2.Normal, Unitize=False)
equals_2 = Equality(FirstNumber=dprod_2, SecondNumber=1)  # -> Equality, Inequality
cull_2 = CullPattern(List=item_7, CullPattern=equals_2.Equality)
scale_10 = Scale(Geometry=cull_2, Center=Point(0, 0, 0), Factor=number_slider)  # -> Geometry, Transform
bang_4 = ExplodeTree(Data=scale_10.Geometry)  # -> Branch0, Branch1, Branch2, Branch3

# ----
# Split Curtain Doors based on Normal
number_slider_4 = Slider(2, range=0..5)
debrep_5 = DeconstructBrep(Brep=item)  # -> Faces, Edges, Vertices
item_8 = ListItem(List=debrep_5.Faces, Index=number_slider_4, Wrap=True)  # -> flatten(Item)
panel_5 = Panel("""{0,1,0}
{0,-1,0}
{1,0,0}
{-1,0,0}""")
evalsrf_3 = EvaluateSurface(Surface=reparameterize(item_8), Point="{0.5,0.5,0}")  # -> Point, Normal, UDirection, VDirection, Frame
dprod_3 = DotProduct(VectorA=graft(panel_5), VectorB=evalsrf_3.Normal, Unitize=False)
equals_3 = Equality(FirstNumber=dprod_3, SecondNumber=1)  # -> Equality, Inequality
cull_3 = CullPattern(List=item_8, CullPattern=equals_3.Equality)
scale_11 = Scale(Geometry=cull_3, Center=Point(0, 0, 0), Factor=number_slider)  # -> Geometry, Transform
bang_5 = ExplodeTree(Data=scale_11.Geometry)  # -> Branch0, Branch1, Branch2, Branch3

# ----
# Split Curtain Panels based on Normal
number_slider_5 = Slider(0, range=0..5)
debrep_6 = DeconstructBrep(Brep=simplify(split.Positive))  # -> Faces, Edges, Vertices
item_9 = ListItem(List=debrep_6.Faces, Index=number_slider_5, Wrap=True)  # -> flatten(Item)
panel_6 = Panel("""{0,1,0}
{0,-1,0}
{1,0,0}
{-1,0,0}""")
evalsrf_4 = EvaluateSurface(Surface=reparameterize(item_9), Point="{0.5,0.5,0}")  # -> Point, Normal, UDirection, VDirection, Frame
dprod_4 = DotProduct(VectorA=graft(panel_6), VectorB=evalsrf_4.Normal, Unitize=False)
equals_4 = Equality(FirstNumber=dprod_4, SecondNumber=1)  # -> Equality, Inequality
cull_4 = CullPattern(List=item_9, CullPattern=equals_4.Equality)
scale_12 = Scale(Geometry=cull_4, Center=Point(0, 0, 0), Factor=number_slider)  # -> Geometry, Transform
bang_6 = ExplodeTree(Data=scale_12.Geometry)  # -> Branch0, Branch1, Branch2, Branch3

# ----
# Split Curtain Panels based on Normal
number_slider_6 = Slider(1, range=0..5)
debrep_7 = DeconstructBrep(Brep=simplify(split.Negative))  # -> Faces, Edges, Vertices
item_10 = ListItem(List=debrep_7.Faces, Index=number_slider_6, Wrap=True)  # -> flatten(Item)
panel_7 = Panel("""{0,1,0}
{0,-1,0}
{1,0,0}
{-1,0,0}""")
evalsrf_5 = EvaluateSurface(Surface=reparameterize(item_10), Point="{0.5,0.5,0}")  # -> Point, Normal, UDirection, VDirection, Frame
dprod_5 = DotProduct(VectorA=graft(panel_7), VectorB=evalsrf_5.Normal, Unitize=False)
equals_5 = Equality(FirstNumber=dprod_5, SecondNumber=1)  # -> Equality, Inequality
cull_5 = CullPattern(List=item_10, CullPattern=equals_5.Equality)
scale_13 = Scale(Geometry=cull_5, Center=Point(0, 0, 0), Factor=number_slider)  # -> Geometry, Transform
bang_7 = ExplodeTree(Data=scale_13.Geometry)  # -> Branch0, Branch1, Branch2, Branch3

# ----
# CEILING
model_8 = ModelCategoriesPicker({"Abutments": -2006130, "Air Systems": -2001008, "Air Terminals": -2008013, "Analysis Display Style": -2000304, "Analysis Results": -2000303, "Areas": -2003200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}, selected="Roofs": -2000035)
model_9 = ModelCategoriesPicker({"Abutments": -2006130, "Air Systems": -2001008, "Air Terminals": -2008013, "Analysis Display Style": -2000304, "Analysis Results": -2000303, "Areas": -2003200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}, selected="Ceilings": -2000038)
catfltr_8 = CategoryFilter(Categories=[model_8, model_9], Inverted=False)
elements_8 = QueryElements(Filter=catfltr_8, Limit=100)  # -> Elements, Count
geometry_11 = ElementGeometry(Elements=elements_8.Elements)
scale_14 = Scale(Geometry=geometry_11, Center=Point(0, 0, 0), Factor=number_slider)  # -> Geometry, Transform
mesh_5 = MeshBrep(
    Brep=scale_14.Geometry,
    Settings={GridMaxCount=0, GridMinCount=16, JaggedSeams=False, MaxEdgeLength=0, MinEdgeLength=0.0001, MinTolerance=0, Refine=True, RefineAngle=0, RelativeTolerance=0.65, SimplePlanes=True, Tolerance=0})  # -> flatten(Mesh)
set_names_6 = SetNames(Meshes=mesh_5, Names="ceiling")

txt_3 = Text("dasf")
txt_4 = Text("dasf")

# ----
# LOGIN TO COMPUTE
# This demo is matching version 2021.5.0 of the ComputeGH plugin
panel_8 = Panel("https://compute.procedural.build")
# 0)
password = Text()
login = ComputeLogin(Username="INSERT YOUR USERNAME HERE", Password=password, ComputeURL=panel_8, Retry=Button())

# ----
# Windows
mesh_6 = MeshBrep(
    Brep=[bang_5.Branch1, bang_7.Branch1, bang_6.Branch1, bang_3.Branch1],
    Settings={GridMaxCount=0, GridMinCount=16, JaggedSeams=False, MaxEdgeLength=0, MinEdgeLength=0.0001, MinTolerance=0, Refine=True, RefineAngle=0, RelativeTolerance=0.65, SimplePlanes=True, Tolerance=0})  # -> flatten(Mesh)
mesh_7 = MeshBrep(
    Brep=[bang_4.Branch0, bang_5.Branch0, bang_7.Branch0, bang_3.Branch0],
    Settings={GridMaxCount=0, GridMinCount=16, JaggedSeams=False, MaxEdgeLength=0, MinEdgeLength=0.0001, MinTolerance=0, Refine=True, RefineAngle=0, RelativeTolerance=0.65, SimplePlanes=True, Tolerance=0})  # -> flatten(Mesh)
mesh_8 = MeshBrep(
    Brep=[bang_7.Branch3, bang_6.Branch3, bang_3.Branch3],
    Settings={GridMaxCount=0, GridMinCount=16, JaggedSeams=False, MaxEdgeLength=0, MinEdgeLength=0.0001, MinTolerance=0, Refine=True, RefineAngle=0, RelativeTolerance=0.65, SimplePlanes=True, Tolerance=0})  # -> flatten(Mesh)
mesh_9 = MeshBrep(
    Brep=[bang_4.Branch2, bang_6.Branch2, bang_7.Branch2, bang_3.Branch2],
    Settings={GridMaxCount=0, GridMinCount=16, JaggedSeams=False, MaxEdgeLength=0, MinEdgeLength=0.0001, MinTolerance=0, Refine=True, RefineAngle=0, RelativeTolerance=0.65, SimplePlanes=True, Tolerance=0})  # -> flatten(Mesh)
set_names_7 = SetNames(Meshes=mesh_9, Names="glass_west")
set_names_8 = SetNames(Meshes=mesh_6, Names="glass_north")
set_names_9 = SetNames(Meshes=mesh_7, Names="glass_south")
set_names_10 = SetNames(Meshes=mesh_8, Names="glass_east")

mesh_10 = MeshBrep(
    Brep=[scale.Geometry, scale_4.Geometry, scale_2.Geometry],
    Settings={GridMaxCount=0, GridMinCount=16, JaggedSeams=False, MaxEdgeLength=0, MinEdgeLength=0.0001, MinTolerance=0, Refine=True, RefineAngle=0, RelativeTolerance=0.65, SimplePlanes=True, Tolerance=0})  # -> flatten(Mesh)
set_names_11 = SetNames(Meshes=mesh_10, Names="window_frames")

# ----
# GET OR CREATE
# PROJECT AND TASK
panel_9 = Panel("Version 1")
# 1)
project_and_task = GetOrCreateProjectAndTask(Auth=login, ProjectName="Revit Annual Daylight", TaskName=panel_9, Create=Button())

merge = Merge(
    Data1=set_names_4,
    Data2=set_names_3,
    Data3=set_names_5,
    Data4=set_names_6,
    Data5=set_names_8,
    Data6=set_names_9,
    Data7=set_names_11,
    Data8=set_names_10,
    Data9=set_names_7,
    Data10=set_names,
    Data11=set_names_2)  # -> flatten(Result)

# ----
# Display
swatch = ColourSwatch(SwatchColor=RGB(0, 0, 0))
# Get Started: If you haven't done already, sign up for a free user account at https://compute.procedural.build/ to get started!
# 
# 0) Add your username (email) and password.
# 
# 1) Update the project name, number and task name. To create the new project and task click the button.
# 1a) Check the project and parent task in the browser to see progress.
# 
# 2) Update/Check the case setup.
# Pick the desired number of CPUs you want to run with.
# Select a EPW file that you want to use. You can use the Download EPW component to download an EPW file from EnergyPlus.
# 2a) Give names to the geometry.
# 2b) Apply materials.
# 
# 3) Click the button to upload and start the probe task.
# 
# 4) Click the button the start the daylight simulation.*
# 
# 5) Click the button the add a daylight metric calculation to the results of the daylight simulation.*
# 
# 6) Wait for the simulation to finish and the download will start.
# 
# 7) Visualize the results!
# 
# If you are having any questions, issues or feedback, you are welcome to post them at https://discourse.procedural.build/
# We will be there to answer any queries!
# 
# NOTES:
# * The simulation tasks will queue up, so you don't need to wait for each to finish, but you can just add task in one go.
swatch_2 = ColourSwatch(SwatchColor=RGB(0, 0, 0))
medges = MeshEdges(Mesh=merge)  # -> NakedEdges, InteriorEdges, NonManifoldEdges
wires = BrepWireframe(Density=-1)
preview = CustomPreview(Geometry=wires, Material=swatch)
preview_2 = CustomPreview(Geometry=[medges.NakedEdges, medges.InteriorEdges], Material=swatch_2)
preview_3 = CustomPreview(Material=ColourSwatch(SwatchColor=RGBA(86, 126, 193, 171)))

# ----
# SET MATERIALS
panel_10 = Panel("""glass_north*
glass_south*
glass_east*
glass_west*
skylight_north*
skylight_south*""")
panel_11 = Panel("""0.9
0.9
0.9
0.0
0.0""")
panel_12 = Panel("""ceiling*
window_frames*""")
python_6 = GhPythonScript(reals=panel_11)  # -> overrides; inputs reals: list
# ---------- python_6: Python ----------
__author__ = "Christian Kongsgaard"
__version__ = "2021.01.21"

import json


overrides = json.dumps({"reals": reals})
# ---------- end python_6 ----------
python_7 = GhPythonScript(bsdf="clear.xml")  # -> overrides
# ---------- python_7: Python ----------
__author__ = "Christian Kongsgaard"
__version__ = "2021.01.21"

import json


overrides = json.dumps({"bsdf_path": bsdf})
# ---------- end python_7 ----------
panel_13 = Panel("""wall*
floor*""")
list = ValueList({"Context": 0, "Wall": 1, "Window": 2, "Ceiling": 3, "Roof": 4, "Floor": 5, "Ground": 6}, selected="Ceiling")
list_2 = ValueList({"Context": 0, "Wall": 1, "Window": 2, "Ceiling": 3, "Roof": 4, "Floor": 5, "Ground": 6}, selected="Wall")
list_3 = ValueList({"Context": 0, "Wall": 1, "Window": 2, "Ceiling": 3, "Roof": 4, "Floor": 5, "Ground": 6}, selected="Ground")
list_4 = ValueList({"Context": 0, "Wall": 1, "Window": 2, "Ceiling": 3, "Roof": 4, "Floor": 5, "Ground": 6}, selected="Window")
material = RadianceMaterial(Names=panel_13, Preset=list_2)
material_2 = RadianceMaterial(Names=panel_12, Preset=list, Overrides=python_6)
material_3 = RadianceMaterial(Names="ground*", Preset=list_3)
material_4 = RadianceMaterial(Names=panel_10, Preset=list_4, Overrides=python_7)
# 2b)
merge_2 = Merge(Data1=material, Data2=material_2, Data3=material_3, Data4=material_4)

# ----
# INSPECT NORMALS
brep = Brep(flatten(scale_7.Geometry))
debrep_8 = DeconstructBrep(Brep=brep)  # -> Faces, Edges, Vertices
evalsrf_6 = EvaluateSurface(Surface=reparameterize(debrep_8.Faces), Point="{0.5,0.5,0}")  # -> Point, Normal, UDirection, VDirection, Frame
amp = Amplitude(Vector=evalsrf_6.Normal, Amplitude=Slider(100, range=0..100))
vdisex = VectorDisplayEx(Point=evalsrf_6.Point, Vector=evalsrf_6.Normal, Colour=RGB(0, 0, 0), Width=2)

# ----
# SETUP SOLUTION
panel_14 = Panel("{ambient_bounces:5, ambient_divisions: 22400, limit_ray_weight: 0.00005}")
panel_15 = Panel("C:\Procedural\AnnualDaylight\DNK_Copenhagen.061800_IWEC.epw")
list_5 = ValueList({"3Phase": 0, "SolarRadiation": 1, "DaylightFactor": 2, "SkyViewFactor": 3}, selected="3Phase")
# 2)
radiation_solution = RadiationSolution(
    Input=project_and_task,
    CPUs=Slider(18, range=1..24),
    Method=list_5,
    Materials=merge_2,
    EPWFile=panel_15,
    Overrides=panel_14)

# ----
# Open Compute in Browser
toggle = BooleanToggle(False)
# 1a)
launch_browser = PythonScript(input=project_and_task, open=toggle)  # -> out
# ---------- launch_browser: Python ----------
import webbrowser
import json

taskId = ""
projectId = ""
url = ""

if input:
    input_ = json.loads(input)
    task = input_.get("task")
    project = input_.get("project")
    url = input_.get("url")
    if task:
        taskId = task.get("uid")
    if project:
        projectId = project.get("uid")



if url and taskId:
    url = url + "/project/" + projectId + "/task/" + taskId
    print url
else:
    print "Please provide input from Task/Project component"
    print "GOT url:", url, "TaskId:", taskId
if open:
    webbrowser.open(url, new=2)
# ---------- end launch_browser ----------
panel_16 = Panel(launch_browser)

# ----
# CREATE PROBES
area = Area(Geometry=scale_3.Geometry)  # -> Area, Centroid
sort = SortList(Keys=area.Area, ValuesA=scale_3.Geometry)  # -> Keys, ValuesA
flip = Flip(Surface=sort.ValuesA)  # -> Surface, Result
# 3)
analysismesh = AnalysisMesh(Surface=flip.Surface, GridSize=Slider(0.2, range=0..1), Offset=Slider(0.8, range=0..1), OffsetDirection=2)  # -> AnalysisMesh, FaceCenters, FaceNormals
probe_radiation = ProbeRadiation(
    Input=radiation_solution,
    Mesh=analysismesh.AnalysisMesh,
    Points=analysismesh.FaceCenters,
    Normals=analysismesh.FaceNormals,
    Names=panel_2,
    Create=Button())

# ----
# COMPUTE CASE
button = Button()
# 4)
compute = Compute(Input=probe_radiation, Mesh=merge, Compute=button)  # -> Info, Output

# ----
# COMPUTE DAYLIGHT METRIC
list_6 = ValueList({"Daylight Autonomy": 0, "Spatial Daylight Autonomy": 1, "Continuous Daylight Autonomy": 2, "Useful Daylight Illuminances": 3, "Statistics": 4}, selected="Spatial Daylight Autonomy")
# 5)
daylight_metrics = DaylightMetrics(Input=compute.Output, Preset=list_6, CPUs=Slider(2, range=0..10), CaseDirectory="metrics", Create=Button())

# ----
# DOWNLOAD
panel_17 = Panel("C:\Procedural\RevitAnnualDaylight\")
concat = Concatenate(FragmentA=panel_17, FragmentB=panel_9)
# 6)
download = Download(Input=daylight_metrics, DownloadPath="metrics", LocalPath=concat, Reload=Button())

# ----
# VISUALIZE
number_slider_7 = Slider(0, range=0..9)
radiation_results = RadiationProbeResults(Folder=download, Rerun=Button())  # -> Info, Metric
branch_mask = GhPythonScript(Index=number_slider_7)  # -> out, Path
# ---------- branch_mask: Python ----------
__author__ = "kongs"
__version__ = "2020.08.31"

import rhinoscriptsyntax as rs

if not Index:
    Index = 0
    
Path = "{*;" + str(Index) + "}"
# ---------- end branch_mask ----------
split_2 = SplitTree(Data=radiation_results.Metric, Masks=flatten(branch_mask.Path))  # -> Positive, Negative
panel_18 = Panel(radiation_results.Info)
colors = Data([RGB(113, 142, 173), RGB(118, 150, 161), RGB(129, 169, 135), RGB(138, 186, 112), RGB(145, 190, 106), RGB(187, 198, 91), RGB(231, 206, 76), RGB(238, 210, 81), RGB(244, 226, 118), RGB(252, 245, 164), RGB(255, 253, 184)])
recolor_mesh = RecolorMesh(
    Mesh=analysismesh.AnalysisMesh,
    Result=split_2.Positive,
    ListOfColors=colors,
    LowerBoundary=Slider(0, range=0..100),
    UpperBoundary=Slider(100, range=0..100),
    Segments=10)  # -> ColoredMesh, Colors, Values
mjoin = MeshJoin(Meshes=flatten(recolor_mesh.ColoredMesh))
python_8 = GhPythonScript(mesh=mjoin, scale=Slider(1.2, range=0.5..5))  # -> out, text_point, legend
# ---------- python_8: Python ----------
__author__ = "kongs"
__version__ = "2020.09.15"

import rhinoscriptsyntax as rs

scale = scale or 1
bb = rs.BoundingBox(mesh)

point = bb[5]
point.X = point.X * 1.05 * scale
plane = rs.MovePlane(rs.WorldXYPlane(), point)

width = (bb[5].X - bb[4].X) * 0.15 * scale
height = (bb[3].Y - bb[4].Y)

legend = point

point_ = bb[0]
point_.Y = point_.Y - (height * 0.1 * scale)
text_point = rs.MovePlane(rs.WorldXYPlane(), point_)
# ---------- end python_8 ----------
branch = TreeBranch(Tree=simplify(recolor_mesh.Values), Path="{0}", MaintainPaths=True)  # -> reverse(Branch)
branch_2 = TreeBranch(Tree=simplify(recolor_mesh.Colors), Path="{0}", MaintainPaths=True)  # -> reverse(Branch)
# 7)
panel_19 = Panel("Daylight Autonomy %")
legend = Legend(BasePoint=python_8.legend, Colors=branch_2, Values=branch, Scale=Slider(2.5, range=0.5..5), TextHeight=1)  # -> Legend, Text
tag = TextTag3D(Location=python_8.text_point, Text=panel_19, Size=1, Colour=RGB(0, 0, 0), Justification=1)

# ----
# Tag Spatial Daylight Autonomy
number_slider_8 = Slider(1, range=0..9)
branch_mask_2 = GhPythonScript(Index=number_slider_8)  # -> out, Path; same code as branch_mask
split_3 = SplitTree(Data=radiation_results.Metric, Masks=flatten(branch_mask_2.Path))  # -> Positive, Negative
python_9 = GhPythonScript(x=split_3.Positive)  # -> out, a
# ---------- python_9: Python ----------
__author__ = "kongs"
__version__ = "2021.05.11"

import rhinoscriptsyntax as rs

a = "sDA: {0}%".format( x * 100)
# ---------- end python_9 ----------
area_2 = Area(Geometry=analysismesh.AnalysisMesh)  # -> Area, Centroid
Z = UnitZ(Factor=0.25)
move = Move(Geometry=area_2.Centroid, Motion=Z)  # -> Geometry, Transform
tag_2 = TextTag3D(
    Location=move.Geometry,
    Text=python_9.a,
    Size=Slider(0.5, range=0.1..1),
    Colour=ColourSwatch(SwatchColor=RGB(0, 0, 0)),
    Justification=5)

# ----
# Add to Revit Rooms
panel_20 = Panel("Spatial Daylight Autonomy")
sort_2 = SortList(Keys=area.Area, ValuesA=python_4.a)  # -> Keys, ValuesA
python_10 = GhPythonScript(x=flatten(split_3.Positive))  # -> out, a
# ---------- python_10: Python ----------
__author__ = "kongs"
__version__ = "2021.05.11"

import rhinoscriptsyntax as rs

a = "{0}".format( x * 100)
# ---------- end python_10 ----------
sharedpara = DefineSharedParameter(Name=panel_20, Overwrite=False)
setparam = SetElementParameter(Element=sort_2.ValuesA, ParameterKey=sharedpara, ParameterValue=python_10.a)  # disabled
