# Grasshopper definition MeshIndependence.gh (Grasshopper 1.0.7)
# plug-ins: ProceduralCS

# ----
# LOGIN TO COMPUTE
# This demo is matching version 2021.7.2 of the ComputeGH plugin
panel = Panel("https://compute.procedural.build")
# 0)
password = Text()
login = ComputeLogin(Username="INSERT YOUR USERNAME HERE", Password=password, ComputeURL=panel, Retry=Button())

# ----
# GEOMETRY
panel_2 = Panel("buildings")
mesh = Mesh([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])
# 2a) GEOMETRY: Here we assign names to the geometry.
# For this demo, we just give all the geometry the same name "buildings". When doing larger cases it is adventages to apply different names to different parts of the input geometry.
# That way it is easier to find the individual surfaces later, if needed.
# 
# We also apply the mesh levels here.
# The mesh levels specifies the size of the mesh faces on the surface of the geometry. The levels are related to the Cell Size set in the Domain component.
# If you have a Cell Size of eg. 10m and apply a mesh level of 2 then your mesh faces will be 10 halfed 2 times ie. 2.5m
number_slider = Slider(2, range=0..10)
set_names = SetNames(Meshes=mesh, Names=panel_2)  # -> Meshes, Names
mesh_level = CFDMeshLevel(Meshes=set_names.Meshes, MinLevel=number_slider, MaxLevel=0)

# ----
# GET OR CREATE
# PROJECT AND TASK
panel_3 = Panel("Version 1")
# 1) CREATE PROJECT AND TASK: Every task on Compute belongs to a project. Then first thing to do is to create that project.
# 
# We will call our project Simple VWT and our TaskName Version 1. The parent task we create together with our project works to group our simulation tasks, so we can easily keep track of design iterations. When we click on the Create button the project and task will be created on Compute.
button = Button()
# 1)
project_and_task = GetOrCreateProjectAndTask(Auth=login, ProjectName="Mesh Independence", TaskName=panel_3, Create=button)

# ----
# CONFIGURE MESHING
number_slider_2 = Slider(0, range=0..100)
# 2b) CONFIGURE MESHING: This is where we set up the domain and mesh properties for the CFD case.
# The meshes with applied mesh levels are inputted and the domain is generated.
# In the domain component you can specify different properties for the CFD domain.
# 
# For this demo we have just applied some simple defaults, which should be changed when you run a real case.
number_slider_3 = Slider(2, range=0..10)
toggle = BooleanToggle(True)
list = ValueList({"3D": 0, "2D": 1}, selected="3D")
domain = CFDDomain(
    Objects=mesh_level,
    DomainType=list,
    CellSize=Slider(2, range=0..2),
    Z0=toggle,
    CenterXY=toggle,
    Square=toggle,
    XYScale=Slider(1.5, range=0..10),
    XYOffset=number_slider_2,
    ZScale=number_slider_3)  # -> Output, Info, BoundingBox, Mesh
panel_4 = Panel(domain.Info)
mesh_2 = ComputeMesh(Input=project_and_task, Domain=domain.Output)

# ----
# Display
mesh_3 = Mesh(domain.Mesh)
# Get Started: If you haven't done already, sign up for a free user account at https://compute.procedural.build/ to get started!
# 
# 0) Add your username (email) and password.
# 
# 1) Update the project name, number and task name. To create the new project and task click the button.
# 
# 2) Update the solver configuration or leave the defaults.
# 
# 3) Click the button to upload and start simulating the case.
# 
# 4) Click the button to add the probe points. Make sure to create the C:/Procedural/ComputeVWTDemo folder to store the results in.
# 
# 5) Wait for the simulation to finish and visualise the results.
# 
# 6) Check the simulation progress in the browser.
# 
# If you are having any questions, issues or feedback, you are welcome to post them at https://discourse.procedural.build/
# We will be there to answer any queries!
swatch = ColourSwatch(SwatchColor=RGB(0, 0, 0))
medges = MeshEdges(Mesh=mesh_3)  # -> NakedEdges, InteriorEdges, NonManifoldEdges
wires = BrepWireframe(Brep=domain.BoundingBox, Density=-1)
preview = CustomPreview(Geometry=wires, Material=ColourSwatch(SwatchColor=RGB(0, 0, 0)))
preview_2 = CustomPreview(Geometry=domain.Mesh, Material=ColourSwatch(SwatchColor=RGB(153, 153, 153)))
preview_3 = CustomPreview(Geometry=[medges.NakedEdges, medges.InteriorEdges], Material=swatch)
facen = FaceNormals(Mesh=mesh_3)  # -> flatten(Centers), Normals
lng = ListLength(List=facen.Centers)
mesh_faces = Panel(lng)

# ----
# SET BOUNDARY CONDITIONS
panel_5 = Panel("{'U': '{ value uniform (0 -5 0); }'}")
# 2c) ASSIGN BOUNDARY CONDITIONS: Here we assign boundary conditions to the different geometry.
# By default all geometry are given the boundary condition "wall".
# Therefore we only need to give the domain box sides different boundary conditions to specify in flow of air over the model.
panel_6 = Panel("""MaxZ
MinZ
MinX
MaxX""")
cfd_bc = CFDBoundaryCondition(Names="MaxY", Preset=2, Overrides=panel_5)
cfd_bc_2 = CFDBoundaryCondition(Names="MinY", Preset=3)
cfd_bc_3 = CFDBoundaryCondition(Names=panel_6, Preset=1)
merge = Merge(Data1=cfd_bc, Data2=cfd_bc_2, Data3=cfd_bc_3)

# ----
# Open Compute in Browser
toggle_2 = BooleanToggle(False)
# 1a)
launch_browser = PythonScript(input=project_and_task, open=toggle_2)  # -> out
# ---------- launch_browser: Python ----------
import webbrowser
import json

taskId = ""
projectId = ""
url = ""

if input:
    input_ = json.loads(input)
    task = input_.get("task")
    project = input_.get("project")
    url = input_.get("url")
    if task:
        taskId = task.get("uid")
    if project:
        projectId = project.get("uid")



if url and taskId:
    url = url + "/project/" + projectId + "/task/" + taskId
    print url
else:
    print "Please provide input from Task/Project component"
    print "GOT url:", url, "TaskId:", taskId
if open:
    webbrowser.open(url, new=2)
# ---------- end launch_browser ----------
panel_7 = Panel(launch_browser)

# ----
# SETUP SOLVER
list_2 = ValueList({"simpleFoam": 0, "potentialFoam": 1, "porousSimpleFoam": 2, "pisoFoam": 3, "buoyantSimpleFoam": 4, "buoyantPimpleFoam": 5, "buoyantBoussinesqSimpleFoam": 6, "buoyantBoussinesqPimpleFoam": 7}, selected="simpleFoam")
# 2) SETUP SOLUTION: With the solution component you can specify, who many CPUs you want to run with. For this demo 4 is sufficient.
# 
# You can choose between different OpenFOAM solvers. For running outdoor comfort analyses the simpleFoam solver is recormended.
# We will also use the MeshIndependenceStudy as Case Type as it is the method that sets up the mesh independence study with multiple mesh sizes. By default it sets up 3 sizes, but this can be modified with the overrides.
number_slider_4 = Slider(300, range=0..1000)
list_3 = ValueList({"SimpleCase": 0, "VirtualWindTunnel": 1, "MeshOnly": 2, "MeshIndependenceStudy": 3}, selected="MeshIndependenceStudy")
# 2)
cfd_solution = ComputeSolution(
    Input=mesh_2,
    CPUs=Slider(2, range=1..24),
    Solver=list_2,
    CaseType=list_3,
    BoundaryConditions=merge,
    Iterations=number_slider_4)

# ----
# CREATE A PROBE POINTS
number_slider_5 = Slider(1.5, range=0..3)
# 4a) CREATE PROBE POINTS: We use the AnalysisMesh component to create a mesh, whose face centers we use as probe points.
# 
# The mesh we will also use to color the results onto.
bbox = BoundingBox(Content=mesh, Plane=PlaneXY(0, 0, 0))  # -> Box, Box_2
list_4 = ValueList({"X": 0, "Y": 1, "Z": 2}, selected="Z")
slicedomain = SliceDomain(
    Domain=domain.BoundingBox,
    Location=number_slider_5,
    GridSize=Slider(2, range=0..3),
    Exclude=bbox.Box,
    SliceDirection=list_4)  # -> AnalysisMesh, FaceCenters, FaceNormals

# ----
# RUN ON COMPUTE
button_2 = Button()
# 3)
compute = Compute(Input=cfd_solution, Mesh=domain.Mesh, Compute=button_2)  # -> Info, Output
# 3) COMPUTE: Clicking Compute will upload the geometry, boundary conditions and anything else needed to run the case.
# 
# This component will create an Actions tasks, that turn the Rhino/Grasshopper geometry and boundary condition descriptions into openFOAM files and setup the openFOAM case.
# The component will create a series of Action, Mesh and SimpleCases, which will execute after the Actions task is done.
# All these tasks will run in parralell and make up the mesh independence study.
# 
# When a black info bar under the component appears, saying Tasks Created, then the tasks are created on the server. You can then go to the project and task on Compute to inspect.
panel_8 = Panel(compute.Info)

# ----
# SETUP SOLVER
# 5) SETUP SOLUTION: With the solution component you can specify, who many CPUs you want to run with. For this demo 4 is sufficient.
# 
# We will use the VirtualWindTunnel Case Type as it is the method that sets up the virtual wind tunnel and lets you simulate multiple angles at the same time. You specify the number of angles that you would like to run in "Number of Angles". For this demo we have chosen 4, which means that the angles 0.0, 90.0, 180.0 and 270.0 is simulated.
# 
# We add the override >>"copy_folder": "independence/mesh_1/foam:foam"<< to copy/replace the folder "independence/mesh_1/foam" with the "foam" folder. That way we don't need to rerun the meshing.
# We add the override >>"keep_mesh": true<< to prevent the components from creating another Mesh task as we have already meshed the case.
panel_9 = Panel("{\"keep_mesh\": true, \"copy_folder\": {\"source\": \"independence/mesh_1/foam\", \"destination\": \"foam\"}}")
list_5 = ValueList({"simpleFoam": 0, "potentialFoam": 1, "porousSimpleFoam": 2, "pisoFoam": 3, "buoyantSimpleFoam": 4, "buoyantPimpleFoam": 5, "buoyantBoussinesqSimpleFoam": 6, "buoyantBoussinesqPimpleFoam": 7}, selected="simpleFoam")
list_6 = ValueList({"SimpleCase": 0, "VirtualWindTunnel": 1, "MeshOnly": 2, "MeshIndependenceStudy": 3}, selected="VirtualWindTunnel")
# 5)
cfd_solution_2 = ComputeSolution(
    Input=mesh_2,
    CPUs=Slider(2, range=1..24),
    Solver=list_5,
    CaseType=list_6,
    BoundaryConditions=merge,
    Iterations=Slider(300, range=0..1000),
    NumberOfAngles=Slider(4, range=0..10),
    Overrides=panel_9)

# ----
# RUN ON COMPUTE
button_3 = Button()
# 6)
compute_2 = Compute(Input=cfd_solution_2, Mesh=domain.Mesh, Compute=button_3)  # -> Info, Output
# 6) COMPUTE VWT: Clicking Compute will upload the geometry, boundary conditions and anything else needed to run the case.
# 
# This component will create an Actions tasks, that turn the Rhino/Grasshopper geometry and boundary condition descriptions into openFOAM files and setup the openFOAM case.
# The component will create a Mesh task, which will execute after the Actions task is done.
# Furthermore, a VirtualWindTunnel task will be created with the number of wind angles underneeth that has been specified in the Solution component. The wind angles will start and run in parallel, when the prepare_wind_tunnel is finished.
# 
# When a black info bar under the component appears, saying Tasks Created, then the tasks are created on the server. You can then go to the project and task on Compute to inspect.
panel_10 = Panel(compute_2.Info)

# ----
# PROBE AND DOWNLOAD
number_slider_6 = Slider(1, range=0..1)
# 4) CREATE PROBES: When clicking the button connected to Create in the Probe Points component and new subtask, called Probe, will be created for each mesh independence subtask.
# 
# We run the probe task as a way of evaulating the different mesh resolutions. Finally a Probe Statistics task will be create that produces statistics, that can be used to decide, which mesh resolution to choose.
# 
# Fields is the fields (type of values) we want to extract from the CFD simulation. In this case we are interested in the wind speeds (U) and the pressure (p).
button_4 = Button()
# 4)
panel_11 = Panel("""U
p""")
probe_points = ProbePoints(
    Input=compute.Output,
    Points=slicedomain.FaceCenters,
    Fields=panel_11,
    Mesh=slicedomain.AnalysisMesh,
    CPUs=number_slider_6,
    DependentOn="VirtualWindTunnel",
    Create=button_4)

# ----
# PROBE AND DOWNLOAD
number_slider_7 = Slider(1, range=0..1)
# 7) CREATE PROBES: When clicking the button connected to Create in the Probe Points component and new subtask, called Probe, will be created.
# Running probe tasks in a CFD simulation is a post simulation process and what you are doing is to go into the simulation results and extracting the values you want from a set of probe points.
# We do that by creating a grid of points that we want to have the results in.
# 
# Fields is the fields (type of values) we want to extract from the CFD simulation. In this case we are interested in the wind speeds (Utrans) and the pressure (p).
button_5 = Button()
# 7)
probe_points_2 = ProbePoints(
    Input=compute_2.Output,
    Points=slicedomain.FaceCenters,
    Fields="Utrans",
    CPUs=number_slider_7,
    DependentOn="VirtualWindTunnel",
    Create=button_5)

# ----
# 4b) DOWNLOAD RESULTS: The component will itself start downloading the files as soon as they become available on the server.
# 
# We are downloading the probe statistics and parsing them in the next panel, so we can decide, which mesh size we want to continue with.
# 
# The probe statistics are always compared against the smallest mesh size.
panel_12 = Panel("C:\Procedural\SimpleVWT\")
concat = Concatenate(FragmentA=panel_12, FragmentB=panel_3, FragmentC="\")
download = Download(Input=compute.Output, DownloadPath="independence/probe_stats.json", LocalPath=concat, Reload=Button())
python = GhPythonScript(path=download, file_name="probe_stats.json")  # -> out, data
# ---------- python: Python ----------
__author__ = "kongs"
__version__ = "2021.09.06"

import os
import json

_data = None

if path and file_name:
    _path = os.path.join(path, file_name)
    if os.path.exists(_path):
        with open(_path, "r") as file:
            _data = json.load(file)

if _data:
    data = ""
    for set in _data.keys():
        data += "## " + set + " ##\n\n"
        for field in _data[set].keys():
            data += "## " + field + " ##\n"
            versions = "    "
            mse =  "MSE  "
            rmse = "RMSE "
            std =  "STD  "
            min =  "MIN  "
            max =  "MAX  "
            for version in _data[set][field].keys():
                _version = version.replace("/data/independence/", "").replace("/foam", "")
                versions += _version + "    " 
                mse  += "{:.2f}".format(_data[set][field][version]["mse"])+ "    " 
                rmse += "{:.2f}".format(_data[set][field][version]["rmse"])+ "    " 
                std  += "{:.2f}".format(_data[set][field][version]["std"])+ "    " 
                min  += "{:.2f}".format(_data[set][field][version]["min"])+ "    " 
                max  += "{:.2f}".format(_data[set][field][version]["max"])+ "    " 
            data += versions + "\n" + mse + "\n" + rmse + "\n" + std + "\n" + min + "\n" + max + "\n\n"
else:
    data = "Waiting for file to be available!"
# ---------- end python ----------
probe_stats = Panel(python.data)

# ----
# 7b) DOWNLOAD RESULTS: The component will itself start downloading the files as soon as they become available on the server.
# 
# Notice that we are downloading two folders:
# 
# * VWT/postProcessing/internalCloud
# * geometry
# 
# They are respectively put into
# * probeResults
# * geometry
# 
# That way we can both download the probe results and the result mesh. The Path output from the download component, we split into two, so we can give it to the right input in the Load Results Component.
panel_13 = Panel("C:\Procedural\MeshIndependence\")
panel_14 = Panel("""\probeResults
\geometry""")
panel_15 = Panel("""VWT/postProcessing/internalCloud
geometry""")
concat_2 = Concatenate(FragmentA=panel_13, FragmentB=panel_3, FragmentC=panel_14)
download_2 = Download(Input=probe_points_2, DownloadPath=panel_15, LocalPath=concat_2, Reload=Button())
item = ListItem(List=download_2, Index=1, Wrap=True)
item_2 = ListItem(List=download_2, Index=0, Wrap=True)

# ----
# Visualize Values
# 8) VISUALIZE WIND RESULTS: By using the Load Probe Results and the Recolor Mesh components, it is possible to visualize the wind speed from the differnt wind angles.
# https://compute.procedural.build
number_slider_8 = Slider(0, range=0..3)
load_probe_results = LoadProbeResults(Folder=item_2, MeshPath=item, Rerun=Button())  # -> Info, Points, Mesh, Utrans, P, U
branch_mask = GhPythonScript(Index=number_slider_8)  # -> out, Path
# ---------- branch_mask: Python ----------
__author__ = "kongs"
__version__ = "2020.08.31"

import rhinoscriptsyntax as rs

if not Index:
    Index = 0
    
Path = "{*;" + str(Index) + "}"
# ---------- end branch_mask ----------
panel_16 = Panel(load_probe_results.Info)
vlen = VectorLength(Vector=load_probe_results.Utrans)
split = SplitTree(Data=vlen, Masks=flatten(branch_mask.Path))  # -> Positive, Negative
colors = Data([RGB(255, 255, 255), RGB(209, 229, 240), RGB(146, 197, 222), RGB(67, 147, 195), RGB(33, 102, 172), RGB(5, 48, 97)])
# 8)
recolor_mesh = RecolorMesh(
    Mesh=load_probe_results.Mesh,
    Result=split.Positive,
    ListOfColors=colors,
    UpperBoundary=Slider(8, range=0..10),
    Segments=10)  # -> ColoredMesh, Colors, Values
mjoin = MeshJoin(Meshes=flatten(recolor_mesh.ColoredMesh))
python_2 = GhPythonScript(mesh=mjoin, scale=Slider(1.2, range=0.5..5))  # -> out, text_point, legend
# ---------- python_2: Python ----------
__author__ = "kongs"
__version__ = "2020.09.15"

import rhinoscriptsyntax as rs

scale = scale or 1
bb = rs.BoundingBox(mesh)

point = bb[5]
point.X = point.X * 1.05 * scale
plane = rs.MovePlane(rs.WorldXYPlane(), point)

width = (bb[5].X - bb[4].X) * 0.15 * scale
height = (bb[3].Y - bb[4].Y)

legend = point

point_ = bb[0]
point_.Y = point_.Y - (height * 0.1 * scale)
text_point = rs.MovePlane(rs.WorldXYPlane(), point_)
# ---------- end python_2 ----------
legend_text = LegendText(T=load_probe_results.Info, i=number_slider_8)
legend = Legend(
    BasePoint=python_2.legend,
    Colors=recolor_mesh.Colors,
    Values=recolor_mesh.Values,
    Scale=Slider(2.5, range=0.5..5),
    TextHeight=1)  # -> Legend, Text
tag = TextTag3D(Location=python_2.text_point, Text=legend_text, Size=1, Colour=RGB(0, 0, 0), Justification=1)

# ----
# Visualize Vectors
bnd = Bounds(Numbers=flatten(vlen))
split_2 = SplitTree(Data=load_probe_results.Utrans, Masks=flatten(branch_mask.Path))  # -> Positive, Negative
dedomain = DeconstructDomain(Domain=bnd)  # -> Start, End
gradient = Gradient(
    LowerLimit=dedomain.End,
    UpperLimit=dedomain.Start,
    Parameter=split.Positive,
    stops=[0: RGB(5, 48, 97), 0.166: RGB(33, 102, 172), 0.33: RGB(67, 147, 195), 0.5: RGB(146, 197, 222), 0.66: RGB(209, 229, 240), 0.833: RGB(255, 255, 255)])
vdisex = VectorDisplayEx(Point=load_probe_results.Points, Vector=split_2.Positive, Colour=gradient, Width=2)

# ==== cluster LegendText
T = ClusterInput()
i = ClusterInput()
branch = TreeBranch(Tree=T, Path="{2}", MaintainPaths=True)
item = ListItem(List=branch, Index=i, Wrap=True)
concat = Concatenate(FragmentA="Wind Velocity [m/s]", FragmentB=item, FragmentC="° from North")
R = ClusterOutput(concat)
