# Grasshopper definition 2D-Indoor.gh (Grasshopper 1.0.7)
# plug-ins: ProceduralCS

# ----
# Mesh Settings
number_slider = Slider(15, range=0..100)
custom_mesh_settings = SettingsCustom(
    StitchSeams=True,
    SimplePlanes=Toggle(True),
    Refine=True,
    MinCount=number_slider,
    MaxCount=400,
    AspectRatio=20,
    MaxDistance=0,
    MaxAngle=Slider(18, range=0..100),
    MinEdge=0,
    MaxEdge=0)

number_slider_2 = Slider(3, range=0..10)
roof = Brep(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)
walls = Brep([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])
openings = Brep([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])
people = Brep([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])
facade = Brep([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])
railing = Brep([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])
slabs = Brep([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])
smooth = SettingsQuality()
join = BrepJoin(Breps=[roof, walls])  # -> Breps, Closed
mesh = MeshBrep(Brep=people, Settings=custom_mesh_settings)
mesh_2 = MeshBrep(Brep=facade, Settings=custom_mesh_settings)
mesh_3 = MeshBrep(Brep=openings, Settings=custom_mesh_settings)
mesh_4 = MeshBrep(Brep=slabs, Settings=custom_mesh_settings)
mesh_5 = MeshBrep(Brep=join.Breps, Settings=smooth)
mesh_6 = MeshBrep(Brep=railing, Settings=custom_mesh_settings)
set_names = SetNames(Meshes=mesh, Names="people")
set_names_2 = SetNames(Meshes=mesh_2, Names="facade")
set_names_3 = SetNames(Meshes=mesh_4, Names="slab")
set_names_4 = SetNames(Meshes=mesh_3, Names="openings")
set_names_5 = SetNames(Meshes=mesh_5, Names="envolope")
set_names_6 = SetNames(Meshes=mesh_6, Names="railing")
mesh_level = CFDMeshLevel(Meshes=set_names, MinLevel=number_slider_2, MaxLevel=0)
mesh_level_2 = CFDMeshLevel(Meshes=set_names_3, MinLevel=number_slider_2, MaxLevel=0)
mesh_level_3 = CFDMeshLevel(Meshes=set_names_4, MinLevel=number_slider_2, MaxLevel=0)
mesh_level_4 = CFDMeshLevel(Meshes=set_names_5, MinLevel=number_slider_2, MaxLevel=0)
mesh_level_5 = CFDMeshLevel(Meshes=set_names_6, MinLevel=number_slider_2, MaxLevel=0)
mesh_level_6 = CFDMeshLevel(Meshes=set_names_2, MinLevel=number_slider_2, MaxLevel=0)

# ----
# LOGIN TO COMPUTE
# This demo is matching version 2021.3.6 of the ComputeGH plugin
panel = Panel("https://compute.procedural.build")
# 0)
password = Text()
login = ComputeLogin(Username="INSERT YOUR USERNAME HERE", Password=password, ComputeURL=panel, Retry=Button())

heat = Geometry([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])
mesh_7 = MeshBrep(Brep=heat, Settings=custom_mesh_settings)
number_slider_3 = Slider(1, range=0..10)
set_names_7 = SetNames(Meshes=mesh_7, Names="heatZone")
refinement_region = RefinementRegion(Meshes=set_names_7, Location="inside", MinLevel=number_slider_3, MaxLevel=number_slider_3)

# ----
# GET OR CREATE
# PROJECT AND TASK
panel_2 = Panel("Version 1")
# 1)
project_and_task = GetOrCreateProjectAndTask(Auth=login, ProjectName="2D Indoor", TaskName=panel_2, Create=Button())

# ----
# Inlet/Outlet
panel_3 = Panel("""{
'U': '{ value uniform (0 0.4 0); }',
'T': '{ type fixedValue; value uniform 290.15; }'
}""")
panel_4 = Panel("""{
'U': '{ value uniform (0 -0.4 0); }',
'T': '{ type fixedValue; value uniform 290.15; }'
}""")
panel_5 = Panel("""openings.__2
openings.__3
openings.__4""")
cfd_bc = CFDBoundaryCondition(Names="openings.__0", Preset=2, Overrides=panel_4)
cfd_bc_2 = CFDBoundaryCondition(Names="openings.__1", Preset=2, Overrides=panel_3)
cfd_bc_3 = CFDBoundaryCondition(Names=panel_5, Preset=2, Overrides="{'U': '{ value uniform (0 0 0.6); }'}")
cfd_bc_4 = CFDBoundaryCondition(Names="openings.__5", Preset=4)
merge = Merge(Data1=cfd_bc, Data2=cfd_bc_2, Data3=cfd_bc_3, Data4=cfd_bc_4)

# ----
# SET BOUNDARY CONDITIONS
panel_6 = Panel("{ 'T': '{ type fixedValue; value uniform 310.15; }' }")
getnames = GetNames()
getnames_2 = GetNames()
panel_7 = Panel("""MaxZ
MinZ
MinX
MaxX""")
panel_8 = Panel("""MinY
MaxY""")
cfd_bc_5 = CFDBoundaryCondition(Names=[panel_8, getnames], Preset=0)
cfd_bc_6 = CFDBoundaryCondition(Names=panel_7, Preset=1, Overrides="{ 'T': '{ type zeroGradient; }' }")
cfd_bc_7 = CFDBoundaryCondition(Names=getnames_2, Preset=0, Overrides=panel_6)
merge_2 = Merge(Data1=cfd_bc_5, Data2=cfd_bc_6, Data4=cfd_bc_7, Data5=merge)  # -> flatten(Result)

toggle = BooleanToggle(False)

merge_3 = Merge(
    Data1=mesh_level,
    Data2=mesh_level_3,
    Data3=mesh_level_6,
    Data4=mesh_level_4,
    Data5=mesh_level_2,
    Data6=mesh_level_5,
    Data7=refinement_region)
get_names = GetNames(Meshes=refinement_region)
pt = ConstructPoint(XCoordinate=6, YCoordinate=0, ZCoordinate=0)
yz = YZPlane(Origin=pt)
list = ValueList({"3D": 0, "2D": 1}, selected="2D")
setset = CFDSetSet(Names=get_names, Location=[True, True, False], IsCellZone=False)
domain = CFDDomain(
    Objects=merge_3,
    DomainType=list,
    CellSize=Slider(0.5, range=0..24),
    Z0=toggle,
    CenterXY=toggle,
    Square=True,
    XYScale=Slider(1.1, range=0..10),
    XYOffset=Slider(0, range=0..100),
    ZScale=Slider(1, range=0..10),
    Plane=yz)  # -> Output, Info, BoundingBox, Mesh
panel_9 = Panel(domain.Info)
mesh_8 = ComputeMesh(Input=project_and_task, Domain=domain.Output, SetSet=setset)

# ----
# Open Compute in Browser
toggle_2 = BooleanToggle(False)
# 1a)
launch_browser = PythonScript(input=project_and_task, open=toggle_2)  # -> out
# ---------- launch_browser: Python ----------
import webbrowser
import json

taskId = ""
projectId = ""
url = ""

if input:
    input_ = json.loads(input)
    task = input_.get("task")
    project = input_.get("project")
    url = input_.get("url")
    if task:
        taskId = task.get("uid")
    if project:
        projectId = project.get("uid")



if url and taskId:
    url = url + "/project/" + projectId + "/task/" + taskId
    print url
else:
    print "Please provide input from Task/Project component"
    print "GOT url:", url, "TaskId:", taskId
if open:
    webbrowser.open(url, new=2)
# ---------- end launch_browser ----------
panel_10 = Panel(launch_browser)

# ----
# SETUP SOLVER
panel_11 = Panel("""/* These overrides will override settings within casefiles.  

The case file that you specify will be created if it does not exist. 

Note that we use a ">" to define path separators (not a slash "/")
this is because the backend data structure does not support slashes in
a dictionary key.

A case file override looks like this:
```
constant>porosityProperties {
    testKey value;
}
```
*/

decomposeParDict {
numberOfSubdomains 6;
simpleCoeffs { n (3 2 1); }
hierarchicalCoeffs { n (3 2 1); }
}

system>fvOptions {
//************************

heatZone.__0
{
  type scalarSemiImplicitSource;
  active true;
  selectionMode cellSet;

  scalarSemiImplicitSourceCoeffs
  {
    cellSet heatZone.__0;    
    selectionMode cellSet;
    volumeMode  specific; // absolute
    injectionRateSuSp
    {
      h (130.15 0);
    }
  }
}


heatZone.__1
{
  type scalarSemiImplicitSource;
  active true;
  selectionMode cellSet;

  scalarSemiImplicitSourceCoeffs
  {
    cellSet heatZone.__1;     
    selectionMode cellSet;
    volumeMode  specific; // absolute
    injectionRateSuSp
    {
      h (130.15 0);
    }
  }
}


//************************
}""")
panel_12 = Panel("""/* 
This is a OpenFOAM formatted dictionary that defines overrides that will be
applied to the "fields" definition of your case.  

The fields dictionary defines which fields will be used (the files in the 0 folder).
Applying overrides here allows you to define additional fields for the calculation.

A field will look like this:
```
U
{
  classType volVectorField;
  dimensions [ 0 1 -1 0 0 0 0 ];
  internalField uniform (0 0 0);
}
```
*/

T
{
  internalField uniform 294.15;
}""")
list_2 = ValueList({"simpleFoam": 0, "potentialFoam": 1, "porousSimpleFoam": 2, "pisoFoam": 3, "buoyantSimpleFoam": 4, "buoyantPimpleFoam": 5, "buoyantBoussinesqSimpleFoam": 6, "buoyantBoussinesqPimpleFoam": 7}, selected="buoyantSimpleFoam")
list_3 = ValueList({"SimpleCase": 0, "VirtualWindTunnel": 1, "MeshOnly": 2}, selected="SimpleCase")
overrides = GhPythonScript(fields=panel_12, caseFiles=panel_11)  # -> overrides; inputs fields: list, presets: list, caseFiles: list
# ---------- overrides: Python ----------
__author__ = "markp"
__version__ = "2020.09.11"

import json

overrides = json.dumps({"setup": setup, "fields": fields, "presets": presets, "caseFiles": caseFiles})
# ---------- end overrides ----------
# 2)
cfd_solution = ComputeSolution(
    Input=mesh_8,
    CPUs=Slider(2, range=1..24),
    Solver=list_2,
    CaseType=list_3,
    BoundaryConditions=merge_2,
    Iterations=Slider(250, range=0..1000),
    NumberOfAngles=16,
    Overrides=overrides)

# ----
# RUN ON COMPUTE
# 3)
button = Button()
compute = Compute(Input=cfd_solution, Mesh=domain.Mesh, Compute=button)  # -> Info, Output
panel_13 = Panel(compute.Info)

# ----
# CREATE A CUT PLANE
number_slider_4 = Slider(6, range=0..10)
list_4 = ValueList({"X": 0, "Y": 1, "Z": 2}, selected="X")
slicedomain = SliceDomain(
    Domain=domain.BoundingBox,
    Location=number_slider_4,
    GridSize=Slider(0.1, range=0..3),
    Exclude=people,
    SliceDirection=list_4)  # -> AnalysisMesh, FaceCenters, FaceNormals

# ----
# Display
mesh_9 = Mesh(domain.Mesh)
# Get Started: If you haven't done already, sign up for a free user account at https://compute.procedural.build/ to get started!
# 
# 0) Add your username (email) and password.
# 
# 1) Update the project name, number and task name. To create the new project and task click the button.
# 
# 2) Update the solver configuration or leave the defaults.
# 
# 3) Click the button to upload and start simulating the case.
# 
# 4) Click the button to add the probe points.
# 
# 5) Wait for the simulation to finish and visualise the results. Connect the U and T values to the wire to see the results when they are done.
# 
# If you are having any questions, issues or feedback, you are welcome to post them at https://discourse.procedural.build/
# We will be there to answer any queries!
swatch = ColourSwatch(SwatchColor=RGB(0, 0, 0))
medges = MeshEdges(Mesh=mesh_9)  # -> NakedEdges, InteriorEdges, NonManifoldEdges
medges_2 = MeshEdges(Mesh=slicedomain.AnalysisMesh)  # -> NakedEdges, InteriorEdges, NonManifoldEdges
wires = BrepWireframe(Brep=domain.BoundingBox, Density=-1)
preview = CustomPreview(Geometry=wires, Material=ColourSwatch(SwatchColor=RGB(0, 0, 0)))
preview_2 = CustomPreview(Geometry=domain.Mesh, Material=ColourSwatch(SwatchColor=RGB(153, 153, 153)))
preview_3 = CustomPreview(Geometry=[medges.NakedEdges, medges.InteriorEdges], Material=ColourSwatch(SwatchColor=RGB(0, 0, 0)))
preview_4 = CustomPreview(Geometry=[medges_2.NakedEdges, medges_2.InteriorEdges], Material=swatch)

facen = FaceNormals(Mesh=mesh_9)  # -> flatten(Centers), Normals
lng = ListLength(List=facen.Centers)
mesh_faces = Panel(lng)

# ----
# PROBE AND DOWNLOAD
button_2 = Button()
# 4)
panel_14 = Panel("foam/")
panel_15 = Panel("""U
T""")
probe_points = ProbePoints(
    Input=compute.Output,
    Points=slicedomain.FaceCenters,
    Names="slice",
    Fields=panel_15,
    CPUs=1,
    CaseDirectory=panel_14,
    Create=button_2)
folder_name = GhPythonScript(BasePath="C:\Procedural", ProjectName="2D Indoor", TaskName=panel_2)  # -> out, ProjectPath, TaskPath
# ---------- folder_name: Python ----------
__author__ = "kongsgaard"
__version__ = "2020.08.31"

import rhinoscriptsyntax as rs
import os

if not BasePath:
    BasePath = "C:\Procedural"

if not ProjectName:
    ProjectName = "Project"
else:
    project_name_ = ProjectName.replace(" ", "_")
    
if not TaskName:
    TaskName = "Task"
else:
    task_name_ = TaskName.replace(" ", "_")
    
ProjectPath = os.path.join(BasePath, project_name_)
TaskPath = os.path.join(BasePath, project_name_, task_name_)
# ---------- end folder_name ----------
concat = Concatenate(FragmentA=folder_name.TaskPath, FragmentB="\probeResults")
download = Download(Input=probe_points, DownloadPath="foam/postProcessing/internalCloud", LocalPath=concat, Reload=Button())

# ----
# VISUALIZE AIR FLOW
# VISUALIZE AIR FLOW
button_3 = Button()
# 5)
load_probe_results = LoadProbeResults(Folder=download, Mesh=slicedomain.AnalysisMesh, Rerun=button_3)  # -> Info, Points, Mesh
connect_to_u = Relay()
# https://compute.procedural.build
panel_16 = Panel("{0;1}")
connect_to_t = Relay()
split = SplitTree(Data=connect_to_u, Masks=flatten(panel_16))  # -> Positive, Negative
split_2 = SplitTree(Data=connect_to_t, Masks=flatten("{0;1}"))  # -> Positive, Negative
vlen = VectorLength(Vector=split.Positive)
number_slider_5 = Slider(1, range=0..10)
subtraction = Subtraction(A=split_2.Positive, B=273.15)
bnd = Bounds(Numbers=vlen)
bnd_2 = Bounds(Numbers=subtraction)
dedomain = DeconstructDomain(Domain=bnd)  # -> Start, End
dedomain_2 = DeconstructDomain(Domain=bnd_2)  # -> Start, End
colors = Data([RGB(75, 107, 169), RGB(173, 203, 249), RGB(254, 244, 84), RGB(234, 126, 0), RGB(234, 38, 0)])
colors_2 = Data([RGB(75, 107, 169), RGB(173, 203, 249), RGB(254, 244, 84), RGB(234, 126, 0), RGB(234, 38, 0)])
recolor_mesh = RecolorMesh(
    Mesh=load_probe_results.Mesh,
    Result=subtraction,
    ListOfColors=colors,
    LowerBoundary=dedomain_2.Start,
    UpperBoundary=dedomain_2.End,
    Segments=10)  # -> ColoredMesh, Colors, Values
recolor_mesh_2 = RecolorMesh(
    Mesh=load_probe_results.Mesh,
    Result=vlen,
    ListOfColors=colors_2,
    LowerBoundary=dedomain.Start,
    UpperBoundary=number_slider_5,
    Segments=10)  # -> ColoredMesh, Colors, Values
python = GhPythonScript(mesh=recolor_mesh.ColoredMesh, scale=1)  # -> out, text_point, rectangle
# ---------- python: Python ----------
__author__ = "kongs"
__version__ = "2020.09.15"

import rhinoscriptsyntax as rs


bb = rs.BoundingBox(mesh)

point = bb[2]
point.Y = point.Y * 1.05 * scale
plane = rs.MovePlane(rs.WorldYZPlane(), point)


width = (bb[2].Y - bb[0].Y) * 0.05 * scale
height = (bb[4].Z - bb[2].Z)
rectangle = rs.AddRectangle(plane, width, height)

point_ = bb[0]
point_.Z = point_.Z - (height * 0.2 * scale)
text_point = rs.MovePlane(rs.WorldYZPlane(), point_)
# ---------- end python ----------
python_2 = GhPythonScript(mesh=recolor_mesh_2.ColoredMesh, scale=1)  # -> out, text_point, rectangle; same code as python
gradient = Gradient(
    LowerLimit=number_slider_5,
    UpperLimit=dedomain.Start,
    Parameter=vlen,
    stops=[0: RGB(234, 38, 0), 0.25: RGB(234, 126, 0), 0.5: RGB(254, 244, 84), 0.75: RGB(173, 203, 249), 1: RGB(75, 107, 169)])
legend = Legend(Colour=recolor_mesh.Colors, Tags=recolor_mesh.Values, Rectangle=python.rectangle, LegendType=1)
legend_2 = Legend(Colour=recolor_mesh_2.Colors, Tags=recolor_mesh_2.Values, Rectangle=python_2.rectangle, LegendType=1)
vdisex = VectorDisplayEx(Point=load_probe_results.Points, Vector=split.Positive, Colour=RGB(0, 0, 0), Width=2)
tag = TextTag3D(Location=python.text_point, Text="Temperature (C)", Size=1, Colour=RGB(0, 0, 0), Justification=1)
tag_2 = TextTag3D(Location=python_2.text_point, Text="Air Speed (m/s)", Size=1, Colour=RGB(0, 0, 0), Justification=1)
