# Grasshopper definition UTCI.gh (Grasshopper 1.0.7)
# plug-ins: ProceduralCS

num = Number(0)
num_2 = Number(0)

# ----
# LOGIN TO COMPUTE
# This demo is matching version 2021.7.2 of the ComputeGH plugin
panel = Panel("https://compute.procedural.build")
# S1) LOGIN: Login with your email and password for Compute here.
# If you don't have an account on Compute yet, then create one for free here: https://compute.procedural.build/accounts/register
# S1)
panel_2 = Panel("INSERT YOUR USERNAME HERE")
password = Text()
login = ComputeLogin(Username=panel_2, Password=password, ComputeURL=panel, Retry=Button())

num_3 = Number(0)
num_4 = Number(0)

num_5 = Number(0)
# https://compute.procedural.build
num_6 = Number(0)

# ----
# GEOMETRY
# S2) ASSING NAMES: Here we import the geometry and assign names to it.
# For this demo, we just give all the geometry the same name "buildings". When doing larger cases it is advantageous to apply different names to different parts of the input geometry.
# That way it is easier to find the individual surfaces later, if needed.
panel_3 = Panel("buildings")
# S2)
mesh = Mesh([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])
set_names = SetNames(Meshes=mesh, Names=panel_3)  # -> Meshes, Names

# ----
# SET BOUNDARY CONDITIONS
panel_4 = Panel("{'U': '{ value uniform (0 -5 0); }'}")
# W2c) ASSIGN BOUNDARY CONDITIONS: Here we assign boundary conditions to the different geometry.
# By default, all geometry are given the boundary condition "wall".
# Therefore we, only need to give the domain box sides different boundary conditions to specify in flow of air over the model.
panel_5 = Panel("""MaxZ
MinZ
MinX
MaxX""")
cfd_bc = CFDBoundaryCondition(Names="MaxY", Preset=2, Overrides=panel_4)
cfd_bc_2 = CFDBoundaryCondition(Names="MinY", Preset=3)
cfd_bc_3 = CFDBoundaryCondition(Names=panel_5, Preset=1)
merge = Merge(Data1=cfd_bc, Data2=cfd_bc_2, Data3=cfd_bc_3)

# ----
# S3)
# NAMING
insert_valid_local_epw_file_path = Panel("")
task_name = Panel("Version 1")
# S4)
project_name = Panel("UTCI")
probe_names = Panel("plaza")
# S3) NAMING: Here we specify the naming for this file.
# We have several names that are used throughout the file.
# 
# PROJECT NAME:
# This is the project name that we will run the simulations task under.
# 
# TASK NAME:
# This is the parent task name, which we organize all simulation task under.
# 
# PROBE NAMES:
# We give a descriptive name to our probes.
# 
# EPW FILE:
# A valid EPW file needs to be references here. If you do not have a EPW file, then you can download one by clicking on the Download EPW component.
button = Button()
download_epw = DownloadEPW(OpenBrowser=button)

# ----
# GET OR CREATE
# PROJECT AND TASK
# W1)
panel_6 = Panel("{\"nest_with\": \"Wind\"}")
# W1) CREATE PROJECT AND TASK: Every task on Compute belongs to a project. Then first thing to do is to create that project.
# 
# We will call our project UTCI and our TaskName Version 1 (both project name and task name are defined in the setup section of the script). The parent task we create together with our project works to group our simulation tasks, so we can easily keep track of design iterations. When we click on the Create button the project and task will be created on Compute.
# 
# We add the override: {"nest_with": "Wind"} to add a Wind parent task underneath the Version 1 task.
# 
# The Wind parent task is not doing anything. It is simple to organize the task list and to have Radiation tasks and CFD tasks grouped together.
project_and_task = GetOrCreateProjectAndTask(Auth=login, ProjectName=project_name, TaskName=task_name, Overrides=panel_6, Create=Button())

# ----
# GET OR CREATE
# PROJECT AND TASK
# R1) CREATE PROJECT AND TASK: We already have created a project above. So this time we are only going to create a parent task.
# 
# We add the override: {"nest_with": "Radiation"} to add a Radiation parent task underneath the Version 1 task.
# 
# The Radiation parent task is not doing anything. It is simple to organize the task list and to have Radiation tasks and CFD tasks grouped together.
panel_7 = Panel("{\"nest_with\": \"Radiation\"}")
# R1)
project_and_task_2 = GetOrCreateProjectAndTask(Auth=login, ProjectName=project_name, TaskName=task_name, Overrides=panel_7, Create=Button())

# ----
# CONFIGURE MESHING
# W2a) MESH LEVELS: We apply the mesh levels here.
# The mesh levels specifies the size of the mesh faces on the surface of the geometry. The levels are related to the Cell Size set in the Domain component.
# If you have a Cell Size of eg. 10m and apply a mesh level of 2 then your mesh faces will be 10 halved 2 times ie. 2.5m
number_slider = Slider(2, range=0..10)
mesh_level = CFDMeshLevel(Meshes=set_names.Meshes, MinLevel=number_slider, MaxLevel=0)
# W2b) CONFIGURE MESHING: This is where we set up the domain and mesh properties for the CFD case.
# The meshes with applied mesh levels are inputted and the domain is generated.
# In the domain component you can specify different properties for the CFD domain.
# 
# For this demo we have just applied some simple defaults, which should be changed when you run a real case.
number_slider_2 = Slider(2, range=0..10)
toggle = BooleanToggle(True)
list = ValueList({"3D": 0, "2D": 1}, selected="3D")
domain = CFDDomain(
    Objects=mesh_level,
    DomainType=list,
    CellSize=Slider(2, range=0..2),
    Z0=toggle,
    CenterXY=toggle,
    Square=toggle,
    XYScale=Slider(1.5, range=0..10),
    XYOffset=Slider(0, range=0..100),
    ZScale=number_slider_2)  # -> Output, Info, BoundingBox, Mesh
panel_8 = Panel(domain.Info)
# W2)
mesh_2 = ComputeMesh(Input=project_and_task, Domain=domain.Output)

# ----
# Display
mesh_3 = Mesh(domain.Mesh)
# Get Started: If you haven't done already, sign up for a free user account at https://compute.procedural.build/ to get started!
# 
# This demo is a bit different from other demos, mainly because of its size.
# We have split up the script into 4 sections
# (S) Setup
# (W) Wind
# (R) Radiation
# (C) Comfort
# 
# Go through the different sections and click to buttons to run the different analyses.
# 
# If you are having any questions, issues or feedback, you are welcome to post them at https://discourse.procedural.build/
# We will be there to answer any queries!
swatch = ColourSwatch(SwatchColor=RGB(0, 0, 0))
medges = MeshEdges(Mesh=mesh_3)  # -> NakedEdges, InteriorEdges, NonManifoldEdges
wires = BrepWireframe(Brep=domain.BoundingBox, Density=-1)
preview = CustomPreview(Geometry=wires, Material=ColourSwatch(SwatchColor=RGB(0, 0, 0)))
preview_2 = CustomPreview(Geometry=domain.Mesh, Material=ColourSwatch(SwatchColor=RGB(153, 153, 153)))  # disabled
preview_3 = CustomPreview(Geometry=[medges.NakedEdges, medges.InteriorEdges], Material=swatch)
facen = FaceNormals(Mesh=mesh_3)  # -> flatten(Centers), Normals
lng = ListLength(List=facen.Centers)
mesh_faces = Panel(lng)

# ----
# GET OR CREATE
# PROJECT AND TASK
# C1) GET PROJECT AND TASK: We already have created a project above. So this is only to retrieve the project and task information.
# 
# If the component is yellow saying that you should create a project/task, but you have already done it above, you can click Create. The component will not create a new task, but only retrieve the information from the Compute server.
button_2 = Button()
# C1)
project_and_task_3 = GetOrCreateProjectAndTask(Auth=login, ProjectName=project_name, TaskName=task_name, Create=button_2)

# ----
# SETUP SOLUTION
panel_9 = Panel("building*")
# R2) SETUP SOLUTION: With the solution component you can specify, who many CPUs you want to run with. For this demo 8 is sufficient.
# 
# You can choose between different methods. To run a mean radiant temperature analysis you have to pick the MeanRadiantTemperature method.
# 
# You cannot continue before you apply a valid EPW file.
# You can use our Download EPW component to find a EPW file that suits you.
# 
# Here we also assign materials to the geometry. For simplicity, we just apply the same material to all the geometry.
# It is possible to apply overrides to the different presets.
# Read more about the presets and overrides here:
# https://compute.procedural.build/docs/daylight/materials
list_2 = ValueList({"Context": 0, "Wall": 1, "Window": 2, "Ceiling": 3, "Roof": 4, "Floor": 5, "Ground": 6}, selected="Wall")
material = RadianceMaterial(Names=panel_9, Preset=list_2)
list_3 = ValueList({"3Phase": 0, "SolarRadiation": 1, "DaylightFactor": 2, "SkyViewFactor": 3, "MeanRadiantTemperature": 4}, selected="MeanRadiantTemperature")
# R3) CREATE PROBES: When clicking the button connected to Create in the Probe Radiation component and new subtask, called Probe, will be created. When a black info bar under the component appears, saying Task Created, then the task is created on the server. You can then go to the project and task on Compute to inspect.
# R2)
radiation_solution = RadiationSolution(
    Input=project_and_task_2,
    CPUs=Slider(2, range=1..24),
    Method=list_3,
    Materials=material,
    EPWFile=insert_valid_local_epw_file_path)

# ----
# CREATE PROBE POINTS
srf = Surface(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)
# S4) CREATE PROBE POINTS: We use the AnalysisMesh component to create a mesh, whose face centers we use as probe points.
# 
# The mesh we will also use to color the results onto.
bbox = BoundingBox(Content=mesh, Plane=PlaneXY(0, 0, 0))  # -> Box, Box_2
list_4 = ValueList({"X": 0, "Y": 1, "Z": 2}, selected="Z")
analysismesh = AnalysisMesh(Surface=srf, GridSize=Slider(1, range=0..3), Exclude=bbox.Box, Offset=Slider(1.2, range=0..3), OffsetDirection=list_4)  # -> AnalysisMesh, FaceCenters, FaceNormals

# ----
# C2)
number_slider_3 = Slider(2, range=1..24)
# C2) COMPUTE UTCI: Clicking Create will create a UTCI task on the Compute server.
# 
# The UTCI task will use the data from the previous analyses (Wind and Radiation) together with the weather data to compute the UTCI.
list_5 = ValueList({"UTCI": 0}, selected="UTCI")
outdoor_comfort = OutdoorComfort(
    Input=project_and_task_3,
    EPWFile=insert_valid_local_epw_file_path,
    ComfortMethod=list_5,
    ProbeNames=probe_names,
    Thresholds=["{\"field\": \"extreme cold stress\", \"value\": [null, -40]}", "{\"field\": \"very strong cold stress\", \"value\": [-40, -27]}", "{\"field\": \"strong cold stress\", \"value\": [-27, -13]}", "{\"field\": \"moderate cold stress\", \"value\": [-13, 0]}", "{\"field\": \"slight cold stress\", \"value\": [0, 9]}", "{\"field\": \"no thermal stress\", \"value\": [9, 18]}", "{\"field\": \"thermal comfort\", \"value\": [18, 26]}", "{\"field\": \"moderate heat stress\", \"value\": [26, 32]}", "{\"field\": \"strong heat stress\", \"value\": [32, 38]}", "{\"field\": \"very strong heat stress\", \"value\": [38, 46]}", "{\"field\": \"extreme heat stress\", \"value\": [46, null]}"],
    CPUs=number_slider_3,
    DependentOn="Wind",
    Create=Button())

# ----
# CREATE PROBES
button_3 = Button()
# R3)
probe_radiation = ProbeRadiation(
    Input=radiation_solution,
    Points=analysismesh.FaceCenters,
    Normals=analysismesh.FaceNormals,
    Names=probe_names,
    Create=button_3)

# ----
# C3)
panel_10 = Panel("comfort/utci")
# C3) DOWNLOAD RESULTS: The component will itself start downloading the files as soon as they become available on the server.
concat = Concatenate(FragmentA="C:\Procedural\UTCI\", FragmentB=task_name, FragmentC="\comfort\")
download = Download(Input=outdoor_comfort, DownloadPath=panel_10, LocalPath=concat, Overrides="{\"exclude\": [\".utci\"]}", Reload=Button())

# ----
# COMPUTE MRT
# R4) COMPUTE MRT: Clicking Compute will upload the geometry, materials, epw and anything else needed to run the case.
# 
# This component will create an Actions tasks, that turn the Rhino/Grasshopper geometry and material description into .rad files and set up the Radiance case.
# The component will also create a Ray Tracing task with a Sky View Factor and a Solar Radiation task underneath. Finally, it with add the Mean Radiant Temperature task.
# 
# The Sky View Factor and Solar Radiation tasks will run in parallel, but wait for the Actions task to finish and the Mean Radiant Temperature task will start when both the Sky View Factor and Solar Radiation tasks are done.
button_4 = Button()
# R4)
compute = Compute(Input=probe_radiation, Mesh=set_names.Meshes, Compute=button_4)  # -> Info, Output

# ----
# SETUP SOLVER
# W3) SETUP SOLUTION: With the solution component you can specify, who many CPUs you want to run with. For this demo 8 is sufficient.
# 
# You can choose between different OpenFOAM solvers. For running outdoor comfort analyses the simpleFoam solver is recommended.
# We will also use the VirtualWindTunnel Case Type as it is the method that sets up the virtual wind tunnel and lets you simulate multiple angles at the same time. You specify the number of angles that you would like to run in "Number of Angles". For this demo we have chosen 4, which means that the angles 0.0, 90.0, 180.0 and 270.0 is simulated.
# 
# This is also the place where you specify the number of iterations that you would like the run the simulates for. For the purpose of the demo 300 is enough. But when running real cases we recommend between 500 and 1000
number_slider_4 = Slider(4, range=0..100)
list_6 = ValueList({"simpleFoam": 0, "potentialFoam": 1, "porousSimpleFoam": 2, "pisoFoam": 3, "buoyantSimpleFoam": 4, "buoyantPimpleFoam": 5, "buoyantBoussinesqSimpleFoam": 6, "buoyantBoussinesqPimpleFoam": 7}, selected="simpleFoam")
list_7 = ValueList({"SimpleCase": 0, "VirtualWindTunnel": 1, "MeshOnly": 2}, selected="VirtualWindTunnel")
# W3)
cfd_solution = ComputeSolution(
    Input=mesh_2,
    CPUs=Slider(2, range=1..24),
    Solver=list_6,
    CaseType=list_7,
    BoundaryConditions=merge,
    Iterations=Slider(300, range=0..1000),
    NumberOfAngles=number_slider_4)

# ----
# Open Compute in Browser
# S5) OPEN IN BROWSER: To open the project and task in the browser click here.
toggle_2 = BooleanToggle(False)
# S5)
launch_browser = PythonScript(input=project_and_task, open=toggle_2)  # -> out
# ---------- launch_browser: Python ----------
import webbrowser
import json

taskId = ""
projectId = ""
url = ""

if input:
    input_ = json.loads(input)
    task = input_.get("task")
    project = input_.get("project")
    url = input_.get("url")
    if task:
        taskId = task.get("uid")
    if project:
        projectId = project.get("uid")



if url and taskId:
    url = url + "/project/" + projectId + "/task/" + taskId
    print url
else:
    print "Please provide input from Task/Project component"
    print "GOT url:", url, "TaskId:", taskId
if open:
    webbrowser.open(url, new=2)
# ---------- end launch_browser ----------
panel_11 = Panel(launch_browser)

# ----
# CALCULATE SEASONAL
#  MRT STATISTICS
panel_12 = Panel("{\"file_extension\": \"mrt\"}")
# R5) SEASONAL STATISTICS: The Mean Radiant Temperature Method produces hourly MRT values (C) throughout the year for each point. That is a lot of data.
# 
# To reduce that amount of data to inspect, we can transform it into seasons. That way we can view e.g. the mean MRT of the summer evenings.
# 
# Note this step is not strictly needed to calculate the UTCI, but it is a good way of verifying the results.
list_8 = ValueList({"Daylight Autonomy": 0, "Spatial Daylight Autonomy": 1, "Continuous Daylight Autonomy": 2, "Useful Daylight Illuminances": 3, "Statistics": 4, "Seasonal Statistics": 5}, selected="Seasonal Statistics")
# R5)
daylight_metrics = DaylightMetrics(
    Input=compute.Output,
    Preset=list_8,
    Overrides=panel_12,
    CPUs=Slider(2, range=0..10),
    CaseDirectory="metrics",
    Create=Button())

# ----
# COMPUTE WIND TUNNEL
# W4) COMPUTE VWT: Clicking Compute will upload the geometry, boundary conditions and anything else needed to run the case.
# 
# This component will create an Actions tasks, that turn the Rhino/Grasshopper geometry and boundary condition descriptions into openFOAM files and set up the openFOAM case.
# The component will create a Mesh task, which will execute after the Actions task is done.
# Furthermore, a VirtualWindTunnel task will be created with the number of wind angles underneath that has been specified in the Solution component. The wind angles will start and run in parallel, when the prepare_wind_tunnel is finished.
# 
# When a black info bar under the component appears, saying Tasks Created, then the tasks are created on the server. You can then go to the project and task on Compute to inspect.
button_5 = Button()
compute_2 = Compute(Input=cfd_solution, Mesh=domain.Mesh, Compute=button_5)  # -> Info, Output
# W4)
panel_13 = Panel(compute_2.Info)

# ----
# DOWNLOAD MRT
panel_14 = Panel("C:\Procedural\UTCI\")
# R6) DOWNLOAD RESULTS: The component will itself start downloading the files as soon as they become available on the server.
panel_15 = Panel("results/mrt")
concat_2 = Concatenate(FragmentA=panel_14, FragmentB=task_name, FragmentC="\mrt\")
# R6)
download_2 = Download(Input=probe_radiation, DownloadPath=panel_15, LocalPath=concat_2, Reload=Button())

# ----
# PROBE
button_6 = Button()
panel_16 = Panel("""Utrans
p""")
# W5) CREATE PROBES: When clicking the button connected to Create in the Probe Points component and new subtask, called Probe, will be created.
# Running probe tasks in a CFD simulation is a post simulation process and what you are doing is to go into the simulation results and extracting the values you want from a set of probe points.
# We do that by creating a grid of points that we want to have the results in.
# 
# Fields is the fields (type of values) we want to extract from the CFD simulation. In this case we are interested in the wind speeds (Utrans) and the pressure (p).
# W5)
probe_points = ProbePoints(
    Input=compute_2.Output,
    Points=analysismesh.FaceCenters,
    Names=probe_names,
    Fields=panel_16,
    Mesh=analysismesh.AnalysisMesh,
    CPUs=1,
    DependentOn="VirtualWindTunnel",
    Create=button_6)

# ----
# W6) WIND THRESHOLDS: When clicking the button connected to Create in the Probe Points component and new subtask, called Probe, will be created.
# Running probe tasks in a CFD simulation is a post simulation process and what you are doing is to go into the simulation results and extracting the values you want from a set of probe points.
# We do that by creating a grid of points that we want to have the results in.
# 
# Fields is the fields (type of values) we want to extract from the CFD simulation. In this case we are interested in the wind speeds (Utrans) and the pressure (p).
number_slider_5 = Slider(2, range=1..24)
# W6)
wind_thresholds = WindThresholds(
    Input=probe_points,
    EPWFile=insert_valid_local_epw_file_path,
    PatchNames=probe_names,
    Thresholds=["{\"field\": \"sitting\", \"value\": 4}", "{\"field\": \"standing\", \"value\": 6}", "{\"field\": \"strolling\", \"value\": 8}", "{\"field\": \"business_walking\", \"value\": 10}", "{\"field\": \"uncomfortable\", \"value\": 10}", "{\"field\": \"unsafe_frail\", \"value\": 15}", "{\"field\": \"unsafe_all\", \"value\": 20}"],
    CPUs=number_slider_5,
    DependentOn="Probe",
    Create=Button())

# ----
# LOAD SIMULATION MESH: This is to load the simulation mesh into Grasshopper, so we can use it to visualize the results for all the analyses
panel_17 = Panel("""VWT/postProcessing/internalCloud/0.0
geometry""")
concat_3 = Concatenate(FragmentA="C:\Procedural\UTCI\", FragmentB=task_name, FragmentC="\mesh\")
download_3 = Download(Input=probe_points, DownloadPath=panel_17, LocalPath=concat_3, Reload=Button())
load_probe_results = LoadProbeResults(Folder=download_3, MeshPath=download_3, Rerun=Button())  # -> Info, Points, Mesh

# ----
# VISUALIZE
button_7 = Button()
comfort_results = OutdoorComfortResults(Folder=download, Rerun=button_7)  # -> Info, Winter_morning, Winter_noon, Winter_afternoon, Winter_evenings, Spring_morning, Spring_noon, Spring_afternoon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
branch_mask = GhPythonScript(Index=Slider(2, range=0..12))  # -> out, Path
# ---------- branch_mask: Python ----------
__author__ = "kongs"
__version__ = "2020.08.31"

import rhinoscriptsyntax as rs

if not Index:
    Index = 0
    
Path = "{*;" + str(Index) + "}"
# ---------- end branch_mask ----------
split = SplitTree(Data=comfort_results.Yearly, Masks=flatten(branch_mask.Path))  # -> Positive, Negative
panel_18 = Panel(comfort_results.Info)
colors = Data([RGB(5, 48, 97), RGB(33, 102, 172), RGB(67, 147, 195), RGB(146, 197, 222), RGB(209, 229, 240), RGB(255, 255, 255), RGB(244, 165, 130), RGB(178, 24, 43)])
# C4) VISUALIZE UTCI: By using the Comfort Results and the Recolor Mesh components, it is possible to visualize the UTCI through the different seasons of the year.
# C4)
recolor_mesh = RecolorMesh(
    Mesh=load_probe_results.Mesh,
    Result=split.Positive,
    ListOfColors=colors,
    UpperBoundary=Slider(8, range=0..10),
    Segments=10)  # -> ColoredMesh, Colors, Values
mjoin = MeshJoin(Meshes=flatten(recolor_mesh.ColoredMesh))
python = GhPythonScript(mesh=mjoin, scale=Slider(1.2, range=0.5..5))  # -> out, text_point, legend
# ---------- python: Python ----------
__author__ = "kongs"
__version__ = "2020.09.15"

import rhinoscriptsyntax as rs

scale = scale or 1
bb = rs.BoundingBox(mesh)

point = bb[5]
point.X = point.X * 1.05 * scale
plane = rs.MovePlane(rs.WorldXYPlane(), point)

width = (bb[5].X - bb[4].X) * 0.15 * scale
height = (bb[3].Y - bb[4].Y)

legend = point

point_ = bb[0]
point_.Y = point_.Y - (height * 0.1 * scale)
text_point = rs.MovePlane(rs.WorldXYPlane(), point_)
# ---------- end python ----------
panel_19 = Panel("""UTCI [°C]
Yearly Average""")
legend = Legend(
    BasePoint=python.legend,
    Colors=recolor_mesh.Colors,
    Values=recolor_mesh.Values,
    Scale=Slider(2.5, range=0.5..5),
    TextHeight=1)  # -> Legend, Text
tag = TextTag3D(Location=python.text_point, Text=panel_19, Size=1, Colour=RGB(0, 0, 0), Justification=1)

# ----
# VISUALIZE
button_8 = Button()
comfort_results_2 = OutdoorComfortResults(Folder=download_2, Rerun=button_8)  # -> Info, Winter_morning, Winter_noon, Winter_afternoon, Winter_evenings, Spring_morning, Spring_noon, Spring_afternoon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
branch_mask_2 = GhPythonScript(Index=Slider(1, range=0..9))  # -> out, Path; same code as branch_mask
panel_20 = Panel(comfort_results_2.Info)
split_2 = SplitTree(Data=comfort_results_2.Yearly, Masks=flatten(branch_mask_2.Path))  # -> Positive, Negative
# R7) VISUALIZE RESULTS: By using the Comfort Results and the Recolor Mesh components, it is possible to visualize the MRT through the different seasons of the year.
number_slider_6 = Slider(5, range=0..100)
colors_2 = Data([RGB(5, 48, 97), RGB(33, 102, 172), RGB(67, 147, 195), RGB(146, 197, 222), RGB(209, 229, 240), RGB(255, 255, 255), RGB(244, 165, 130), RGB(178, 24, 43)])
recolor_mesh_2 = RecolorMesh(
    Mesh=load_probe_results.Mesh,
    Result=split_2.Positive,
    ListOfColors=colors_2,
    LowerBoundary=Slider(-5, range=-5..10),
    UpperBoundary=number_slider_6,
    Segments=10)  # -> ColoredMesh, Colors, Values
mjoin_2 = MeshJoin(Meshes=flatten(recolor_mesh_2.ColoredMesh))
# R7)
panel_21 = Panel("""Mean Radiant Temperature [°C]
Yearly""")
python_2 = GhPythonScript(mesh=mjoin_2, scale=Slider(1.2, range=0.5..5))  # -> out, text_point, legend; same code as python
legend_2 = Legend(
    BasePoint=python_2.legend,
    Colors=recolor_mesh_2.Colors,
    Values=recolor_mesh_2.Values,
    Scale=Slider(2.5, range=0.5..5),
    TextHeight=1)  # -> Legend, Text
tag_2 = TextTag3D(Location=python_2.text_point, Text=panel_21, Size=1, Colour=RGB(0, 0, 0), Justification=1)

# ----
# W7) DOWNLOAD RESULTS: The component will itself start downloading the files as soon as they become available on the server.
panel_22 = Panel("urbanComfort")
concat_4 = Concatenate(FragmentA="C:\Procedural\UTCI\", FragmentB=task_name, FragmentC="\wind\")
# W7)
download_4 = Download(
    Input=wind_thresholds,
    DownloadPath=panel_22,
    LocalPath=concat_4,
    Overrides="{\"include\": [\".Uav\", \"0\"]}",
    Reload=Button())

# ----
# VISUALIZE
button_9 = Button()
wind_threshold_results = WindThresholdResults(
    Folder=download_4,
    ThresholdType=0,
    ThresholdFrequency=["{\"field\": \"sitting\", \"value\": 5}", "{\"field\": \"standing\", \"value\": 5}", "{\"field\": \"strolling\", \"value\": 5}", "{\"field\": \"business_walking\", \"value\": 5}", "{\"field\": \"uncomfortable\", \"value\": 95}", "{\"field\": \"unsafe_frail\", \"value\": 99.977}", "{\"field\": \"unsafe_all\", \"value\": 99.977}"],
    Rerun=button_9)  # -> Info, Winter_morning, Winter_noon, Winter_afternoon, Winter_evenings, Spring_morning, Spring_noon, Spring_afternoon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
branch_mask_3 = GhPythonScript(Index=Slider(0, range=0..9))  # -> out, Path; same code as branch_mask
# W8)
# W8) VISUALIZE WIND RESULTS: By using the Wind Threshold Results and the Recolor Mesh components, it is possible to visualize the average wind speed through the different seasons of the year.
panel_23 = Panel(wind_threshold_results.Info)
split_3 = SplitTree(Data=wind_threshold_results.Yearly, Masks=flatten(branch_mask_3.Path))  # -> Positive, Negative
colors_3 = Data([RGB(255, 255, 255), RGB(209, 229, 240), RGB(146, 197, 222), RGB(67, 147, 195), RGB(33, 102, 172), RGB(5, 48, 97)])
recolor_mesh_3 = RecolorMesh(
    Mesh=load_probe_results.Mesh,
    Result=split_3.Positive,
    ListOfColors=colors_3,
    UpperBoundary=Slider(6, range=0..100),
    Segments=10)  # -> ColoredMesh, Colors, Values
mjoin_3 = MeshJoin(Meshes=flatten(recolor_mesh_3.ColoredMesh))
python_3 = GhPythonScript(mesh=mjoin_3, scale=Slider(1.2, range=0.5..5))  # -> out, text_point, legend; same code as python
panel_24 = Panel("""Wind Velocity [m/s]
Yearly Average""")
legend_3 = Legend(
    BasePoint=python_3.legend,
    Colors=recolor_mesh_3.Colors,
    Values=recolor_mesh_3.Values,
    Scale=Slider(2.5, range=0.5..5),
    TextHeight=1)  # -> Legend, Text
tag_3 = TextTag3D(Location=python_3.text_point, Text=panel_24, Size=1, Colour=RGB(0, 0, 0), Justification=1)
