# Grasshopper definition WindThresholds.gh (Grasshopper 1.0.7)
# plug-ins: ProceduralCS

swatch = ColourSwatch(SwatchColor=RGB(153, 153, 153))
envvars = GhPythonScript()  # -> user, pw
# ---------- envvars: Python ----------
""" Get login credentials from OS Environment Variables
"""

import os

user = os.environ.get('PROCEDURAL_USER')
pw = os.environ.get('PROCEDURAL_PASS')

#print("Got login credentials from Environment Variables: %s, %s"%(user, pw))
# ---------- end envvars ----------

# ----
# LOGIN TO COMPUTE
# This demo is tested using version 2021.11.1 of the ComputeGH plugin on Rhino 7
panel = Panel("https://compute.procedural.build")
panel_2 = Panel(envvars.user)
# 0)
password = Text(envvars.pw)
login = ComputeLogin(Username=panel_2, Password=password, ComputeURL=panel, Retry=Button())

# ----
# GEOMETRY
# 2a) GEOMETRY: Here we assign names to the geometry.
# For this demo, we just give all the geometry the same name "buildings". When doing larger cases it is adventages to apply different names to different parts of the input geometry.
# That way it is easier to find the individual surfaces later, if needed.
# 
# We also apply the mesh levels here.
# The mesh levels specifies the size of the mesh faces on the surface of the geometry. The levels are related to the Cell Size set in the Domain component.
# If you have a Cell Size of eg. 10m and apply a mesh level of 2 then your mesh faces will be 10 halfed 2 times ie. 2.5m
mesh = Mesh([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])

# ----
# GET OR CREATE
# PROJECT AND TASK
panel_3 = Panel("Demos - Rhino7 - Wind Thresholds")

# ----
# SET BOUNDARY CONDITIONS
panel_4 = Panel("{'U': '{ value uniform (0 -5 0); }'}")
# 2c) ASSIGN BOUNDARY CONDITIONS: Here we assign boundary conditions to the different geometry.
# By default all geometry are given the boundary condition "wall".
# Therefore we only need to give the domain box sides different boundary conditions to specify in flow of air over the model.
panel_5 = Panel("""MaxZ
MinZ
MinX
MaxX""")
cfd_bc = CFDBoundaryCondition(Names="MaxY", Preset=2, Overrides=panel_4)
cfd_bc_2 = CFDBoundaryCondition(Names="MinY", Preset=3)
cfd_bc_3 = CFDBoundaryCondition(Names=panel_5, Preset=1)
merge = Merge(Data1=cfd_bc, Data2=cfd_bc_2, Data3=cfd_bc_3)

# ----
# 1)
# 1) CREATE PROJECT AND TASK: Every task on Compute belongs to a project. Then first thing to do is to create that project.
# 
# We will call our project Simple VWT and our TaskName Version 1. The parent task we create together with our project works to group our simulation tasks, so we can easily keep track of design iterations. When we click on the Create button the project and task will be created on Compute.
project_and_task = GetOrCreateProjectAndTask(Auth=login, ProjectName=panel_3, TaskName="Version 1", Create=Button())

# ----
# Open Compute in Browser
toggle = BooleanToggle(False)
# 1a)
launch_browser = PythonScript(input=project_and_task, open=toggle)  # -> out
# ---------- launch_browser: Python ----------
import webbrowser
import json

taskId = ""
projectId = ""
url = ""

if input:
    input_ = json.loads(input)
    task = input_.get("task")
    project = input_.get("project")
    url = input_.get("url")
    if task:
        taskId = task.get("uid")
    if project:
        projectId = project.get("uid")



if url and taskId:
    url = url + "/project/" + projectId + "/task/" + taskId
    print url
else:
    print "Please provide input from Task/Project component"
    print "GOT url:", url, "TaskId:", taskId
if open:
    webbrowser.open(url, new=2)
# ---------- end launch_browser ----------
panel_6 = Panel(launch_browser)

list = ValueList({"SimpleCase": 0, "VirtualWindTunnel": 1, "MeshOnly": 2}, selected="VirtualWindTunnel")

# ----
# PICK CRITERIA
# THRESHOLD VALUES (m/s)
# THRESHOLD FREQUENCIES (%)
panel_7 = Panel("""NEN 8100
Davenport
Lawson LDDC
Lawson 2001""")
# 5) PICK CRITERIA: In this demo we have set up the values for 4 comfort criteria:
# * NEN 8100
# * Davenport
# * Lawson LDDC
# * Lawson 2001
# 
# All of them consists of Threshold values and Threshold Frequencies.
# 
# Threshold Values are to determine how often over the course of a year that the wind speed exceeds a certain level (threshold)
# 
# The Threshold Frequencies then maps the results from the Threshold Values to specific comfort criteria levels.
number_slider = Slider(3, range=0..3)
nen_8100 = Panel("""{"field": "sitting long", "value": 5}
{"field": "sitting short", "value": 5}
{"field": "walking leisurely", "value": 5}
{"field": "walking fast", "value": 5}
{"field": "uncomfortable", "value": 5}""")
davenport = Panel("""{"field": "sitting long", "value": 3.6}
{"field": "sitting short", "value": 5.3}
{"field": "walking leisurely", "value": 7.6}
{"field": "walking fast", "value": 9.8}
{"field": "uncomfortable", "value": 9.8}
{"field": "dangerous", "value": 15.1}""")
lawson_lddc = Panel("""{"field": "frequent sitting", "value": 2.5}
{"field": "occasional sitting", "value": 4}
{"field": "standing", "value": 6}
{"field": "walking", "value": 8}
{"field": "uncomfortable", "value": 8}
{"field": "unsafe", "value": 15}""")
lawson_2001 = Panel("""{"field": "sitting", "value": 4}
{"field": "standing", "value": 6}
{"field": "strolling", "value": 8}
{"field": "business walking", "value": 10}
{"field": "uncomfortable", "value": 10}
{"field": "unsafe frail", "value": 15}
{"field": "unsafe all", "value": 20}""")
# 5)
item = ListItem(List=panel_7, Index=number_slider, Wrap=True)
panel_8 = Panel(item)
entwine = Entwine(Branch00=nen_8100, Branch01=davenport, Branch02=lawson_lddc, Branch03=lawson_2001, FlattenInputs=True)  # -> simplify(Result)
branch = TreeBranch(Tree=entwine, Path=number_slider, MaintainPaths=True)
nen_8100_2 = Panel("""{"field": "sitting long", "value": 2.5}
{"field": "sitting short", "value": 5}
{"field": "walking leisurely", "value": 10}
{"field": "walking fast", "value": 20}
{"field": "uncomfortable", "value": 80}""")
davenport_2 = Panel("""{"field": "sitting long", "value": 1.5}
{"field": "sitting short", "value": 1.5}
{"field": "walking leisurely", "value": 1.5}
{"field": "walking fast", "value": 1.5}
{"field": "uncomfortable", "value": 98.5}
{"field": "dangerous", "value": 99.99}""")
lawson_lddc_2 = Panel("""{"field": "frequent sitting", "value": 5}
{"field": "occasional sitting", "value": 5}
{"field": "standing", "value": 5}
{"field": "walking", "value": 5}
{"field": "uncomfortable", "value": 95}
{"field": "unsafe", "value": 99.978}""")
lawson_2001_2 = Panel("""{"field": "sitting", "value": 5}
{"field": "standing", "value": 5}
{"field": "strolling", "value": 5}
{"field": "business walking", "value": 5}
{"field": "uncomfortable", "value": 95}
{"field": "unsafe frail", "value": 99.977}
{"field": "unsafe all", "value": 99.977}""")
entwine_2 = Entwine(Branch00=nen_8100_2, Branch01=davenport_2, Branch02=lawson_lddc_2, Branch03=lawson_2001_2, FlattenInputs=True)  # -> simplify(Result)
# https://compute.procedural.build
branch_2 = TreeBranch(Tree=entwine_2, Path=number_slider, MaintainPaths=True)

# ----
# CREATE WIND THRESHOLDS
panel_9 = Panel("C:\Procedural\WeatherFiles\DNK_Copenhagen.061800_IWEC.epw")
download_epw = DownloadEPW(OpenBrowser=Button())
# 6)
button = Button()

# ----
# Display
# Get Started: If you haven't done already, sign up for a free user account at https://compute.procedural.build/ to get started!
# 
# 0) Add your username (email) and password.
# 
# 1) Update the project name, number and task name. To create the new project and task click the button.
# 
# 2) Update the solver configuration or leave the defaults.
# 
# 3) Click the button to upload and start simulating the case.
# 
# 4) Click the button to add the probe task.
# 
# 5) Select the wind comfort criteria you want use.
# 
# 6) Create the wind comfort task.
# 
# 7 ) Wait for the simulation to finish and visualise the results.
# 
# If you are having any questions, issues or feedback, you are welcome to post them at https://discourse.procedural.build/
# We will be there to answer any queries!
swatch_2 = ColourSwatch(SwatchColor=RGB(0, 0, 0))

# ----
# CONFIGURE MESHING
panel_10 = Panel("buildings")
set_names = SetNames(Meshes=mesh, Names=panel_10)  # -> Meshes, Names
mesh_level = CFDMeshLevel(Meshes=set_names.Meshes, MinLevel=Slider(2, range=0..10))
# 2b) CONFIGURE MESHING: This is where we set up the domain and mesh properties for the CFD case.
# The meshes with applied mesh levels are inputted and the domain is generated.
# In the domain component you can specify different properties for the CFD domain.
# 
# For this demo we have just applied some simple defaults, which should be changed when you run a real case.
number_slider_2 = Slider(2, range=0..10)
toggle_2 = BooleanToggle(True)
list_2 = ValueList({"3D": 0, "2D": 1}, selected="3D")

domain = CFDDomain(
    Meshes=mesh_level,
    DomainType=list_2,
    CellSize=Slider(2, range=0..2),
    AlignBottom=toggle_2,
    CenterXY=toggle_2,
    Square=toggle_2,
    XYScale=Slider(1.5, range=0..10),
    XYOffset=Slider(0, range=0..100),
    ZScale=number_slider_2)  # -> Output, Info, BoundingBox, Mesh

mesh_2 = Mesh(domain.Mesh)
medges = MeshEdges(Mesh=mesh_2)  # -> NakedEdges, InteriorEdges, NonManifoldEdges
wires = BrepWireframe(Brep=domain.BoundingBox, Density=-1)
preview = CustomPreview(Geometry=wires, Material=ColourSwatch(SwatchColor=RGB(0, 0, 0)))
preview_2 = CustomPreview(Geometry=domain.Mesh, Material=ColourSwatch(SwatchColor=RGB(222, 222, 222)))
preview_3 = CustomPreview(Geometry=[medges.NakedEdges, medges.InteriorEdges], Material=swatch_2)
facen = FaceNormals(Mesh=mesh_2)  # -> flatten(Centers), Normals
lng = ListLength(List=facen.Centers)
mesh_faces = Panel(lng)

mesh_3 = ComputeMesh(Input=project_and_task, Domain=domain.Output)
panel_11 = Panel(domain.Info)

# ----
# SETUP SOLVER
list_3 = ValueList({"simpleFoam": 0, "potentialFoam": 1, "porousSimpleFoam": 2, "pisoFoam": 3, "buoyantSimpleFoam": 4, "buoyantPimpleFoam": 5, "buoyantBoussinesqSimpleFoam": 6, "buoyantBoussinesqPimpleFoam": 7}, selected="simpleFoam")
# 2) SETUP SOLUTION: With the solution component you can specify, who many CPUs you want to run with. For this demo 4 is sufficient.
# 
# You can choose between different OpenFOAM solvers. For running outdoor comfort analyses the simpleFoam solver is recormended.
# We will also use the VirtualWindTunnel Case Type as it is the method that sets up the virtual wind tunnel and lets you simulate multiple angles at the same time. You specify the number of angles that you would like to run in "Number of Angles". For this demo we have chosen 4, which means that the angles 0.0, 90.0, 180.0 and 270.0 is simulated.
# 
# This is also the place where you specify the number of iterations that you would like the run the simulates for. For the purpose of the demo 300 is enough. But when running real cases we recormend between 500 and 1000
number_slider_3 = Slider(8, range=0..100)
# 2)
cfd_solution = ComputeSolution(
    Input=mesh_3,
    CPUs=Slider(2, range=1..24),
    Solver=list_3,
    CaseType=list,
    BoundaryConditions=merge,
    Iterations=Slider(300, range=0..1000),
    NumberOfAngles=number_slider_3)

# ----
# CREATE A CUT PLANE
number_slider_4 = Slider(1.5, range=0..3)
# 4a) CREATE PROBE POINTS: We use the AnalysisMesh component to create a mesh, whose face centers we use as probe points.
# 
# The mesh we will also use to color the results onto.
bbox = BoundingBox(Content=mesh, Plane=PlaneXY(0, 0, 0))  # -> Box, Box_2
list_4 = ValueList({"X": 0, "Y": 1, "Z": 2}, selected="Z")
slicedomain = SliceDomain(
    Domain=domain.BoundingBox,
    Location=number_slider_4,
    GridSize=Slider(2, range=0..3),
    Exclude=bbox.Box,
    SliceDirection=list_4)  # -> AnalysisMesh, FaceCenters, FaceNormals

# ----
# RUN ON COMPUTE
# 3)
button_2 = Button()
# 3) COMPUTE VWT: Clicking Compute will upload the geometry, boundary conditions and anything else needed to run the case.
# 
# This component will create an Actions tasks, that turn the Rhino/Grasshopper geometry and boundary condition descriptions into openFOAM files and setup the openFOAM case.
# The component will create a Mesh task, which will execute after the Actions task is done.
# Furthermore, a VirtualWindTunnel task will be created with the number of wind angles underneeth that has been specified in the Solution component. The wind angles will start and run in parallel, when the prepare_wind_tunnel is finished.
# 
# When a black info bar under the component appears, saying Tasks Created, then the tasks are created on the server. You can then go to the project and task on Compute to inspect.
compute = Compute(Input=cfd_solution, Mesh=domain.Mesh, Compute=button_2)  # -> Info, Output
panel_12 = Panel(compute.Info)

# ----
# PROBE
# 4)
button_3 = Button()
panel_13 = Panel("""Utrans
p""")
# 4) CREATE PROBES: When clicking the button connected to Create in the Probe Points component and new subtask, called Probe, will be created.
# Running probe tasks in a CFD simulation is a post simulation process and what you are doing is to go into the simulation results and extracting the values you want from a set of probe points.
# We do that by creating a grid of points that we want to have the results in.
# 
# Fields is the fields (type of values) we want to extract from the CFD simulation. In this case we are interested in the wind speeds (Utrans) and the pressure (p).
probe_points = ProbePoints(
    Input=compute.Output,
    Points=slicedomain.FaceCenters,
    Names="plane",
    Fields=panel_13,
    CPUs=1,
    DependentOn="VirtualWindTunnel",
    Create=button_3)

# ----
# 6a) CREATE WIND THRESHOLD TASK: After picking the comfort criteria we want to run. We have to create a task on Compute. The task needs an EPW file to turn the results from the VWT into annual values, whereafter it can apply the threshold values to it.
wind_thresholds = WindThresholds(
    Input=probe_points,
    EPWFile=panel_9,
    ProbeNames="plane",
    Thresholds=branch,
    CPUs=Slider(1, range=1..10),
    DependentOn="Probe",
    Create=button)

# ----
# CALCULATE FREQUENCIES
# 6b) DOWNLOAD RESULTS: The component will itself start downloading the files as soon as they become available on the server.
panel_14 = Panel("C:\Procedural\Demos\WindThresholds\")
concat = Concatenate(FragmentA=panel_14, FragmentB=panel_8)
download = Download(Input=wind_thresholds, DownloadPath="urbanComfort", LocalPath=concat, Reload=Button())
# 6c) LOAD WINDTHRESHOLD RESULTS: Load the wind theshold results after they have been downloaded.
# 
# We apply seasonal statistics the threshold so you can inspect the comfort at different times of the year.
button_4 = Button()
wind_threshold_results = WindThresholdResults(Folder=download, ThresholdType=Slider(1, range=0..1), ThresholdFrequency=branch_2, Rerun=button_4)  # -> Info, Winter_morning, Winter_noon, Winter_afternoon, Winter_evenings, Spring_morning, Spring_noon, Spring_afternoon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
panel_15 = Panel(wind_threshold_results.Info)

# ----
# VISUALIZE
lng_2 = ListLength(List=branch_2)  # -> expr("x-1", Length)
# 7) VISUALIZE WIND RESULTS: By using the Recolor Mesh components, it is possible to visualize the comfort criteria.
panel_16 = Panel("{1}")
colors = Data([RGB(5, 48, 97), RGB(33, 102, 172), RGB(67, 147, 195), RGB(146, 197, 222), RGB(209, 229, 240), RGB(255, 255, 255), RGB(253, 219, 199), RGB(244, 165, 130), RGB(214, 96, 77), RGB(178, 24, 43), RGB(103, 0, 31)])
branch_3 = TreeBranch(Tree=panel_15, Path=panel_16, MaintainPaths=True)
recolor_mesh = RecolorMesh(
    Mesh=slicedomain.AnalysisMesh,
    Result=wind_threshold_results.Yearly,
    ListOfColors=colors,
    UpperBoundary=lng_2,
    Segments=lng_2)  # -> ColoredMesh, Colors, Values
# 7)
pt = ConstructPoint(XCoordinate=Slider(0, range=0..50), YCoordinate=0, ZCoordinate=0)
basepoint = GhPythonScript(mesh=recolor_mesh.ColoredMesh, override=pt)  # -> out, base_point; inputs override: Point3d
# ---------- basepoint: Python ----------
__author__ = "Christian Kongsgaard"
__version__ = "2020.09.15"

import rhinoscriptsyntax as rs

bb = rs.BoundingBox(mesh)

base_point = bb[0]
base_point.Y = base_point.Y
base_point.X += override.X
base_point.Y += override.Y
base_point.Z += override.Z
# ---------- end basepoint ----------
text = GhPythonScript(title="Wind Comfort Criteria", thresholds=panel_7, thresholdIndex=number_slider)  # -> out, a; inputs thresholds: list, thresholdIndex: Int32
# ---------- text: Python ----------
__author__ = "Christian Kongsgaard"
__version__ = "2020.09.04"

import json

comfort = thresholds[thresholdIndex]
a = title + "\n" + comfort
# ---------- end text ----------
tag = TextTag3D(Location=basepoint.base_point, Text=text.a, Size=Slider(3, range=0.5..5), Colour=RGB(0, 0, 0), Justification=1)

pt_2 = ConstructPoint(XCoordinate=Slider(5, range=0..50), YCoordinate=0, ZCoordinate=0)
basepoint_2 = GhPythonScript(mesh=recolor_mesh.ColoredMesh, override=pt_2)  # -> out, base_point; inputs override: Point3d
# ---------- basepoint_2: Python ----------
__author__ = "Christian Kongsgaard"
__version__ = "2020.09.15"

import rhinoscriptsyntax as rs

bb = rs.BoundingBox(mesh)

base_point = bb[1]
base_point.Y = base_point.Y
base_point.X += override.X
base_point.Y += override.Y
base_point.Z += override.Z
# ---------- end basepoint_2 ----------
legend = Legend(
    BasePoint=basepoint_2.base_point,
    Colors=reverse(recolor_mesh.Colors),
    Values=branch_3,
    Scale=Slider(8, range=1..10),
    TextHeight=Slider(3, range=1..10))  # -> Legend, Text
