# Grasshopper definition SkyViewFactor.gh (Grasshopper 1.0.7)
# plug-ins: ProceduralCS

# ----
# LOGIN TO COMPUTE
# This demo is matching version 2021.2.5 of the ComputeGH plugin
panel = Panel("https://compute.procedural.build")
# 0)
password = Text()
login = ComputeLogin(Username="INSERT YOUR USERNAME HERE", Password=password, ComputeURL=panel, Retry=Button())

# ----
# SET NAMES
mesh = Mesh([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])
setnames = SetNames(Objs=mesh, Names="building")
# 2a)
merge = Merge(Data1=setnames)

# ----
# SET MATERIALS
panel_2 = Panel("building*")
material = RadianceMaterial(Names=panel_2, Preset=0)
# 2b)
merge_2 = Merge(Data1=material)

# ----
# GET OR CREATE
# PROJECT AND TASK
panel_3 = Panel("Version 2")
# 1)
project_and_task = GetOrCreateProjectAndTask(Auth=login, ProjectName="Sky View Factor", TaskName=panel_3, Create=Button())

panel_4 = Panel(merge_2)

# ----
# Open Compute in Browser
button = Button()
# 1a)
launch_browser = PythonScript(input=project_and_task, open=button)  # -> out
# ---------- launch_browser: Python ----------
import webbrowser
import json

taskId = ""
projectId = ""
url = ""

if input:
    input_ = json.loads(input)
    task = input_.get("task")
    project = input_.get("project")
    url = input_.get("url")
    if task:
        taskId = task.get("uid")
    if project:
        projectId = project.get("uid")



if url and taskId:
    url = url + "/project/" + projectId + "/task/" + taskId
    print url
else:
    print "Please provide input from Task/Project component"
    print "GOT url:", url, "TaskId:", taskId
if open:
    webbrowser.open(url, new=2)
# ---------- end launch_browser ----------
panel_5 = Panel(launch_browser)

# ----
# SETUP SOLUTION
number_slider = Slider(2, range=1..24)
list = ValueList({"3Phase": 0, "SolarRadiation": 1, "DaylightFactor": 2, "SkyViewFactor": 3}, selected="SkyViewFactor")
# 2)
radiation_solution = RadiationSolution(Input=project_and_task, CPUs=number_slider, Method=list, Materials=merge_2)

# ----
# CREATE PROBES
number_slider_2 = Slider(1, range=0..1)
brep = Brep([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])
# 3)
analysismesh = AnalysisMesh(Surface=brep, GridSize=number_slider_2, Offset=Slider(0, range=0..1), OffsetDirection=2)  # -> AnalysisMesh, FaceCenters, FaceNormals
panel_6 = Panel("""facade00
facade01
facade02
facade03
facade04
facade05
facade06
facade07
facade08
facade09
facade10
facade11
facade12
facade13
facade14
facade15
facade16
facade17
facade18
facade19
facade20""")
probe_radiation = ProbeRadiation(
    Input=radiation_solution,
    Points=analysismesh.FaceCenters,
    Normals=analysismesh.FaceNormals,
    Names=panel_6,
    Create=Button())

# ----
# Display
bbox = BoundingBox(Content=mesh, Plane=PlaneXY(0, 0, 0))  # -> Box, Box_2
# Get Started: If you haven't done already, sign up for a free user account at https://compute.procedural.build/ to get started!
# 
# 0) Add your username (email) and password.
# 
# 1) Update the project name, number and task name. To create the new project and task click the button.
# 1a) Check the project and parent task in the browser to see progress.
# 
# 2) Update/Check the case setup.
# Pick the desired number of CPUs you want to run with.
# 2a) Give names to the geometry.
# 2b) Apply materials.
# 
# 3) Click the button to upload and start the probe task.
# 
# 4) Click the button the start the sky view factor simulation.*
# 
# 5) Wait for the simulation to finish and the download will start.
# 
# 6) Visualize the results!
# 
# If you are having any questions, issues or feedback, you are welcome to post them at https://discourse.procedural.build/
# We will be there to answer any queries!
# 
# NOTES:
# * The simulation tasks will queue up, so you don't need to wait for each to finish, but you can just add task in one go.
swatch = ColourSwatch(SwatchColor=RGB(0, 0, 0))
medges = MeshEdges(Mesh=merge)  # -> NakedEdges, InteriorEdges, NonManifoldEdges
wires = BrepWireframe(Brep=bbox.Box, Density=-1)
preview = CustomPreview(Geometry=wires, Material=ColourSwatch(SwatchColor=RGB(0, 0, 0)))
preview_2 = CustomPreview(Geometry=analysismesh.FaceCenters, Material=ColourSwatch(SwatchColor=RGB(0, 0, 0)))
preview_3 = CustomPreview(Geometry=[medges.NakedEdges, medges.InteriorEdges], Material=swatch)

# ----
# COMPUTE CASE
button_2 = Button()
# 4)
compute = Compute(Input=probe_radiation, Mesh=merge, Compute=button_2)  # -> Info, Output

panel_7 = Panel(probe_radiation)

# ----
# DOWNLOAD
panel_8 = Panel("C:\Procedural\SkyViewFactor\")
concat = Concatenate(FragmentA=panel_8, FragmentB=panel_3)
# 5)
download = Download(Input=compute.Output, DownloadPath="results", LocalPath=concat, Reload=Button())

# ----
# VISUALIZE
button_3 = Button()
radiation_results = RadiationProbeResults(Folder=download, Rerun=button_3)  # -> Info, Metric
colors = Data(["201,54,54", "198,62,58", "150,179,119", "138,207,134", "55,97,59"])
recolor_mesh = RecolorMesh(
    Mesh=analysismesh.AnalysisMesh,
    Result=radiation_results.Metric,
    ListOfColors=colors,
    LowerBoundary=Slider(0, range=0..100),
    UpperBoundary=Slider(30, range=0..100),
    Segments=Slider(10, range=0..10))  # -> ColoredMesh, Colors, Values
mjoin = MeshJoin(Meshes=flatten(recolor_mesh.ColoredMesh))
python = GhPythonScript(mesh=mjoin, scale=Slider(1.2, range=0.5..5))  # -> out, text_point, legend
# ---------- python: Python ----------
__author__ = "kongs"
__version__ = "2020.09.15"

import rhinoscriptsyntax as rs

scale = scale or 1
bb = rs.BoundingBox(mesh)

point = bb[5]
point.X = point.X * 1.05 * scale
point.Z = 0

legend = point

height = (bb[3].Y - bb[4].Y)
point_ = bb[0]
point_.Y = point_.Y - (height * 0.1 * scale)
text_point = rs.MovePlane(rs.WorldXYPlane(), point_)
# ---------- end python ----------
branch = TreeBranch(Tree=simplify(recolor_mesh.Values), Path="{0}", MaintainPaths=True)  # -> reverse(Branch)
branch_2 = TreeBranch(Tree=simplify(recolor_mesh.Colors), Path="{0}", MaintainPaths=True)  # -> reverse(Branch)
# 6)
panel_9 = Panel("Sky View Factor %")
legend = Legend(BasePoint=python.legend, Colors=branch_2, Values=branch, Scale=Slider(2.5, range=0.5..5), TextHeight=1)  # -> Legend, Text
tag = TextTag3D(Location=python.text_point, Text=panel_9, Size=1, Colour=RGB(0, 0, 0), Justification=1)
