# Grasshopper definition SolarRadiation.gh (Grasshopper 1.0.7)
# plug-ins: ProceduralCS

# ----
# LOGIN TO COMPUTE
# This demo is matching version 2021.2.7 of the ComputeGH plugin
panel = Panel("https://compute.procedural.build")
# 0)
password = Text()
login = ComputeLogin(Username="INSERT YOUR USERNAME HERE", Password=password, ComputeURL=panel, Retry=Button())

# ----
# SET NAMES
outer = Brep(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)
inner = Brep(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)
mesh = Mesh([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])
mesh_2 = MeshBrep(
    Brep=[inner, outer],
    Settings={GridMaxCount=0, GridMinCount=16, JaggedSeams=False, MaxEdgeLength=0, MinEdgeLength=0.0001, MinTolerance=0, Refine=True, RefineAngle=0, RelativeTolerance=0.65, SimplePlanes=True, Tolerance=0})
bbox = BoundingBox(Content=mesh, Plane=PlaneXY(0, 0, 0))  # -> Box, Box_2
setnames = SetNames(Objs=mesh_2, Names="ground")
setnames_2 = SetNames(Objs=mesh, Names="building")
# 2a)
merge = Merge(Data1=setnames_2, Data2=setnames)

# ----
# SET MATERIALS
panel_2 = Panel("""building*
ground*""")
material = RadianceMaterial(Names=panel_2, Preset=0)
# 2b)
merge_2 = Merge(Data1=material)

# ----
# GET OR CREATE
# PROJECT AND TASK
panel_3 = Panel("Version 1")
# 1)
project_and_task = GetOrCreateProjectAndTask(Auth=login, ProjectName="Solar Radiation", TaskName=panel_3, Create=Button())

panel_4 = Panel(merge_2)

# ----
# SETUP SOLUTION
panel_5 = Panel("C:\Procedural\SolarRadiation\DNK_Copenhagen.061800_IWEC.epw")
list = ValueList({"3Phase": 0, "SolarRadiation": 1, "DaylightFactor": 2, "SkyViewFactor": 3}, selected="SolarRadiation")
# 2)
radiation_solution = RadiationSolution(Input=project_and_task, CPUs=Slider(2, range=1..24), Method=list, Materials=merge_2, EPWFile=panel_5)

# ----
# Open Compute in Browser
button = Button()
# 1a)
launch_browser = PythonScript(input=project_and_task, open=button)  # -> out
# ---------- launch_browser: Python ----------
import webbrowser
import json

taskId = ""
projectId = ""
url = ""

if input:
    input_ = json.loads(input)
    task = input_.get("task")
    project = input_.get("project")
    url = input_.get("url")
    if task:
        taskId = task.get("uid")
    if project:
        projectId = project.get("uid")



if url and taskId:
    url = url + "/project/" + projectId + "/task/" + taskId
    print url
else:
    print "Please provide input from Task/Project component"
    print "GOT url:", url, "TaskId:", taskId
if open:
    webbrowser.open(url, new=2)
# ---------- end launch_browser ----------
panel_6 = Panel(launch_browser)

# ----
# CREATE PROBES
number_slider = Slider(1, range=0..1)
# 3)
analysismesh = AnalysisMesh(Surface=inner, GridSize=number_slider, Exclude=bbox.Box, Offset=Slider(0.2, range=0..1), OffsetDirection=2)  # -> AnalysisMesh, FaceCenters, FaceNormals
probe_radiation = ProbeRadiation(Input=radiation_solution, Points=analysismesh.FaceCenters, Normals=analysismesh.FaceNormals, Create=Button())

# ----
# Display
swatch = ColourSwatch(SwatchColor=RGB(0, 0, 0))
# Get Started: If you haven't done already, sign up for a free user account at https://compute.procedural.build/ to get started!
# 
# 0) Add your username (email) and password.
# 
# 1) Update the project name, number and task name. To create the new project and task click the button.
# 1a) Check the project and parent task in the browser to see progress.
# 
# 2) Update/Check the case setup.
# Pick the desired number of CPUs you want to run with.
# Select a EPW file that you want to use. You can use the Download EPW component to download an EPW file from EnergyPlus.
# 2a) Give names to the geometry.
# 2b) Apply materials.
# 
# 3) Click the button to upload and start the probe task.
# 
# 4) Click the button the start the solar radiation simulation.*
# 
# 5) Click the button the add the statistic calculation to the results of the solar radiation simulation.*
# 
# 6) Wait for the simulation to finish and the download will start.
# 
# 7) Visualize the results!
# 
# If you are having any questions, issues or feedback, you are welcome to post them at https://discourse.procedural.build/
# We will be there to answer any queries!
# 
# NOTES:
# * The simulation tasks will queue up, so you don't need to wait for each to finish, but you can just add task in one go.
swatch_2 = ColourSwatch(SwatchColor=RGB(0, 0, 0))
medges = MeshEdges(Mesh=merge)  # -> NakedEdges, InteriorEdges, NonManifoldEdges
wires = BrepWireframe(Brep=bbox.Box, Density=-1)
preview = CustomPreview(Geometry=wires, Material=swatch)
preview_2 = CustomPreview(Geometry=[medges.NakedEdges, medges.InteriorEdges], Material=swatch_2)
preview_3 = CustomPreview(Geometry=analysismesh.FaceCenters, Material=ColourSwatch(SwatchColor=RGB(0, 0, 0)))

# ----
# COMPUTE CASE
button_2 = Button()
# 4)
compute = Compute(Input=probe_radiation, Mesh=merge, Compute=button_2)  # -> Info, Output

# ----
# COMPUTE STATISTIC
list_2 = ValueList({"daylight_autonomy": 0, "spatial_daylight_autonomy": 1, "continuous_daylight_autonomy": 2, "useful_daylight_illuminances": 3, "statistics": 4}, selected="statistics")
# 5)
daylight_metrics = DaylightMetrics(Input=compute.Output, Preset=list_2, CPUs=1, Create=Button())

# ----
# DOWNLOAD
panel_7 = Panel("C:\Procedural\SolarRadiation\")
concat = Concatenate(FragmentA=panel_7, FragmentB=panel_3)
# 6)
download = Download(Input=daylight_metrics, DownloadPath="metrics", LocalPath=concat, Reload=Button())

# ----
# VISUALIZE
number_slider_2 = Slider(4, range=0..4)
radiation_results = RadiationProbeResults(Folder=download, Rerun=Button())  # -> Info, Metric
branch_mask = GhPythonScript(Index=number_slider_2)  # -> out, Path
# ---------- branch_mask: Python ----------
__author__ = "kongs"
__version__ = "2020.08.31"

import rhinoscriptsyntax as rs

if not Index:
    Index = 0
    
Path = "{*;" + str(Index) + "}"
# ---------- end branch_mask ----------
split = SplitTree(Data=radiation_results.Metric, Masks=flatten(branch_mask.Path))  # -> Positive, Negative
bnd = Bounds(Numbers=flatten(split.Positive))
dedomain = DeconstructDomain(Domain=bnd)  # -> Start, End
colors = Data([RGB(65, 93, 138), RGB(81, 128, 134), RGB(107, 185, 128), RGB(124, 201, 127), RGB(204, 234, 124), RGB(255, 255, 122), RGB(255, 238, 124), RGB(255, 211, 127), RGB(250, 191, 121), RGB(220, 106, 79), RGB(201, 54, 54)])
# 7)
recolor_mesh = RecolorMesh(
    Mesh=analysismesh.AnalysisMesh,
    Result=split.Positive,
    ListOfColors=colors,
    LowerBoundary=dedomain.Start,
    UpperBoundary=dedomain.End,
    Segments=10)  # -> ColoredMesh, Colors, Values
mjoin = MeshJoin(Meshes=flatten(recolor_mesh.ColoredMesh))
python = GhPythonScript(mesh=mjoin, scale=Slider(1.2, range=0.5..5))  # -> out, text_point, legend
# ---------- python: Python ----------
__author__ = "kongs"
__version__ = "2020.09.15"

import rhinoscriptsyntax as rs

scale = scale or 1
bb = rs.BoundingBox(mesh)

point = bb[5]
point.X = point.X * 1.05 * scale
plane = rs.MovePlane(rs.WorldXYPlane(), point)

width = (bb[5].X - bb[4].X) * 0.15 * scale
height = (bb[3].Y - bb[4].Y)

legend = point

point_ = bb[0]
point_.Y = point_.Y - (height * 0.1 * scale)
text_point = rs.MovePlane(rs.WorldXYPlane(), point_)
# ---------- end python ----------
legend = Legend(
    BasePoint=python.legend,
    Colors=reverse(recolor_mesh.Colors),
    Values=reverse(recolor_mesh.Values),
    Scale=Slider(2.5, range=0.5..5),
    TextHeight=1)  # -> Legend, Text
tag = TextTag3D(Location=python.text_point, Text="Yearly Solar Radiation kWh/m2 ", Size=1, Colour=RGB(0, 0, 0), Justification=1)

panel_8 = Panel(radiation_results.Info)
