# Grasshopper definition SpatialDaylightAutonomy.gh (Grasshopper 1.0.7)
# plug-ins: ProceduralCS

# ----
# LOGIN TO COMPUTE
# This demo is matching version 2021.3.5 of the ComputeGH plugin
panel = Panel("https://compute.procedural.build")
# 0)
password = Text()
login = ComputeLogin(Username="INSERT YOUR USERNAME HERE", Password=password, ComputeURL=panel, Retry=Button())

# ----
# SET NAMES
number_slider = Slider(50, range=0..100)
windows_north = Brep([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])
windows_east = Surface([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])
floor = Brep(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)
area = Area(Geometry=floor)  # -> Area, Centroid
cir = Circle(Plane=area.Centroid, Radius=number_slider)
walls = Brep([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])
ceiling = Brep(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)
mesh = MeshBrep(
    Brep=floor,
    Settings={GridMaxCount=0, GridMinCount=16, JaggedSeams=False, MaxEdgeLength=0, MinEdgeLength=0.0001, MinTolerance=0, Refine=True, RefineAngle=0, RelativeTolerance=0.65, SimplePlanes=True, Tolerance=0})
mesh_2 = MeshBrep(
    Brep=cir,
    Settings={GridMaxCount=0, GridMinCount=16, JaggedSeams=False, MaxEdgeLength=0, MinEdgeLength=0.0001, MinTolerance=0, Refine=True, RefineAngle=0, RelativeTolerance=0.65, SimplePlanes=True, Tolerance=0})
mesh_3 = MeshBrep(
    Brep=ceiling,
    Settings={GridMaxCount=0, GridMinCount=16, JaggedSeams=False, MaxEdgeLength=0, MinEdgeLength=0.0001, MinTolerance=0, Refine=True, RefineAngle=0, RelativeTolerance=0.65, SimplePlanes=True, Tolerance=0})
mesh_4 = MeshBrep(
    Brep=walls,
    Settings={GridMaxCount=0, GridMinCount=16, JaggedSeams=False, MaxEdgeLength=0, MinEdgeLength=0.0001, MinTolerance=0, Refine=True, RefineAngle=0, RelativeTolerance=0.65, SimplePlanes=True, Tolerance=0})
mesh_5 = MeshBrep(
    Brep=windows_east,
    Settings={GridMaxCount=0, GridMinCount=16, JaggedSeams=False, MaxEdgeLength=0, MinEdgeLength=0.0001, MinTolerance=0, Refine=True, RefineAngle=0, RelativeTolerance=0.65, SimplePlanes=True, Tolerance=0})
mesh_6 = MeshBrep(
    Brep=windows_north,
    Settings={GridMaxCount=0, GridMinCount=16, JaggedSeams=False, MaxEdgeLength=0, MinEdgeLength=0.0001, MinTolerance=0, Refine=True, RefineAngle=0, RelativeTolerance=0.65, SimplePlanes=True, Tolerance=0})
set_names = SetNames(Meshes=mesh_4, Names="wall")
set_names_2 = SetNames(Meshes=mesh, Names="floor")
set_names_3 = SetNames(Meshes=mesh_2, Names="ground")
set_names_4 = SetNames(Meshes=mesh_3, Names="ceiling")
set_names_5 = SetNames(Meshes=mesh_6, Names="window_north")
set_names_6 = SetNames(Meshes=mesh_5, Names="window_east")
# 2a)
merge = Merge(Data1=set_names, Data2=set_names_2, Data3=set_names_3, Data4=set_names_4, Data5=set_names_5, Data6=set_names_6)

# ----
# Display
swatch = ColourSwatch(SwatchColor=RGB(0, 0, 0))
# Get Started: If you haven't done already, sign up for a free user account at https://compute.procedural.build/ to get started!
# 
# 0) Add your username (email) and password.
# 
# 1) Update the project name, number and task name. To create the new project and task click the button.
# 1a) Check the project and parent task in the browser to see progress.
# 
# 2) Update/Check the case setup.
# Pick the desired number of CPUs you want to run with.
# Select a EPW file that you want to use. You can use the Download EPW component to download an EPW file from EnergyPlus.
# 2a) Give names to the geometry.
# 2b) Apply materials.
# 
# 3) Click the button to upload and start the probe task.
# 
# 4) Click the button the start the daylight simulation.*
# 
# 5) Click the button the add a daylight metric calculation to the results of the daylight simulation.*
# 
# 6) Wait for the simulation to finish and the download will start.
# 
# 7) Visualize the results!
# 
# If you are having any questions, issues or feedback, you are welcome to post them at https://discourse.procedural.build/
# We will be there to answer any queries!
# 
# NOTES:
# * The simulation tasks will queue up, so you don't need to wait for each to finish, but you can just add task in one go.
swatch_2 = ColourSwatch(SwatchColor=RGB(0, 0, 0))
medges = MeshEdges(Mesh=merge)  # -> NakedEdges, InteriorEdges, NonManifoldEdges
wires = BrepWireframe(Brep=[floor, walls, ceiling], Density=-1)
preview = CustomPreview(Geometry=wires, Material=swatch)
preview_2 = CustomPreview(Geometry=[medges.NakedEdges, medges.InteriorEdges], Material=swatch_2)
preview_3 = CustomPreview(Geometry=[windows_north, windows_east], Material=ColourSwatch(SwatchColor=RGBA(86, 126, 193, 171)))

# ----
# SET MATERIALS
panel_2 = Panel("clear.xml")
panel_3 = Panel("""0.9
0.9
0.9
0.0
0.0""")
python = GhPythonScript(reals=panel_3)  # -> overrides; inputs reals: list
# ---------- python: Python ----------
__author__ = "Christian Kongsgaard"
__version__ = "2021.01.21"

import json


overrides = json.dumps({"reals": reals})
# ---------- end python ----------
python_2 = GhPythonScript(bsdf=panel_2)  # -> overrides
# ---------- python_2: Python ----------
__author__ = "Christian Kongsgaard"
__version__ = "2021.01.21"

import json


overrides = json.dumps({"bsdf_path": bsdf})
# ---------- end python_2 ----------
python_3 = GhPythonScript(bsdf=panel_2)  # -> overrides; same code as python_2
panel_4 = Panel("""wall*
floor*""")
list = ValueList({"Context": 0, "Wall": 1, "Window": 2, "Ceiling": 3, "Roof": 4, "Floor": 5, "Ground": 6}, selected="Ceiling")
list_2 = ValueList({"Context": 0, "Wall": 1, "Window": 2, "Ceiling": 3, "Roof": 4, "Floor": 5, "Ground": 6}, selected="Wall")
list_3 = ValueList({"Context": 0, "Wall": 1, "Window": 2, "Ceiling": 3, "Roof": 4, "Floor": 5, "Ground": 6}, selected="Ground")
list_4 = ValueList({"Context": 0, "Wall": 1, "Window": 2, "Ceiling": 3, "Roof": 4, "Floor": 5, "Ground": 6}, selected="Window")
material = RadianceMaterial(Names=panel_4, Preset=list_2)
material_2 = RadianceMaterial(Names="ceiling*", Preset=list, Overrides=python)
material_3 = RadianceMaterial(Names="ground*", Preset=list_3)
material_4 = RadianceMaterial(Names="window_north*", Preset=list_4, Overrides=python_2)
material_5 = RadianceMaterial(Names="window_east*", Preset=list_4, Overrides=python_3)
# 2b)
merge_2 = Merge(Data1=material, Data2=material_2, Data3=material_3, Data4=material_4, Data5=material_5)

# ----
# GET OR CREATE
# PROJECT AND TASK
panel_5 = Panel("Version 1")
panel_6 = Panel("Spatial Daylight Autonomy")
# 1)
project_and_task = GetOrCreateProjectAndTask(Auth=login, ProjectName=panel_6, TaskName=panel_5, Create=Button())

# ----
# INSPECT NORMALS
panel_7 = Panel("{0.5,0.5,0}")
evalsrf = EvaluateSurface(Surface=reparameterize(windows_east), Point=panel_7)  # -> Point, Normal, UDirection, VDirection, Frame
vdisex = VectorDisplayEx(Point=evalsrf.Point, Vector=evalsrf.Normal, Colour=RGB(0, 0, 0), Width=2)

# ----
# SETUP SOLUTION
panel_8 = Panel("\DNK_Copenhagen.061800_IWEC.epw")
list_5 = ValueList({"3Phase": 0, "SolarRadiation": 1, "DaylightFactor": 2, "SkyViewFactor": 3}, selected="3Phase")
concat = Concatenate(FragmentA="C:\Procedural\", FragmentB=panel_6, FragmentC=panel_8)
# 2)
radiation_solution = RadiationSolution(Input=project_and_task, CPUs=Slider(8, range=1..24), Method=list_5, Materials=merge_2, EPWFile=concat)

# ----
# Open Compute in Browser
toggle = BooleanToggle(False)
# 1a)
launch_browser = PythonScript(input=project_and_task, open=toggle)  # -> out
# ---------- launch_browser: Python ----------
import webbrowser
import json

taskId = ""
projectId = ""
url = ""

if input:
    input_ = json.loads(input)
    task = input_.get("task")
    project = input_.get("project")
    url = input_.get("url")
    if task:
        taskId = task.get("uid")
    if project:
        projectId = project.get("uid")



if url and taskId:
    url = url + "/project/" + projectId + "/task/" + taskId
    print url
else:
    print "Please provide input from Task/Project component"
    print "GOT url:", url, "TaskId:", taskId
if open:
    webbrowser.open(url, new=2)
# ---------- end launch_browser ----------
panel_9 = Panel(launch_browser)

# ----
# CREATE PROBES
analysis_surfaces = Surface([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])
area_2 = Area(Geometry=analysis_surfaces)  # -> Area, Centroid
sort = SortList(Keys=area_2.Area, ValuesA=analysis_surfaces)  # -> Keys, ValuesA
analysismesh = AnalysisMesh(Surface=sort.ValuesA, GridSize=Slider(0.2, range=0..1), Offset=Slider(0.8, range=0..1), OffsetDirection=2)  # -> AnalysisMesh, FaceCenters, FaceNormals
# 3)
button = Button()
panel_10 = Panel("""room_1
room_2
room_3""")
probe_radiation = ProbeRadiation(
    Input=radiation_solution,
    Points=analysismesh.FaceCenters,
    Normals=analysismesh.FaceNormals,
    Names=panel_10,
    Create=button)

# ----
# COMPUTE CASE
button_2 = Button()
# 4)
compute = Compute(Input=probe_radiation, Mesh=merge, Compute=button_2)  # -> Info, Output

# ----
# COMPUTE DAYLIGHT METRIC
list_6 = ValueList({"Daylight Autonomy": 0, "Spatial Daylight Autonomy": 1, "Continuous Daylight Autonomy": 2, "Useful Daylight Illuminances": 3, "Statistics": 4}, selected="Spatial Daylight Autonomy")
# 5)
daylight_metrics = DaylightMetrics(Input=compute.Output, Preset=list_6, CPUs=Slider(4, range=0..10), CaseDirectory="metrics", Create=Button())

# ----
# DOWNLOAD
panel_11 = Panel("C:\Procedural\")
concat_2 = Concatenate(FragmentA=panel_11, FragmentC=panel_6, FragmentD="\", FragmentB=panel_5)
# 6)
download = Download(Input=daylight_metrics, DownloadPath="metrics", LocalPath=concat_2, Reload=Button())

# ----
# VISUALIZE
number_slider_2 = Slider(0, range=0..9)
radiation_results = RadiationProbeResults(Folder=download, Rerun=Button())  # -> Info, Metric
branch_mask = GhPythonScript(Index=number_slider_2)  # -> out, Path
# ---------- branch_mask: Python ----------
__author__ = "kongs"
__version__ = "2020.08.31"

import rhinoscriptsyntax as rs

if not Index:
    Index = 0
    
Path = "{*;" + str(Index) + "}"
# ---------- end branch_mask ----------
split = SplitTree(Data=radiation_results.Metric, Masks=flatten(branch_mask.Path))  # -> Positive, Negative
colors = Data([RGB(113, 142, 173), RGB(118, 150, 161), RGB(129, 169, 135), RGB(138, 186, 112), RGB(145, 190, 106), RGB(187, 198, 91), RGB(231, 206, 76), RGB(238, 210, 81), RGB(244, 226, 118), RGB(252, 245, 164), RGB(255, 253, 184)])
recolor_mesh = RecolorMesh(
    Mesh=analysismesh.AnalysisMesh,
    Result=split.Positive,
    ListOfColors=colors,
    UpperBoundary=Slider(100, range=0..100),
    Segments=10)  # -> ColoredMesh, Colors, Values
mjoin = MeshJoin(Meshes=flatten(recolor_mesh.ColoredMesh))
python_4 = GhPythonScript(mesh=mjoin, scale=Slider(1.2, range=0.5..5))  # -> out, text_point, legend
# ---------- python_4: Python ----------
__author__ = "kongs"
__version__ = "2020.09.15"

import rhinoscriptsyntax as rs

scale = scale or 1
bb = rs.BoundingBox(mesh)

point = bb[5]
point.X = point.X * 1.05 * scale
plane = rs.MovePlane(rs.WorldXYPlane(), point)

width = (bb[5].X - bb[4].X) * 0.15 * scale
height = (bb[3].Y - bb[4].Y)

legend = point

point_ = bb[0]
point_.Y = point_.Y - (height * 0.1 * scale)
text_point = rs.MovePlane(rs.WorldXYPlane(), point_)
# ---------- end python_4 ----------
branch = TreeBranch(Tree=simplify(recolor_mesh.Values), Path="{0}", MaintainPaths=True)  # -> reverse(Branch)
branch_2 = TreeBranch(Tree=simplify(recolor_mesh.Colors), Path="{0}", MaintainPaths=True)  # -> reverse(Branch)
# 7)
panel_12 = Panel("Spatial Daylight Autonomy %")
legend = Legend(BasePoint=python_4.legend, Colors=branch_2, Values=branch, Scale=Slider(2.5, range=0.5..5), TextHeight=1)  # -> Legend, Text
tag = TextTag3D(Location=python_4.text_point, Text=panel_12, Size=1, Colour=RGB(0, 0, 0), Justification=1)

panel_13 = Panel(radiation_results.Info)

area_3 = Area(Geometry=analysismesh.AnalysisMesh)  # -> Area, Centroid
Z = UnitZ(Factor=1)
move = Move(Geometry=area_3.Centroid, Motion=Z)  # -> Geometry, Transform
python_5 = GhPythonScript(x=split.Negative)  # -> a
# ---------- python_5: Python ----------
__author__ = "kongs"
__version__ = "2021.03.18"

a = "sDA: " + "{:.1f}".format(x*100) + "%"
# ---------- end python_5 ----------
tag_2 = TextTag3D(Location=move.Geometry, Text=python_5, Size=1, Colour=ColourSwatch(SwatchColor=RGB(0, 0, 0)), Justification=7)
