# Grasshopper definition VWT_With_Vegetation.gh (Grasshopper 1.0.7)
# plug-ins: ProceduralCS

vegetation = Mesh([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])
set_names = SetNames(Meshes=vegetation, Names="vegetation")  # -> Meshes, Names
# 2c) CONFIGURE REFINEMENT REGION: When simulating with vegetation we want the vegetation as refinement regions in the CFD mesh. We can use the Reginement Region component to do that.
# After turning the vegetation geometry into refinement regions we have to let OpenFOAM know that this is a special refinement region. We do that with the setSet component. To apply the porosity in the refinement region it has to be a CellZone.
refinement_region = RefinementRegion(Meshes=set_names.Meshes, Location="inside", MinLevel=Slider(2, range=0..10), MaxLevel=1)
get_names = GetNames(Meshes=refinement_region)
setset = CFDSetSet(Names=get_names, Location=[True, True, False], IsCellZone=Toggle(True))  # -> flatten(Output)

# ----
# LOGIN TO COMPUTE
# This demo is matching version 2021.8.2 of the ComputeGH plugin
panel = Panel("https://compute.procedural.build")
# 0)
password = Text()
login = ComputeLogin(Username="INSERT YOUR USERNAME HERE", Password=password, ComputeURL=panel, Retry=Button())

# ----
# GEOMETRY
# 2a) GEOMETRY: Here we assign names to the geometry.
# For this demo, we just give all the geometry the same name "buildings". When doing larger cases it is adventages to apply different names to different parts of the input geometry.
# That way it is easier to find the individual surfaces later, if needed.
# 
# We also apply the mesh levels here.
# The mesh levels specifies the size of the mesh faces on the surface of the geometry. The levels are related to the Cell Size set in the Domain component.
# If you have a Cell Size of eg. 10m and apply a mesh level of 2 then your mesh faces will be 10 halfed 2 times ie. 2.5m
buildings_mesh = Mesh([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])

# ----
# GET OR CREATE
# PROJECT AND TASK
panel_2 = Panel("Version 1")
# 1) CREATE PROJECT AND TASK: Every task on Compute belongs to a project. Then first thing to do is to create that project.
# 
# We will call our project Simple VWT and our TaskName Version 1. The parent task we create together with our project works to group our simulation tasks, so we can easily keep track of design iterations. When we click on the Create button the project and task will be created on Compute.
button = Button()
# 1)
project_and_task = GetOrCreateProjectAndTask(Auth=login, ProjectName="VWT with Vegetation", TaskName=panel_2, Create=button, Create_2=False)

# ----
# CONFIGURE MESHING
panel_3 = Panel("buildings")
set_names_2 = SetNames(Meshes=buildings_mesh, Names=panel_3)  # -> Meshes, Names
mesh_level = CFDMeshLevel(Meshes=set_names_2.Meshes, MinLevel=Slider(2, range=0..10), MaxLevel=0)
# 2b) CONFIGURE MESHING: This is where we set up the domain and mesh properties for the CFD case.
# The meshes with applied mesh levels are inputted and the domain is generated.
# In the domain component you can specify different properties for the CFD domain.
# 
# For this demo we have just applied some simple defaults, which should be changed when you run a real case.
number_slider = Slider(2, range=0..10)
merge = Merge(Data1=mesh_level, Data2=refinement_region)
toggle = BooleanToggle(True)
list = ValueList({"3D": 0, "2D": 1}, selected="3D")
domain = CFDDomain(
    Objects=merge,
    DomainType=list,
    CellSize=Slider(2, range=0..2),
    Z0=toggle,
    CenterXY=toggle,
    Square=toggle,
    XYScale=Slider(1.5, range=0..10),
    XYOffset=Slider(0, range=0..100),
    ZScale=number_slider)  # -> Output, Info, BoundingBox, Mesh
panel_4 = Panel(domain.Info)
mesh = ComputeMesh(Input=project_and_task, Domain=domain.Output, SetSet=setset)

# ----
# Display
mesh_2 = Mesh(domain.Mesh)
# Get Started: If you haven't done already, sign up for a free user account at https://compute.procedural.build/ to get started!
# 
# 0) Add your username (email) and password.
# 
# 1) Update the project name, number and task name. To create the new project and task click the button.
# 
# 2) Update the solver configuration or leave the defaults.
# 
# 3) Click the button to upload and start simulating the case.
# 
# 4) Click the button to add the probe points. Make sure to create the C:/Procedural/ComputeVWTDemo folder to store the results in.
# 
# 5) Wait for the simulation to finish and visualise the results.
# 
# 6) Check the simulation progress in the browser.
# 
# If you are having any questions, issues or feedback, you are welcome to post them at https://discourse.procedural.build/
# We will be there to answer any queries!
swatch = ColourSwatch(SwatchColor=RGBA(206, 230, 177, 171))
medges = MeshEdges(Mesh=mesh_2)  # -> NakedEdges, InteriorEdges, NonManifoldEdges
wires = BrepWireframe(Brep=domain.BoundingBox, Density=-1)
preview = CustomPreview(Geometry=wires, Material=ColourSwatch(SwatchColor=RGB(0, 0, 0)))
preview_2 = CustomPreview(Material=ColourSwatch(SwatchColor=RGB(224, 224, 224)))
preview_3 = CustomPreview(Geometry=[medges.NakedEdges, medges.InteriorEdges], Material=ColourSwatch(SwatchColor=RGB(0, 0, 0)))
preview_4 = CustomPreview(Geometry=refinement_region, Material=swatch)
facen = FaceNormals(Mesh=mesh_2)  # -> flatten(Centers), Normals
lng = ListLength(List=facen.Centers)
mesh_faces = Panel(lng)

# ----
# CONFIGURE POROSITY FOR VEGETATION
# 2d) CONFIGURE POROSITY: Here we specify the porosity properties. To create porous regions in OpenFOAM you use the DarcyForchheimer type.
# That type is applied to the CellZones we specify.
# 
# For the porosity coefficient itself; it is hard to give a clear answer to what value you should pick. It is not an exact science. We recommend that you stick to a value between 0.1 and 0.3. Most importantly is that when you compare simulations, that they use the same porosity coefficient.
panel_5 = Panel("""{{NAME}} {
    type DarcyForchheimer;
    active yes;
    cellZone {{NAME}};

    d ({{darcyCoefficient}} {{darcyCoefficient}} {{darcyCoefficient}});
    f ({{porosityCoefficient}} {{porosityCoefficient}} {{porosityCoefficient}});
    coordinateSystem
    {
        type cartesian;
        origin (0 0 0);
        coordinateRotation
        {
            type axesRotation;
            e1 (1.0 0.0 0.0);
            e2 (0.0 0.0 1.0);
        }
    }
}""")
porocity = GhPythonScript(vegetationRegions=get_names, porosityCoefficient=Slider(0.3, range=0.05..0.5), template=panel_5)  # -> fvOptions; inputs vegetationRegions: list
# ---------- porocity: Python ----------
__author__ = "kongs"
__version__ = "2020.11.25"

import rhinoscriptsyntax as rs

begin = "constant>porosityProperties {\n//************************\n"
end = "\n//************************\n}"

fvOptions = begin
if not darcyCoefficient:
    darcyCoefficient = 0

for region in vegetationRegions:
    _template = template.replace("{{NAME}}", region)
    _template = _template.replace("{{darcyCoefficient}}", str(float(darcyCoefficient)))
    _template = _template.replace("{{porosityCoefficient}}", str(float(porosityCoefficient)))
    fvOptions += "\n" + _template + "\n"

fvOptions += end
# ---------- end porocity ----------
panel_6 = Panel(porocity)

# ----
# SET BOUNDARY CONDITIONS
panel_7 = Panel("{'U': '{ value uniform (0 -5 0); }'}")
# 2e) ASSIGN BOUNDARY CONDITIONS: Here we assign boundary conditions to the different geometry.
# By default all geometry are given the boundary condition "wall".
# Therefore we only need to give the domain box sides different boundary conditions to specify in flow of air over the model.
panel_8 = Panel("""MaxZ
MinZ
MinX
MaxX""")
cfd_bc = CFDBoundaryCondition(Names="MaxY", Preset=2, Overrides=panel_7)
cfd_bc_2 = CFDBoundaryCondition(Names="MinY", Preset=3)
cfd_bc_3 = CFDBoundaryCondition(Names=panel_8, Preset=1)
merge_2 = Merge(Data1=cfd_bc, Data2=cfd_bc_2, Data3=cfd_bc_3)

# ----
# Open Compute in Browser
button_2 = Button()
# 1a)
launch_browser = PythonScript(input=project_and_task, open=button_2)  # -> out
# ---------- launch_browser: Python ----------
import webbrowser
import json

taskId = ""
projectId = ""
url = ""

if input:
    input_ = json.loads(input)
    task = input_.get("task")
    project = input_.get("project")
    url = input_.get("url")
    if task:
        taskId = task.get("uid")
    if project:
        projectId = project.get("uid")



if url and taskId:
    url = url + "/project/" + projectId + "/task/" + taskId
    print url
else:
    print "Please provide input from Task/Project component"
    print "GOT url:", url, "TaskId:", taskId
if open:
    webbrowser.open(url, new=2)
# ---------- end launch_browser ----------
panel_9 = Panel(launch_browser)

# ----
# SETUP SOLVER
list_2 = ValueList({"simpleFoam": 0, "potentialFoam": 1, "porousSimpleFoam": 2, "pisoFoam": 3, "buoyantSimpleFoam": 4, "buoyantPimpleFoam": 5, "buoyantBoussinesqSimpleFoam": 6, "buoyantBoussinesqPimpleFoam": 7}, selected="porousSimpleFoam")
# 2) SETUP SOLUTION: With the solution component you can specify, who many CPUs you want to run with. For this demo 4 is sufficient.
# 
# You can choose between different OpenFOAM solvers. For running outdoor comfort analyses the simpleFoam solver is recormended.
# We will also use the VirtualWindTunnel Case Type as it is the method that sets up the virtual wind tunnel and lets you simulate multiple angles at the same time. You specify the number of angles that you would like to run in "Number of Angles". For this demo we have chosen 4, which means that the angles 0.0, 90.0, 180.0 and 270.0 is simulated.
# 
# This is also the place where you specify the number of iterations that you would like the run the simulates for. For the purpose of the demo 300 is enough. But when running real cases we recormend between 500 and 1000
# 
# The overrides we apply here is specifically for the vegetaion. We need to add some extra files describing the porosity. Those files are uploaded through the caseFiles override.
overrides = GhPythonScript(caseFiles=flatten(porocity))  # -> flatten(overrides); inputs fields: list, presets: list, caseFiles: list
# ---------- overrides: Python ----------
__author__ = "markp"
__version__ = "2020.09.11"

import json

overrides = json.dumps({"setup": setup, "fields": fields, "presets": presets, "caseFiles": caseFiles})
# ---------- end overrides ----------
list_3 = ValueList({"SimpleCase": 0, "VirtualWindTunnel": 1, "MeshOnly": 2}, selected="VirtualWindTunnel")
# 2)
cfd_solution = ComputeSolution(
    Input=mesh,
    CPUs=Slider(2, range=1..24),
    Solver=list_2,
    CaseType=list_3,
    BoundaryConditions=merge_2,
    Iterations=Slider(300, range=0..1000),
    NumberOfAngles=Slider(4, range=0..100),
    Overrides=overrides)

# ----
# CREATE A CUT PLANE
number_slider_2 = Slider(1, range=0..3)
# 4a) CREATE PROBE POINTS: We use the AnalysisMesh component to create a mesh, whose face centers we use as probe points.
# 
# The mesh we will also use to color the results onto.
bbox = BoundingBox(Content=buildings_mesh, Plane=PlaneXY(0, 0, 0))  # -> Box, Box_2
list_4 = ValueList({"X": 0, "Y": 1, "Z": 2}, selected="Z")
slicedomain = SliceDomain(
    Domain=domain.BoundingBox,
    Location=Slider(1.5, range=0..3),
    GridSize=number_slider_2,
    Exclude=bbox.Box,
    SliceDirection=list_4)  # -> AnalysisMesh, FaceCenters, FaceNormals

# ----
# RUN ON COMPUTE
button_3 = Button()
# 3)
compute = Compute(Input=cfd_solution, Mesh=domain.Mesh, Compute=button_3)  # -> Info, Output
# 3) COMPUTE VWT: Clicking Compute will upload the geometry, boundary conditions and anything else needed to run the case.
# 
# This component will create an Actions tasks, that turn the Rhino/Grasshopper geometry and boundary condition descriptions into openFOAM files and setup the openFOAM case.
# The component will create a Mesh task, which will execute after the Actions task is done.
# Furthermore, a VirtualWindTunnel task will be created with the number of wind angles underneeth that has been specified in the Solution component. The wind angles will start and run in parallel, when the prepare_wind_tunnel is finished.
# 
# When a black info bar under the component appears, saying Tasks Created, then the tasks are created on the server. You can then go to the project and task on Compute to inspect.
panel_10 = Panel(compute.Info)

# ----
# PROBE AND DOWNLOAD
# 4) CREATE PROBES: When clicking the button connected to Create in the Probe Points component and new subtask, called Probe, will be created.
# Running probe tasks in a CFD simulation is a post simulation process and what you are doing is to go into the simulation results and extracting the values you want from a set of probe points.
# We do that by creating a grid of points that we want to have the results in.
# 
# Fields is the fields (type of values) we want to extract from the CFD simulation. In this case we are interested in the wind speeds (Utrans) and the pressure (p).
button_4 = Button()
# 4)
panel_11 = Panel("""Utrans
p""")
probe_points = ProbePoints(
    Input=compute.Output,
    Points=slicedomain.FaceCenters,
    Fields=panel_11,
    Mesh=slicedomain.AnalysisMesh,
    CPUs=1,
    DependentOn="VirtualWindTunnel",
    Create=button_4)
panel_12 = Panel("""\probeResults
\geometry""")
panel_13 = Panel("""VWT/postProcessing/internalCloud
geometry""")
# 4b) DOWNLOAD RESULTS: The component will itself start downloading the files as soon as they become available on the server.
# 
# Note here, that we are actually downloading two folders:
# 
# * VWT/postProcessing/internalCloud
# * geometry
# 
# The first one contains the simulation results and the second one includes the mesh we want to visualize the results on.
button_5 = Button()
concat = Concatenate(FragmentA="C:\Procedural\VWTVegetation\", FragmentB=panel_2, FragmentC=panel_12)
download = Download(Input=probe_points, DownloadPath=panel_13, LocalPath=concat, Reload=button_5)
split = SplitList(List=download, Index=1)  # -> ListA, ListB

# ----
# 5) VISUALIZE WIND RESULTS: By using the Load Probe Results and the Recolor Mesh components, it is possible to visualize the wind speed from the differnt wind angles.
number_slider_3 = Slider(0, range=0..3)
load_probe_results = LoadProbeResults(Folder=split.ListA, MeshPath=split.ListB, Rerun=Button())  # -> Info, Points, Mesh
branch_mask = GhPythonScript(Index=number_slider_3)  # -> out, Path
# ---------- branch_mask: Python ----------
__author__ = "kongs"
__version__ = "2020.08.31"

import rhinoscriptsyntax as rs

if not Index:
    Index = 0
    
Path = "{*;" + str(Index) + "}"
# ---------- end branch_mask ----------
connect_to_utrans = Relay()
# 5)
panel_14 = Panel(load_probe_results.Info)
vlen = VectorLength(Vector=connect_to_utrans)
split_2 = SplitTree(Data=vlen, Masks=flatten(branch_mask.Path))  # -> Positive, Negative
colors = Data([RGB(255, 255, 255), RGB(209, 229, 240), RGB(146, 197, 222), RGB(67, 147, 195), RGB(33, 102, 172), RGB(5, 48, 97)])
# Visualize Values
recolor_mesh = RecolorMesh(Mesh=load_probe_results.Mesh, Result=split_2.Positive, ListOfColors=colors, Segments=10)  # -> ColoredMesh, Colors, Values
mjoin = MeshJoin(Meshes=flatten(recolor_mesh.ColoredMesh))
python = GhPythonScript(mesh=mjoin, scale=Slider(1.2, range=0.5..5))  # -> out, text_point, legend
# ---------- python: Python ----------
__author__ = "kongs"
__version__ = "2020.09.15"

import rhinoscriptsyntax as rs

scale = scale or 1
bb = rs.BoundingBox(mesh)

point = bb[5]
point.X = point.X * 1.05 * scale
plane = rs.MovePlane(rs.WorldXYPlane(), point)

width = (bb[5].X - bb[4].X) * 0.15 * scale
height = (bb[3].Y - bb[4].Y)

legend = point

point_ = bb[0]
point_.Y = point_.Y - (height * 0.1 * scale)
text_point = rs.MovePlane(rs.WorldXYPlane(), point_)
# ---------- end python ----------
legend_text = LegendText(i=number_slider_3)
legend = Legend(
    BasePoint=python.legend,
    Colors=recolor_mesh.Colors,
    Values=recolor_mesh.Values,
    Scale=Slider(2.5, range=0.5..5),
    TextHeight=1)  # -> Legend, Text
tag = TextTag3D(Location=python.text_point, Text=legend_text, Size=1, Colour=RGB(0, 0, 0), Justification=1)

# ----
# Visualize Vectors
bnd = Bounds(Numbers=flatten(vlen))
# https://compute.procedural.build
split_3 = SplitTree(Data=connect_to_utrans, Masks=flatten(branch_mask.Path))  # -> Positive, Negative
dedomain = DeconstructDomain(Domain=bnd)  # -> Start, End
gradient = Gradient(
    LowerLimit=dedomain.End,
    UpperLimit=dedomain.Start,
    Parameter=split_2.Positive,
    stops=[0: RGB(5, 48, 97), 0.166: RGB(33, 102, 172), 0.33: RGB(67, 147, 195), 0.5: RGB(146, 197, 222), 0.66: RGB(209, 229, 240), 0.833: RGB(255, 255, 255)])
vdisex = VectorDisplayEx(Point=load_probe_results.Points, Vector=split_3.Positive, Colour=gradient, Width=2)

# ==== cluster LegendText
T = ClusterInput()
i = ClusterInput()
branch = TreeBranch(Tree=T, Path="{2}", MaintainPaths=True)
item = ListItem(List=branch, Index=i, Wrap=True)
concat = Concatenate(FragmentA="Wind Velocity [m/s]", FragmentB=item, FragmentC="° from North")
R = ClusterOutput(concat)
