# Grasshopper definition WindThresholds.gh (Grasshopper 1.0.7)
# plug-ins: ProceduralCS

swatch = ColourSwatch(SwatchColor=RGB(153, 153, 153))

# ----
# LOGIN TO COMPUTE
panel = Panel("https://compute.procedural.build")
# 0)
password = Text()
login = ComputeLogin(Username="INSERT YOUR USERNAME HERE", Password=password, ComputeURL=panel, Retry=Button())

# ----
# GEOMETRY
mesh = Mesh([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])

# ----
# GET OR CREATE
# PROJECT AND TASK
panel_2 = Panel("Version 1")
# 1)
project_and_task = GetOrCreateProjectAndTask(Auth=login, ProjectName="Wind Thresholds", TaskName=panel_2, Create=Button())

# ----
# CONFIGURE MESHING
panel_3 = Panel("buildings")
setnames = SetNames(Objs=mesh, Names=panel_3)
mesh_level = CFDMeshLevel(Objs=setnames, MinLevel=Slider(2, range=0..10), MaxLevel=0)
toggle = BooleanToggle(True)
list = ValueList({"3D": 0, "2D": 1}, selected="3D")
domain = CFDDomain(
    Objects=mesh_level,
    DomainType=list,
    CellSize=Slider(2, range=0..2),
    Z0=toggle,
    CenterXY=toggle,
    Square=toggle,
    XYScale=Slider(1.5, range=0..10),
    XYOffset=Slider(0, range=0..100),
    ZScale=Slider(2, range=0..10))  # -> Output, Info, BoundingBox, Mesh
panel_4 = Panel(domain.Info)
mesh_2 = ComputeMesh(Input=project_and_task, Domain=domain.Output)

# ----
# Display
mesh_3 = Mesh(domain.Mesh)
# Get Started: If you haven't done already, sign up for a free user account at https://compute.procedural.build/ to get started!
# 
# 0) Add your username (email) and password.
# 
# 1) Update the project name, number and task name. To create the new project and task click the button.
# 
# 2) Update the solver configuration or leave the defaults.
# 
# 3) Click the button to upload and start simulating the case.
# 
# 4) Click the button to add the probe task.
# 
# 5) Select the wind comfort criteria you want use.
# 
# 6) Create the wind comfort task.
# 
# 7 ) Wait for the simulation to finish and visualise the results.
# 
# If you are having any questions, issues or feedback, you are welcome to post them at https://discourse.procedural.build/
# We will be there to answer any queries!
swatch_2 = ColourSwatch(SwatchColor=RGB(0, 0, 0))
medges = MeshEdges(Mesh=mesh_3)  # -> NakedEdges, InteriorEdges, NonManifoldEdges
wires = BrepWireframe(Brep=domain.BoundingBox, Density=-1)
preview = CustomPreview(Geometry=wires, Material=ColourSwatch(SwatchColor=RGB(0, 0, 0)))
preview_2 = CustomPreview(Geometry=domain.Mesh, Material=ColourSwatch(SwatchColor=RGB(222, 222, 222)))
preview_3 = CustomPreview(Geometry=[medges.NakedEdges, medges.InteriorEdges], Material=swatch_2)
facen = FaceNormals(Mesh=mesh_3)  # -> flatten(Centers), Normals
lng = ListLength(List=facen.Centers)
mesh_faces = Panel(lng)

# ----
# SET BOUNDARY CONDITIONS
panel_5 = Panel("{'U': '{ value uniform (0 -5 0); }'}")
panel_6 = Panel("""MaxZ
MinZ
MinX
MaxX""")
cfd_bc = CFDBoundaryCondition(Names="MaxY", Preset=2, Overrides=panel_5)
cfd_bc_2 = CFDBoundaryCondition(Names="MinY", Preset=3)
cfd_bc_3 = CFDBoundaryCondition(Names=panel_6, Preset=1)
merge = Merge(Data1=cfd_bc, Data2=cfd_bc_2, Data3=cfd_bc_3)

# ----
# Open Compute in Browser
button = Button()
# 1a)
launch_browser = PythonScript(open=button)  # -> out
# ---------- launch_browser: Python ----------
import webbrowser
import json

taskId = ""
projectId = ""
url = ""

if input:
    input_ = json.loads(input)
    task = input_.get("task")
    project = input_.get("project")
    url = input_.get("url")
    if task:
        taskId = task.get("uid")
    if project:
        projectId = project.get("uid")



if url and taskId:
    url = url + "/project/" + projectId + "/task/" + taskId
    print url
else:
    print "Please provide input from Task/Project component"
    print "GOT url:", url, "TaskId:", taskId
if open:
    webbrowser.open(url, new=2)
# ---------- end launch_browser ----------
panel_7 = Panel(launch_browser)

list_2 = ValueList({"simpleFoam": 0, "potentialFoam": 1, "pisoFoam": 2, "buoyantSimpleFoam": 3, "buoyantPimpleFoam": 4, "buoyantBoussinesqSimpleFoam": 5, "buoyantBoussinesqPimpleFoam": 6}, selected="simpleFoam")
list_3 = ValueList({"SimpleCase": 0, "VirtualWindTunnel": 1, "MeshOnly": 2}, selected="VirtualWindTunnel")

# ----
# SETUP SOLVER
number_slider = Slider(4, range=0..100)
# 2)
cfd_solution = ComputeSolution(
    Input=mesh_2,
    CPUs=Slider(4, range=1..24),
    Solver=list_2,
    CaseType=list_3,
    BoundaryConditions=merge,
    Iterations=Slider(300, range=0..1000),
    NumberOfAngles=number_slider)

# ----
# CREATE A CUT PLANE
analysis_surface = AnalysisSurface(B=domain.BoundingBox, C=mesh)
python = GhPythonScript(
    testGeometry=analysis_surface,
    gridSize=Slider(2, range=0..3),
    distBaseSrf=Slider(1.5, range=0..3),
    moveTestMesh=Toggle(True))  # -> readMe, testPoints, ptsVectors, facesArea, mesh; inputs testGeometry: GeometryBase
# ---------- python: Python ----------
### THIS COMPONENT IS COPIED FROM LADYBUG TOOLS. 
### IT IS COPIED TO MAKE DISTRIBUTION OF THIS GRASSHOPPER SCRIPT EASIER, BY HAVING LESS DEPENDENCIES.
### PLEASE REPLACE WITH THE ORIGINAL COMPONENT IF YOU HAVE LADYBUG INSTALLED

"""
Use this component to genrate a mesh with corresponding test points.  The resulting mesh will be in a format that the Recolor Mesh component will accept.
-
Provided by Honeybee 0.0.59
    Args:
        _testSurface: Test surface as a Brep.
        _gridSize: Size of the test grid.
        _distBaseSrf: Distance from base surface.
        moveTestMesh_: Set to 'False' if you want test mesh not to move. Default is 'True'.
    Returns:
        readMe!: ...
        testPoints: Test points
        ptsVectors: Vectors
        faceArea: Area of each mesh face
        mesh: Analysis mesh
"""

import Rhino as rc
import Grasshopper.Kernel as gh
from itertools import chain
import System.Threading.Tasks as tasks

def createMesh(brep, gridSize):
    ## mesh breps
    def makeMeshFromSrf(i, inputBrep):
        try:
            mesh[i] = rc.Geometry.Mesh.CreateFromBrep(inputBrep, meshParam)[0]
            inputBrep.Dispose()
        except:
            print 'Error in converting Brep to Mesh...'
            pass

    # prepare bulk list for each surface
    mesh = [None] * len(brep)

    # set-up mesh parameters for each surface based on surface size
    meshParam = rc.Geometry.MeshingParameters.Default
    meshParam.MaximumEdgeLength = gridSize
    meshParam.MinimumEdgeLength = gridSize
    meshParam.GridAspectRatio = 1

    for i in range(len(mesh)): makeMeshFromSrf(i, brep[i])
    
    return mesh

def flattenList(l):return list(chain.from_iterable(l))

def getTestPts(inputMesh, movingDis, moveTestMesh= False, parallel = True):
        
        # preparing bulk lists
        testPoint = [[]] * len(inputMesh)
        srfNormals = [[]] * len(inputMesh)
        meshSrfCen = [[]] * len(inputMesh)
        meshSrfArea = [[]] * len(inputMesh)
        
        srfCount = 0
        for srf in inputMesh:
            testPoint[srfCount] = range(srf.Faces.Count)
            srfNormals[srfCount] = range(srf.Faces.Count)
            meshSrfCen[srfCount] = range(srf.Faces.Count)
            meshSrfArea[srfCount] = range(srf.Faces.Count)
            srfCount += 1

        try:
            def srfPtCalculator(i):
                # calculate face normals
                inputMesh[i].FaceNormals.ComputeFaceNormals()
                inputMesh[i].FaceNormals.UnitizeFaceNormals()
                
                for face in range(inputMesh[i].Faces.Count):
                    srfNormals[i][face] = (inputMesh[i].FaceNormals)[face] # store face normals
                    meshSrfCen[i][face] = inputMesh[i].Faces.GetFaceCenter(face) # store face centers
                    # calculate test points
                    if srfNormals[i][face]:
                        movingVec = rc.Geometry.Vector3f.Multiply(movingDis,srfNormals[i][face])
                        testPoint[i][face] = rc.Geometry.Point3d.Add(rc.Geometry.Point3d(meshSrfCen[i][face]), movingVec)
                    # make mesh surface, calculate the area, dispose the mesh and mass area calculation
                    tempMesh = rc.Geometry.Mesh()
                    tempMesh.Vertices.Add(inputMesh[i].Vertices[inputMesh[i].Faces[face].A]) #0
                    tempMesh.Vertices.Add(inputMesh[i].Vertices[inputMesh[i].Faces[face].B]) #1
                    tempMesh.Vertices.Add(inputMesh[i].Vertices[inputMesh[i].Faces[face].C]) #2
                    tempMesh.Vertices.Add(inputMesh[i].Vertices[inputMesh[i].Faces[face].D]) #3
                    tempMesh.Faces.AddFace(0, 1, 3, 2)
                    massData = rc.Geometry.AreaMassProperties.Compute(tempMesh)
                    meshSrfArea[i][face] = massData.Area
                    massData.Dispose()
                    tempMesh.Dispose()
                    
                    
        except:
            print 'Error in Extracting Test Points'
            pass
        
        # calling the function
        if parallel:
            tasks.Parallel.ForEach(range(len(inputMesh)),srfPtCalculator)
        else:
            for i in range(len(inputMesh)):
                srfPtCalculator(i)
        
        if moveTestMesh:
            # find surfaces based on first normal in srfNormals - It is a simplification we can write a better function for this later
            for meshCount, mesh in enumerate(inputMesh):
                vector = srfNormals[meshCount][0]
                vector.Unitize()
                vector = rc.Geometry.Vector3d.Multiply(movingDis, vector)
                mesh.Translate(vector.X, vector.Y, vector.Z)
                
        return flattenList(testPoint), flattenList(srfNormals), flattenList(meshSrfArea), inputMesh


if _testGeometry!=None:
    inputMesh = []
    
    if type(_testGeometry) == rc.Geometry.Mesh and _distBaseSrf!=None:
        ghenv.Component.Params.Input[1].Name = '.'
        ghenv.Component.Params.Input[1].NickName = '.'
        inputMesh.append(_testGeometry)
        
    elif _gridSize!=None and _distBaseSrf!=None:
        initMesh = createMesh([_testGeometry], _gridSize)
        for m in initMesh: inputMesh.append(m)   

    if _distBaseSrf<0:
        msg = "Distance from base should be greater than 0. Flip the input surface instead of using a negative number."
        ghenv.Component.AddRuntimeMessage(gh.GH_RuntimeMessageLevel.Warning, msg)
    else:
        testPoints, ptsVectors, facesArea, mesh = getTestPts(inputMesh, _distBaseSrf, moveTestMesh_)
# ---------- end python ----------

# ----
# RUN ON COMPUTE
# 3)
button_2 = Button()
compute = Compute(Input=cfd_solution, Mesh=domain.Mesh, Compute=button_2)  # -> Info, Output
panel_8 = Panel(compute.Info)

# ----
# PICK CRITERIA
# THRESHOLD VALUES (m/s)
# THRESHOLD FREQUENCIES (%)
panel_9 = Panel("""NEN 8100
Davenport
Lawson LDDC
Lawson 2001""")
number_slider_2 = Slider(3, range=0..3)
davenport = Panel("""{"field": "sitting long", "value": 3.6}
{"field": "sitting short", "value": 5.3}
{"field": "walking leisurely", "value": 7.6}
{"field": "walking fast", "value": 9.8}
{"field": "uncomfortable", "value": 9.8}
{"field": "dangerous", "value": 15.1}""")
nen_8100 = Panel("""{"field": "sitting long", "value": 5}
{"field": "sitting short", "value": 5}
{"field": "walking leisurely", "value": 5}
{"field": "walking fast", "value": 5}
{"field": "uncomfortable", "value": 5}""")
lawson_lddc = Panel("""{"field": "frequent sitting", "value": 2.5}
{"field": "occasional sitting", "value": 4}
{"field": "standing", "value": 6}
{"field": "walking", "value": 8}
{"field": "uncomfortable", "value": 8}
{"field": "unsafe", "value": 15}""")
lawson_2001 = Panel("""{"field": "sitting", "value": 4}
{"field": "standing", "value": 6}
{"field": "strolling", "value": 8}
{"field": "business walking", "value": 10}
{"field": "uncomfortable", "value": 10}
{"field": "unsafe frail", "value": 15}
{"field": "unsafe all", "value": 20}""")
# 5)
item = ListItem(List=panel_9, Index=number_slider_2, Wrap=True)
panel_10 = Panel(item)
entwine = Entwine(Branch00=nen_8100, Branch01=davenport, Branch02=lawson_lddc, Branch03=lawson_2001, FlattenInputs=True)  # -> simplify(Result)
branch = TreeBranch(Tree=entwine, Path=number_slider_2, MaintainPaths=True)
nen_8100_2 = Panel("""{"field": "sitting long", "value": 2.5}
{"field": "sitting short", "value": 5}
{"field": "walking leisurely", "value": 10}
{"field": "walking fast", "value": 20}
{"field": "uncomfortable", "value": 80}""")
davenport_2 = Panel("""{"field": "sitting long", "value": 1.5}
{"field": "sitting short", "value": 1.5}
{"field": "walking leisurely", "value": 1.5}
{"field": "walking fast", "value": 1.5}
{"field": "uncomfortable", "value": 98.5}
{"field": "dangerous", "value": 99.99}""")
lawson_lddc_2 = Panel("""{"field": "frequent sitting", "value": 5}
{"field": "occasional sitting", "value": 5}
{"field": "standing", "value": 5}
{"field": "walking", "value": 5}
{"field": "uncomfortable", "value": 95}
{"field": "unsafe", "value": 99.978}""")
lawson_2001_2 = Panel("""{"field": "sitting", "value": 5}
{"field": "standing", "value": 5}
{"field": "strolling", "value": 5}
{"field": "business walking", "value": 5}
{"field": "uncomfortable", "value": 95}
{"field": "unsafe frail", "value": 99.977}
{"field": "unsafe all", "value": 99.977}""")
entwine_2 = Entwine(Branch00=nen_8100_2, Branch01=davenport_2, Branch02=lawson_lddc_2, Branch03=lawson_2001_2, FlattenInputs=True)  # -> simplify(Result)
branch_2 = TreeBranch(Tree=entwine_2, Path=number_slider_2, MaintainPaths=True)

# ----
# PROBE
# 4)
button_3 = Button()
panel_11 = Panel("""Utrans
p""")
probe_points = ProbePoints(Points=python.testPoints, Names="plane", Fields=panel_11, CPUs=1, Create=button_3)

# ----
# CREATE WIND THRESHOLDS
panel_12 = Panel("C:\Procedural\CustomLawson\DNK_Copenhagen.061800_IWEC.epw")
download_epw = DownloadEPW(OpenBrowser=Button())
# 6)
button_4 = Button()
wind_thresholds = WindThresholds(
    Input=probe_points,
    EPWFiles=panel_12,
    PatchNames="plane",
    Thresholds=branch,
    CPUs=Slider(1, range=1..10),
    Create=button_4)

# ----
# CALCULATE FREQUENCIES
panel_13 = Panel("C:\Procedural\WindThresholds\")
concat = Concatenate(FragmentA=panel_13, FragmentB=panel_10)
download = Download(Input=wind_thresholds, DownloadPath="urbanComfort", LocalPath=concat, Reload=Button())
wind_threshold_results = WindThresholdResults(Folder=download, ThresholdType=Slider(1, range=0..1), ThresholdFrequency=branch_2)
panel_14 = Panel(wind_threshold_results)
# https://compute.procedural.build
connect_me_to_yearly = Relay()

# ----
# VISUALIZE
lng_2 = ListLength(List=branch_2)  # -> expr("x-1", Length)
colors = Data([RGB(5, 48, 97), RGB(33, 102, 172), RGB(67, 147, 195), RGB(146, 197, 222), RGB(209, 229, 240), RGB(255, 255, 255), RGB(253, 219, 199), RGB(244, 165, 130), RGB(214, 96, 77), RGB(178, 24, 43), RGB(103, 0, 31)])
branch_3 = TreeBranch(Tree=panel_14, Path="{1}", MaintainPaths=True)  # -> reverse(Branch)
recolor_mesh = RecolorMesh(Mesh=python.mesh, Result=connect_me_to_yearly, ListOfColors=colors, UpperBoundary=lng_2, Segments=lng_2)  # -> ColoredMesh, Colors, Values
python_2 = GhPythonScript(mesh=recolor_mesh.ColoredMesh, scale=Slider(1.1, range=0.5..5))  # -> out, text_point, rectangle
# ---------- python_2: Python ----------
__author__ = "kongs"
__version__ = "2020.09.15"

import rhinoscriptsyntax as rs

scale = scale or 1
bb = rs.BoundingBox(mesh)

point = bb[5]
point.X = point.X * 1.05 * scale
plane = rs.MovePlane(rs.WorldXYPlane(), point)

width = (bb[5].X - bb[4].X) * 0.15 * scale
height = (bb[3].Y - bb[4].Y)

rectangle = rs.AddRectangle(plane, width, height)

point_ = bb[0]
point_.Y = point_.Y - (height * 0.1 * scale)
text_point = rs.MovePlane(rs.WorldXYPlane(), point_)
# ---------- end python_2 ----------
# 7)
number_slider_3 = Slider(3, range=0.5..5)
legend = Legend(Colour=recolor_mesh.Colors, Tags=branch_3, Rectangle=python_2.rectangle, LegendType=1)
tag = TextTag3D(Location=python_2.text_point, Text=panel_10, Size=number_slider_3, Colour=RGB(0, 0, 0), Justification=1)

# ==== cluster AnalysisSurface: This is just cluster of GH components to create and select a analysis surface
C = ClusterInput()
B = ClusterInput()
bbox = BoundingBox(Content=C, Plane=PlaneXY(0, 0, 0))  # -> Box, Box_2
debox = DeconstructBox(Box=B)  # -> Plane, X, Y, Z
planesrf = PlaneSurface(Plane=PlaneXY(0, 0, 0), XSize=debox.X, YSize=debox.Y)
bbx = BrepBrep(BrepA=planesrf, BrepB=bbox.Box)  # -> flatten(Curves), Points
srfsplit = SurfaceSplit(Surface=planesrf, Curves=bbx.Curves)
area = Area(Geometry=srfsplit)  # -> Area, Centroid
sort = SortList(Keys=area.Area)  # -> reverse(Keys), ValuesA
item = ListItem(List=sort.Keys, Index=0, Wrap=True)
equals = Equality(FirstNumber=area.Area, SecondNumber=item)  # -> Equality, Inequality
cull = CullPattern(List=srfsplit, CullPattern=equals.Equality)
L = ClusterOutput(cull)
